# Grasshopper definition ACADIA_analysis.gh (Grasshopper 1.0.7)
# plug-ins: karambaGH

# INPUT GEOMETRY
crv = Curve([<curve referenced from the Rhino model> x45])

# ---- group: members
number_slider = Slider(44, range=0..44)
python = GhPythonScript(n=number_slider)  # -> rob_num; inputs n: Int32
# ---------- python: Python ----------
#Robot Order

order = [
2, #0
1, #1
2, #2
1, #3
2, #4
1, #5
2, #6
1, #7
2, #8
2, #9
1, #10
2, #11
2, #12
1, #13
2, #14
2, #15
1, #16
1, #17
2, #18
1, #19
2, #20
1, #21
2, #22
2, #23
2, #24
1, #25
2, #26
1, #27
2, #29
2, #28
1, #30
2, #31
1, #32
1, #33
1, #34
2, #33
2, #38
1, #36
1, #37
#done
2, #36
2, #37
2, #39
2, #41
2, #42
1, #43
]

rob_num = order[n]
# ---------- end python ----------
python_2 = GhPythonScript(n=number_slider)  # -> idx; inputs n: Int32
# ---------- python_2: Python ----------
idx = range(n+1)

print idx
# ---------- end python_2 ----------
panel = Panel(number_slider)
panel_2 = Panel(python)
data = Data(crv)
data_2 = Data(python_2)

# ---- group: nodes
pt = Point([<point referenced from the Rhino model> x17])
python_3 = GhPythonScript(n=number_slider)  # -> idx; inputs n: Int32
# ---------- python_3: Python ----------
sphere_order = {
0: 2,
1: 3,
2: 4,
3: 4,
4: 4,
5: 4,
6: 5,
7: 5,
8: 5,
9: 6,
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}

idx = range(sphere_order[n])

print idx
# ---------- end python_3 ----------
data_3 = Data(pt)
data_4 = Data(python_3)

# ----
num = Number()

# ----
# INPUT PARAMETERS
# can update placement plane location manually during path planning or use default "place_far" value
panel_3 = Panel("C:/Users/Edvard/Documents/GitHub/workshop_princeton_2021/ACADIA/input_data/")
panel_4 = Panel("C:/Users/Edvard/Documents/GitHub/workshop_princeton_2021/ACADIA/input_data/")
python_4 = GhPythonScript(path=panel_4, filename="member_rotations.json", read_data=Toggle(True))  # -> rotations
# ---------- python_4: Python ----------
import os
from compas_fab.utilities import read_data_from_json
from compas_fab.robots import Configuration

if read_data:
    data = read_data_from_json(os.path.join(path, filename))
    
    
print len(data)
print data
print data['member_29']

rotations = []
for i in range(len(data)):
    rotations.append(data['member_{}'.format(i)])

print rotations
# ---------- end python_4 ----------
python_5 = GhPythonScript(path=panel_3, filename="input_params.json", read_data=Toggle(True))  # -> node_diameter, member_offset, cross_section, place_close, place_far
# ---------- python_5: Python ----------
import os
from compas_fab.utilities import read_data_from_json

if read_data:
    data = read_data_from_json(os.path.join(path, filename))

print data

node_diameter = data['node_diameter']
member_offset = data['member_dist_from_node']
cross_section = data['cross_section_dim']
place_far = data['offset_place_far']
place_close = data['offset_place_close']
# ---------- end python_5 ----------
num_2 = Number(python_5.node_diameter)
num_3 = Number(python_5.member_offset)
num_4 = Number(python_5.cross_section)
num_5 = Number(python_5.place_close)
data_5 = Data(python_4)
num_6 = Number(num)

# ---- group: cross-section
# 1 3/16" (30.16mm) section.
# this dist is to corner
panel_5 = Panel(num_4)
division = Division(A=panel_5, B="sqrt(2)")
polygon = Polygon(Plane=PlaneXY(0, 0, 0), Radius=division, Segments="4", FilletRadius=0)  # -> Polygon, Length
rotate = Rotate(Geometry=polygon.Polygon, Angle=degrees("45"), Plane=PlaneXY(0, 0, 0))  # -> Geometry, Transform
# DEFINE KARAMBA ELEMENTS
crv_2 = Curve(rotate.Geometry)

# ----
num_7 = Number(python_5.place_far)

division_2 = Division(A="1050", B="3")
matprops = MaterialPropertiesKaramba3D(
    FamilyOfMaterial="wood",
    Name="poplar",
    YoungsModulus_kN_cm2="1050",
    InPlaneShearModulus_kN_cm2=division_2,
    TransverseShearModulus_kN_cm2=division_2,
    SpecificWeight_kN_m3="6",
    CoefficientOfThermalExpansion_1_C=1e-05,
    YieldStrength_kN_cm2=23.5,
    mode="Isotrop")
num_8 = Number(panel_5)
multiplication = Multiplication(A=num_8, B=100)
material = MaterialKaramba3D(matprops)
number = Number(multiplication)
number_2 = Number(multiplication)
cross_section = CrossSectionKaramba3D(
    FamilyNameOfCrossSection="DefaultCroSec",
    Material=material,
    Height_cm=number,
    UpperFlangeWidth_cm=number_2,
    LowerFlangeWidth_cm=number_2,
    mode="Trapezoid")
crosec = CrossSectionKaramba3D(cross_section)

# ---- group: current member curves
data_6 = Data(data_2)
data_7 = Data(data)
item = ListItem(List=data_7, Index=data_6, Wrap=True)
crv_3 = Curve(item)

# ---- group: member info
len = Length(Curve=crv_3)
midpt = CurveMiddle(Curve=crv_3)
panel_6 = Panel(num_3)
panel_7 = Panel(num_2)
pl = PlaneNormal(Origin=midpt, ZAxis=crv_3)
python_6 = GhPythonScript(radius=panel_7, offset=panel_6, len=len)  # -> z_factor; inputs len: list
# ---------- python_6: Python ----------
len_reduce = (radius + offset)*2

z_factor = [(l - len_reduce)/l for l in len]
# ---------- end python_6 ----------

# ---- group: member meshes
pframes = PerpFrames(Curve=crv_3, Count=1, Align=True)  # -> Frames, Parameters
crv_4 = Curve(crv_2)
orient = Orient(Geometry=crv_4, Source=PlaneXY(0, 0, 0), Target=simplify(pframes.Frames))  # -> Geometry, Transform
swp1 = Sweep1(Rail=graft(crv_3), Sections=orient.Geometry, Miter=1)

# ---- group: member rotations about axis
data_8 = Data(data_5)
data_9 = Data(data_2)
item_2 = ListItem(List=data_8, Index=data_9, Wrap=True)
panel_8 = Panel(item_2)

# ---- group: nodes
data_10 = Data(data_3)
data_11 = Data(data_4)
panel_9 = Panel(num_2)
item_3 = ListItem(List=data_10, Index=data_11, Wrap=True)
sph = Sphere(Base=item_3, Radius=panel_9)

# ----
# split into supportmembers (fixed at base) and normal members (pinned both ends)
panel_10 = Panel("""3
39
3""")
python_7 = GhPythonScript()  # -> ele_sup_start, ele_norm, ele_sup_end
# ---------- python_7: Python ----------
ele_sup_start = []
for i in range(3):
    ele_sup_start.append("{}_sup_1".format(i))
    ele_sup_start.append("{}_sup_2".format(i))
    
ele_sup_end = []
for i in range(42,45):
    ele_sup_end.append("{}_sup_1".format(i))
    ele_sup_end.append("{}_sup_2".format(i))
    

#ele_norm = []
#for i in range(3,42):
#    ele_norm.append("{}_norm".format(i))
    
ele_norm = []
for i in range(3,42):
    ele_norm.append("{}_norm_1".format(i))
    ele_norm.append("{}_norm_2".format(i))
    
print ele_norm
# ---------- end python_7 ----------
vec = Vector([Vector(-0.9853303771, 0, 0.1706576925), Vector(0.905402374, 0, -0.4245545208), Vector(0.1599355752, 0.9684205669, 0.1912647836), Vector(-0.8783972285, -0.4305993595, 0.2073704427), Vector(0.1098924174, 0.9205970569, -0.3747328587), Vector(0.760114408, -0.5200522929, -0.3895788744)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])
crv_5 = Curve(crv)
partition = PartitionList(List=crv_5, Size=panel_10)  # -> simplify(Chunks)
partition_2 = PartitionList(List=vec, Size=panel_10)  # -> simplify(Chunks)
bang = ExplodeTree(Data=partition)  # -> Branch0, Branch1, Branch2
bang_2 = ExplodeTree(Data=partition_2)  # -> Branch0, Branch1, Branch2
crv_6 = Curve(bang.Branch0)
crv_7 = Curve(bang.Branch1)
crv_8 = Curve(bang.Branch2)
vec_2 = Vector(bang_2.Branch0)
vec_3 = Vector(bang_2.Branch1)
vec_4 = Vector(bang_2.Branch2)
txt = Text(python_7.ele_sup_start)
txt_2 = Text(python_7.ele_norm)
txt_3 = Text(python_7.ele_sup_end)

# ----
# STRUCTURE AT CURRENT STAGE OF CONSTRUCTION
pln = Plane(pl)
pt_2 = Point(midpt)

pt_3 = Point(pt)
item_4 = ListItem(List=pt_3, Index=0, Wrap=True)  # -> Item1, Item
pt_4 = Point(item_4.Item)
pt_5 = Point(item_4.Item1)
supp = SupportKaramba3D(PosInd=pt_4, menu=[buttons(on, on, on, on, on, on)])
supp_2 = SupportKaramba3D(PosInd=pt_5, menu=[buttons(on, on, on, on, on, on)])
support = SupportKaramba3D(supp)
support_2 = SupportKaramba3D(supp_2)

divide = DivideCurve(Curve=crv_8, Count=2, Kinks=False)  # -> Points, Tangents, Parameters
shatter = Shatter(Curve=graft(crv_8), Parameters=divide.Parameters)
vec_5 = Vector(vec_4)
dup = DuplicateData(Data=graft(vec_5), Number=2, Order=True)
crv_9 = Curve(shatter)
txt_4 = Text(txt_3)
graft = GraftTree(Tree=dup, IncludeEmptyLists=True, IncludeNullItems=True)
graft_2 = GraftTree(Tree=crv_9, IncludeEmptyLists=True, IncludeNullItems=True)
graft_3 = GraftTree(Tree=txt_4, IncludeEmptyLists=True, IncludeNullItems=True)
crosec_2 = CrossSectionKaramba3D(crosec)
linetobeam = LineToBeamKaramba3D(
    Line=graft_2,
    Identifier=graft_3,
    CrossSection=crosec_2,
    New=True,
    Remove=True,
    LimitDistance_m=0.005,
    ZOrientation=graft,
    Bending=Toggle(True))  # -> simplify(Element), Points, Info
element = ElementKaramba3D(linetobeam.Element)

divide_2 = DivideCurve(Curve=crv_7, Count=2, Kinks=False)  # -> Points, Tangents, Parameters
shatter_2 = Shatter(Curve=graft(crv_7), Parameters=divide_2.Parameters)
vec_6 = Vector(vec_3)
dup_2 = DuplicateData(Data=graft(vec_6), Number=2, Order=True)
crv_10 = Curve(shatter_2)
txt_5 = Text(txt_2)
graft_4 = GraftTree(Tree=dup_2, IncludeEmptyLists=True, IncludeNullItems=True)
graft_5 = GraftTree(Tree=crv_10, IncludeEmptyLists=True, IncludeNullItems=True)
graft_6 = GraftTree(Tree=txt_5, IncludeEmptyLists=True, IncludeNullItems=True)
crosec_3 = CrossSectionKaramba3D(crosec)
linetobeam_2 = LineToBeamKaramba3D(
    Line=graft_5,
    Identifier=graft_6,
    CrossSection=crosec_3,
    New=True,
    Remove=True,
    LimitDistance_m=0.005,
    ZOrientation=graft_4,
    Bending=Toggle(True))  # -> simplify(Element), Points, Info
element_2 = ElementKaramba3D(linetobeam_2.Element)

divide_3 = DivideCurve(Curve=crv_6, Count=2, Kinks=False)  # -> Points, Tangents, Parameters
shatter_3 = Shatter(Curve=graft(crv_6), Parameters=divide_3.Parameters)
vec_7 = Vector(vec_2)
dup_3 = DuplicateData(Data=graft(vec_7), Number=2, Order=True)
crv_11 = Curve(shatter_3)
txt_6 = Text(txt)
graft_7 = GraftTree(Tree=dup_3, IncludeEmptyLists=True, IncludeNullItems=True)
graft_8 = GraftTree(Tree=crv_11, IncludeEmptyLists=True, IncludeNullItems=True)
graft_9 = GraftTree(Tree=txt_6, IncludeEmptyLists=True, IncludeNullItems=True)
crosec_4 = CrossSectionKaramba3D(crosec)
linetobeam_3 = LineToBeamKaramba3D(
    Line=graft_8,
    Identifier=graft_9,
    CrossSection=crosec_4,
    New=True,
    Remove=True,
    LimitDistance_m=0.005,
    ZOrientation=graft_7,
    Bending=Toggle(True))  # -> simplify(Element), Points, Info
element_3 = ElementKaramba3D(linetobeam_3.Element)

Z = UnitZ(Factor="-0.01")
pt_6 = Point(pt)
loads = LoadsKaramba3D(Vector=Vector(0, 0, -1), LCase=0, mode="Gravity")
loads_2 = LoadsKaramba3D(ForceVector=Z, Local=False, PosInd=pt_6, LCase=0, mode="Point")
load = LoadKaramba3D(loads)
load_2 = LoadKaramba3D(loads_2)

# ----
# ELEMENTS
# use poplar wood as the material
entwine = Entwine(Branch00=element_3, Branch01=element_2, Branch02=element, FlattenInputs=True)
element_4 = ElementKaramba3D(simplify(flatten(entwine)))

# ----
# LOADS
# self-weight for all members, with an additional 1kg point load at each support to represent the weight of the nodes. Need to weigh this later.
merge = Merge(Data1=load, Data2=load_2)
load_3 = LoadKaramba3D(merge)

lng = ListLength(List=load_3)
lng_2 = ListLength(List=load_3)
lng_3 = ListLength(List=element_4)
lng_4 = ListLength(List=element_4)
subtraction = Subtraction(A=lng, B="8")
split = SplitList(List=load_3, Index=subtraction)  # -> ListA, ListB
subtraction_2 = Subtraction(A=lng_2, B="4")
split_2 = SplitList(List=load_3, Index=subtraction_2)  # -> ListA, ListB
subtraction_3 = Subtraction(A=lng_3, B="24")
split_3 = SplitList(List=element_4, Index=subtraction_3)  # -> ListA, ListB
subtraction_4 = Subtraction(A=lng_4, B="48")
split_4 = SplitList(List=element_4, Index=subtraction_4)  # -> ListA, ListB
load_4 = LoadKaramba3D(split.ListA)
element_5 = ElementKaramba3D(split_3.ListA)
load_5 = LoadKaramba3D(split_2.ListA)
element_6 = ElementKaramba3D(split_4.ListA)

panel_11 = Panel("""9999
17
13
10
12
9
11
14,15,16,18,19,20""")
python_8 = GhPythonScript(n="6", rob1="16", rob2="6")  # -> support_list; inputs n: Int32
# ---------- python_8: Python ----------
support_list = []

for i in range(n+1):
    support_list.append("{},{}".format(rob1,rob2))

support_list.append(rob2)

print support_list
# ---------- end python_8 ----------
panel_12 = Panel(python_8)
python_9 = GhPythonScript(n=Slider(0, range=0..7), remove_eles=panel_11, support_eles=python_8)  # -> remove_ids, support_idx; inputs n: Int32, remove_eles: list, support_eles: list
# ---------- python_9: Python ----------
def split_and_append(list_in):
    list_out = []
    for row in list_in:
        list = row.split(',')
        for item in list:
            list_out.append(item)

    return list_out
    
remove_list = split_and_append(remove_eles[1:n+1])
support_list = split_and_append([support_eles[n]])

# turn elements to remove into equivalent text tags
remove_ids = []
for num in remove_list:
    remove_ids.append("{}_norm_1".format(num))
    remove_ids.append("{}_norm_2".format(num))

support_idx = [int(x) for x in support_list]

print remove_ids
print support_idx
# ---------- end python_9 ----------
panel_13 = Panel(python_9.remove_ids)
txt_7 = Text(python_9.remove_ids)
python_10 = GhPythonScript(remove_ids=txt_7)  # -> remove_index; inputs remove_ids: list
# ---------- python_10: Python ----------
remove_index = []
for remove_id in remove_ids:
    member_number = int(remove_id.split('_')[0])
    member_piece = int(remove_id.split('_')[2])
    
    remove_index.append(member_number*2 + (member_piece-1))
    
print remove_index
# ---------- end python_10 ----------
panel_14 = Panel(python_10)

panel_15 = Panel("""9999
28
26
25
23
21
22
27,28,29,30,31,32""")
python_11 = GhPythonScript(n="6", rob1="31", rob2="16")  # -> support_list; inputs n: Int32; same code as python_8
panel_16 = Panel(python_11)
python_12 = GhPythonScript(n=Slider(0, range=0..7), remove_eles=panel_15, support_eles=python_11)  # -> remove_ids, support_idx; inputs n: Int32, remove_eles: list, support_eles: list; same code as python_9
panel_17 = Panel(python_12.remove_ids)
txt_8 = Text(python_12.remove_ids)
python_13 = GhPythonScript(remove_ids=txt_8)  # -> remove_index; inputs remove_ids: list; same code as python_10
panel_18 = Panel(python_13)

panel_19 = Panel("""999
38
34
37
33
36
35
39,40,41,42,43,44""")
python_14 = GhPythonScript(n="6", rob1="31", rob2="40")  # -> support_list; inputs n: Int32
# ---------- python_14: Python ----------
support_list = []

for i in range(n+1):
    support_list.append("{},{}".format(rob1,rob2))

support_list.append(rob1)

print support_list
# ---------- end python_14 ----------
panel_20 = Panel(python_14)
python_15 = GhPythonScript(n=Slider(7, range=0..7), remove_eles=panel_19, support_eles=python_14)  # -> remove_ids, support_idx; inputs n: Int32, remove_eles: list, support_eles: list; same code as python_9
panel_21 = Panel(python_15.support_idx)
panel_22 = Panel(python_15.remove_ids)
txt_9 = Text(python_15.remove_ids)
python_16 = GhPythonScript(remove_ids=txt_9)  # -> remove_index; inputs remove_ids: list; same code as python_10
panel_23 = Panel(python_16)

list = ValueList({"1st phase": 0, "2nd phase": 1, "3rd phase": 2}, selected="1st phase")
num_9 = Number(python_15.support_idx)
num_10 = Number(python_12.support_idx)
num_11 = Number(python_9.support_idx)
filter = StreamFilter(Gate=list, Stream0=num_9, Stream1=num_10, Stream2=num_11)

merge_2 = Merge(
    Data1=ColourSwatch(SwatchColor=RGB(251, 255, 0)),
    Data2=ColourSwatch(SwatchColor=RGB(255, 255, 255)),
    Data3=ColourSwatch(SwatchColor=RGB(255, 255, 255)),
    Data4=ColourSwatch(SwatchColor=RGB(255, 255, 255)),
    Data5=ColourSwatch(SwatchColor=RGB(227, 0, 0)),
    Data6=ColourSwatch(SwatchColor=RGB(21, 255, 0)))
col = Colour(merge_2)  # disabled

# ----
# remove double joints at end, but keep orientation consistent
vec_8 = Vector(vec)

# ----
# SUPPORTS
# treat initial support as fixed, while the other end is pinned. This is closer to how the actual structure behaves based on the types of supports used. Could potentially add some moment support at end...
# 
# The robot grips the middle of the member as a fixed support
num_12 = Number(filter)
crv_12 = Curve(crv_5)

item_5 = ListItem(List=crv_12, Index=num_12, Wrap=False)  # -> simplify(graft(Item))
item_6 = ListItem(List=vec_8, Index=num_12, Wrap=False)  # -> simplify(graft(Item))
end = EndPoints(Curve=item_5)  # -> Start, End
midpt_2 = CurveMiddle(Curve=item_5)
vec_9 = Vector(item_5)
pl_2 = ConstructPlane(Origin=midpt_2, XAxis=vec_9, YAxis=item_6)
rot3d = Rotate3D(Geometry=graft(pl_2), Angle=-1.570796327, Center=graft(midpt_2), Axis=graft(vec_9))  # -> Geometry, Transform
pln_2 = Plane(graft(rot3d.Geometry))

pt_7 = Point(flatten([end.Start, end.End]))
pt_8 = Point(graft(midpt_2))
supp_3 = SupportKaramba3D(PosInd=pt_8, PlaneOfReference=pln_2, menu=[buttons(on, on, on, on, on, on)])
support_3 = SupportKaramba3D(supp_3)

cset = CreateSet(List=flatten(pt_7))  # -> Set, Map
python_17 = GhPythonScript(n=num_12, S=cset.Set, map_index=cset.Map)  # -> S, new_tree; inputs n: list of Int32, S: list, map_index: list
# ---------- python_17: Python ----------
import ghpythonlib.treehelpers as th

#remove node if it is attached to the end support (members 0-2, 42-44)
for i,node in enumerate(n):
    if node in [0,1,2,42,43,44]:
        map_index[2*i + 1] = 0
        print S
        del S[2*i + 1]
        print S
        
print map_index

num_points = int(len(map_index)/2)

new_list = []
save_list = []
for i in range(num_points):
    x,y = map_index[i*2:i*2+2]
    print x,y
    print new_list
    
    if not x in save_list and not y in save_list:
        save_list.append(x)
        save_list.append(y)
        new_list.append([0,0])
    elif not x in save_list:
        save_list.append(x)
        new_list.append([0])
    elif not y in save_list:
        save_list.append(y)
        new_list.append([0])
    else:
        new_list.append([])
        
    
    print "save_list", save_list
    print "tree", new_list
    
#    if x<=y:
#        new_list.append([x,y])
#    else:
#        new_list.append([x])
        
new_tree = th.list_to_tree(new_list)
print new_tree
# ---------- end python_17 ----------
unflatten = UnflattenTree(Tree=python_17.S, Guide=python_17.new_tree)
pt_9 = Point(unflatten)

# ----
# based on weak and strong axis bending of tab, calculate rotation angle...etc
txt_10 = Text(txt_2)
dispatch = Dispatch(List=txt_10, DispatchPattern=[True, False])  # -> ListA, ListB
panel_24 = Panel(dispatch.ListA)
panel_25 = Panel(dispatch.ListB)
txt_11 = Text(graft(dispatch.ListB))
beam_joints = BeamJointsKaramba3D(
    ElementIdentifiers=txt_11,
    CtKNMAtStartingNode=Vector(0, 0, 0),
    CrKNmRadAtStartingNode=Vector(0, 0, 0),
    CtKNMAtEndNode=Vector(0, 0, 0),
    CrKNmRadAtEndNode="{999999,0.03,0.33}",
    menu=[buttons(off, off, off, off, off, off), buttons(off, off, off, off, on, on)])
joint = JointKaramba3D(beam_joints)

# ----
# JOINTS
# pin all the ends of the members, but leave the middle node (where the robot grips) as a full connection to represent the fact that the member is continuous here. Leave torsional resistance at the joints to represent the fact that the tabs will not allow members to twist about their own axis.
# 
# Do not but a joint at the ends of the support members, since they are connected to the base. Currently a torsional rigid body mode exists when but supports are assigned a joint at one end, doesn't affect results but for now keep top of start support elements without a joint
txt_12 = Text(txt)
txt_13 = Text(txt_3)
dispatch_2 = Dispatch(List=txt_12, DispatchPattern=[True, False])  # -> ListA, ListB; disabled
dispatch_3 = Dispatch(List=txt_13, DispatchPattern=[True, False])  # -> ListA, ListB
merge_3 = Merge(Data1=dispatch_2.ListA, Data2=dispatch.ListA, Data3=dispatch_3.ListA)

txt_14 = Text(graft(merge_3))
beam_joints_2 = BeamJointsKaramba3D(
    ElementIdentifiers=txt_14,
    CtKNMAtStartingNode=Vector(0, 0, 0),
    CrKNmRadAtStartingNode="{999999,0.03,0.33}",
    CtKNMAtEndNode=Vector(0, 0, 0),
    CrKNmRadAtEndNode=Vector(0, 0, 0),
    menu=[buttons(off, off, off, off, on, on), buttons(off, off, off, off, off, off)])
joint_2 = JointKaramba3D(beam_joints_2)

merge_4 = Merge(Data1=graft(joint_2), Data2=graft(joint))  # -> flatten(Result)

joint_3 = JointKaramba3D(merge_4)

lng_5 = ListLength(List=joint_3)
lng_6 = ListLength(List=joint_3)
subtraction_5 = Subtraction(A=lng_5, B="45")
split_5 = SplitList(List=joint_3, Index=subtraction_5)  # -> ListA, ListB
subtraction_6 = Subtraction(A=lng_6, B="21")
split_6 = SplitList(List=joint_3, Index=subtraction_6)  # -> ListA, ListB
joint_4 = JointKaramba3D(split_5.ListA)
joint_5 = JointKaramba3D(split_6.ListA)

supp_4 = SupportKaramba3D(PosInd=pt_9, PlaneOfReference=pln_2, menu=[buttons(on, on, on, on, on, on)])
support_4 = SupportKaramba3D(supp_4)

entwine_2 = Entwine(Branch00=support_4, Branch01=support_3, Branch02=support, Branch03=support_2, FlattenInputs=True)  # -> flatten(Result)

support_5 = SupportKaramba3D(flatten(entwine_2))

lng_7 = ListLength(List=support_5)
subtraction_7 = Subtraction(A=lng_7, B="1")
split_7 = SplitList(List=support_5, Index=subtraction_7)  # -> ListA, ListB
support_6 = SupportKaramba3D(split_7.ListA)

element_7 = ElementKaramba3D(flatten(element_6))
support_7 = SupportKaramba3D(flatten(support_6))
load_6 = LoadKaramba3D(flatten(load_4))
joint_6 = JointKaramba3D(flatten(joint_4))
assemble = AssembleModelKaramba3D(Elem=flatten(element_7), Support=flatten(support_7), Load=flatten(load_6), Joint=flatten(joint_6), LimitDistance_m=0.005)  # -> Model, Info, Mass_kg, CenterOfGravity

support_8 = SupportKaramba3D(flatten(support_6))
element_8 = ElementKaramba3D(flatten(element_5))
load_7 = LoadKaramba3D(flatten(load_5))
joint_7 = JointKaramba3D(flatten(joint_5))
assemble_2 = AssembleModelKaramba3D(Elem=flatten(element_8), Support=flatten(support_8), Load=flatten(load_7), Joint=flatten(joint_7), LimitDistance_m=0.005)  # -> Model, Info, Mass_kg, CenterOfGravity

element_9 = ElementKaramba3D(flatten(element_4))
support_9 = SupportKaramba3D(flatten(support_5))
load_8 = LoadKaramba3D(flatten(load_3))
joint_8 = JointKaramba3D(flatten(joint_3))
assemble_3 = AssembleModelKaramba3D(Elem=flatten(element_9), Support=flatten(support_9), Load=flatten(load_8), Joint=flatten(joint_8), LimitDistance_m=0.005)  # -> Model, Info, Mass_kg, CenterOfGravity

analyze = AnalyzeKaramba3D(Model=assemble.Model)  # -> CalculatedModel, MaximumDisplacement_cm, ResultingForceOfGravity_kN, ElasticEnergy_kNm
num_13 = Number(analyze.ElasticEnergy_kNm)
num_14 = Number(analyze.MaximumDisplacement_cm)
model = ModelKaramba3D(analyze.CalculatedModel)

line = Line(crv_11)
line_2 = Line(crv_10)
line_3 = Line(crv_9)
entwine_3 = Entwine(Branch00=line, Branch01=line_2, Branch02=line_3, FlattenInputs=True)  # -> flatten(Result)
crv_13 = Curve(entwine_3)
num_15 = Number(python_10)
python_18 = GhPythonScript(x=crv_13, off_idx=num_15)  # -> out, on_list; inputs x: list, off_idx: list of Int32
# ---------- python_18: Python ----------
num = len(x)

on_list = []
for i in range(num):
    on_list.append(True)
    
for idx in off_idx:
    on_list[idx] = False
    
print on_list
# ---------- end python_18 ----------
model_2 = ModelKaramba3D(model)
activate = ElementActivationKaramba3D(Model=model_2, IsActive=python_18.on_list)

analyze_2 = AnalyzeKaramba3D(Model=activate)  # -> CalculatedModel, MaximumDisplacement_cm, ResultingForceOfGravity_kN, ElasticEnergy_kNm
model_3 = ModelKaramba3D(analyze_2.CalculatedModel)
num_16 = Number(analyze_2.MaximumDisplacement_cm)
num_17 = Number(analyze_2.ElasticEnergy_kNm)

analyze_3 = AnalyzeKaramba3D(Model=assemble_2.Model)  # -> CalculatedModel, MaximumDisplacement_cm, ResultingForceOfGravity_kN, ElasticEnergy_kNm
num_18 = Number(analyze_3.MaximumDisplacement_cm)
num_19 = Number(analyze_3.ElasticEnergy_kNm)
model_4 = ModelKaramba3D(analyze_3.CalculatedModel)

line_4 = Line(crv_11)
line_5 = Line(crv_10)
line_6 = Line(crv_9)
entwine_4 = Entwine(Branch00=line_4, Branch01=line_5, Branch02=line_6, FlattenInputs=True)  # -> flatten(Result)
crv_14 = Curve(entwine_4)
num_20 = Number(python_13)
python_19 = GhPythonScript(x=crv_14, off_idx=num_20)  # -> out, on_list; inputs x: list, off_idx: list of Int32; same code as python_18
model_5 = ModelKaramba3D(model_4)
activate_2 = ElementActivationKaramba3D(Model=model_5, IsActive=python_19.on_list)

analyze_4 = AnalyzeKaramba3D(Model=activate_2)  # -> CalculatedModel, MaximumDisplacement_cm, ResultingForceOfGravity_kN, ElasticEnergy_kNm
model_6 = ModelKaramba3D(analyze_4.CalculatedModel)
num_21 = Number(analyze_4.MaximumDisplacement_cm)
num_22 = Number(analyze_4.ElasticEnergy_kNm)

analyze_5 = AnalyzeKaramba3D(Model=assemble_3.Model)  # -> CalculatedModel, MaximumDisplacement_cm, ResultingForceOfGravity_kN, ElasticEnergy_kNm
model_7 = ModelKaramba3D(analyze_5.CalculatedModel)
num_23 = Number(analyze_5.MaximumDisplacement_cm)
num_24 = Number(analyze_5.ElasticEnergy_kNm)

line_7 = Line(crv_11)
line_8 = Line(crv_10)
line_9 = Line(crv_9)
entwine_5 = Entwine(Branch00=line_7, Branch01=line_8, Branch02=line_9, FlattenInputs=True)  # -> flatten(Result)
crv_15 = Curve(entwine_5)
num_25 = Number(python_16)
python_20 = GhPythonScript(x=crv_15, off_idx=num_25)  # -> out, on_list; inputs x: list, off_idx: list of Int32; same code as python_18
model_8 = ModelKaramba3D(model_7)
activate_3 = ElementActivationKaramba3D(Model=model_8, IsActive=python_20.on_list)

analyze_6 = AnalyzeKaramba3D(Model=activate_3)  # -> CalculatedModel, MaximumDisplacement_cm, ResultingForceOfGravity_kN, ElasticEnergy_kNm
model_9 = ModelKaramba3D(analyze_6.CalculatedModel)
num_26 = Number(analyze_6.MaximumDisplacement_cm)
num_27 = Number(analyze_6.ElasticEnergy_kNm)

internal_energy = Panel(num_13)
deflection_cm = Panel(num_14)
deflection_cm_2 = Panel(num_16)
internal_energy_2 = Panel(num_17)

deflection_cm_3 = Panel(num_23)
internal_energy_3 = Panel(num_24)
deflection_cm_4 = Panel(num_26)
internal_energy_4 = Panel(num_27)

deflection_cm_5 = Panel(num_18)
internal_energy_5 = Panel(num_19)
deflection_cm_6 = Panel(num_21)
internal_energy_6 = Panel(num_22)

num_28 = Number(num_27)
num_29 = Number(num_22)
num_30 = Number(num_17)
model_10 = ModelKaramba3D(model_9)
model_11 = ModelKaramba3D(model_6)
model_12 = ModelKaramba3D(model_3)
filter_2 = StreamFilter(Gate=list, Stream0=num_28, Stream1=num_29, Stream2=num_30)
rec = DataRecorder(filter_2, DataLimit=-10, RecordData=True)
data_12 = Data(rec)
data_13 = Data(data_12)
total = Panel(data_13)
filter_3 = StreamFilter(Gate=list, Stream0=model_10, Stream1=model_11, Stream2=model_12)

model_13 = ModelKaramba3D(filter_3)
model_14 = ModelKaramba3D(model_13)
model_15 = ModelKaramba3D(model_13)
model_16 = ModelKaramba3D(model_13)
model_17 = ModelKaramba3D(model_13)
model_18 = ModelKaramba3D(model_13)
beamdisp = BeamDisplacementsKaramba3D(AnalyzedModel=model_14, LoadCase=-1, MaximumDistanceBetweenResults_m=-1, NumberOfResultsPerElement=2)  # -> AnalyzedModel, Translations_m, Rotations_rad
utilization = UtilizationOfElementsKaramba3D(
    AnalyzedModel=model_16,
    ResultCase=-1,
    NumberOfSamplePoints=3,
    ElasticDesign=True,
    GammaM0=1,
    GammaM1=1,
    WithDetails=False,
    mode="Beams")  # -> AnalyzedModel, Utilization, SigMax_kN_cm2, SigMin_kN_cm2, TauMax_kN_cm2, UtilN, UtilVy, UtilVz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
nodedisp = NodalDisplacementsKaramba3D(AnalyzedModel=model_17, ResultCase=0)  # -> AnalyzedModel, NodalTranslations_m, NodalRotations_rad
d_energy = DeformationEnergyKaramba3D(AnalyzedModel=model_18, ResultCase=0)  # -> AnalyzedModel, flatten(AxialDeformationEnergies_kNm), flatten(BendingEnergies_kNm)
modelview = ModelViewKaramba3D(Model=model_15, ResultFactors="1000", ResultCase=-1, Colors=col)  # -> Model, DeformedMesh, DeformedAxes, DeformedModel
panel_26 = Panel(d_energy.AxialDeformationEnergies_kNm)
panel_27 = Panel(d_energy.BendingEnergies_kNm)
beamview = BeamViewKaramba3D(Model=modelview.Model)  # -> Model, MeshesOfRenderedBeams, DeformedBeamAxes, LegendColors, LegendTags
panel_28 = Panel(nodedisp.NodalTranslations_m)
legend = Legend(Colour=beamview.LegendColors, Tags=beamview.LegendTags, LegendType=101)
panel_29 = Panel(beamdisp.Translations_m)

ma = MassAddition(Input=d_energy.BendingEnergies_kNm)  # -> Result, PartialResults
ma_2 = MassAddition(Input=d_energy.AxialDeformationEnergies_kNm)  # -> Result, PartialResults
lng_8 = ListLength(List=d_energy.AxialDeformationEnergies_kNm)
division_3 = Division(A=ma.Result, B=lng_8)
division_4 = Division(A=ma_2.Result, B=lng_8)
rec_2 = DataRecorder(division_4, DataLimit=-10, RecordData=True)
rec_3 = DataRecorder(division_3, DataLimit=-10, RecordData=True)
data_14 = Data(rec_2)
data_15 = Data(rec_3)
data_16 = Data(data_14)
data_17 = Data(data_15)
bending = Panel(data_17)
axial = Panel(data_16)
entwine_6 = Entwine(Branch00=total, Branch01=axial, Branch02=bending, FlattenInputs=True)

panel_30 = Panel("""6
7""")
entwine_7 = Entwine(Branch00=panel_30, Branch02="6", FlattenInputs=True)

data_18 = Data(Tree({0;0}: ["1.3692e-6", "1.3377e-6", "1.3265e-6", "1.3432e-6", "1.4531e-6", "1.437e-6", "1.4287e-6", "22657.064928"], {0;1}: ["9.0949e-9", "9.3009e-9", "9.5162e-9", "1.0168e-8", "1.1638e-8", "1.19e-8", "1.2205e-8", "1.1876e-8"], {0;2}: ["5.5351e-9", "5.303e-9", "5.2971e-9", "5.2035e-9", "5.2858e-9", "5.2491e-9", "5.277e-9", "5.9099e-9"]))
replace = ReplaceItems(List=data_18, Item=0, Indices=entwine_7, Wrap=False)
ma_3 = MassAddition(Input=replace)  # -> Result, PartialResults

data_19 = Data(Tree({0;0}: ["1.4701e-6", "1.4386e-6", "1.4274e-6", "1.4085e-6", "1.405e-6", "1.4585e-6", "2.6865e-6", "17142.036622"], {0;1}: ["9.7394e-9", "9.96e-9", "1.0191e-8", "1.0433e-8", "1.0688e-8", "1.1529e-8", "2.278e-8", "2.9416e-8"], {0;2}: ["5.6103e-9", "5.38e-9", "5.3759e-9", "5.279e-9", "5.3658e-9", "5.3898e-9", "5.953e-9", "6.5604e-9"]))
replace_2 = ReplaceItems(List=data_19, Item=0, Indices=entwine_7, Wrap=False)
ma_4 = MassAddition(Input=replace_2)  # -> Result, PartialResults

data_20 = Data(Tree({0;0}: ["1.3361e-6", "1.3047e-6", "1.2973e-6", "1.2784e-6", "1.2749e-6", "1.2589e-6", "1.2505e-6", "7465.65999"], {0;1}: ["8.9414e-9", "9.1024e-9", "9.2855e-9", "9.5066e-9", "9.7383e-9", "9.9532e-9", "1.0208e-8", "1.5331e-8"], {0;2}: ["5.4669e-9", "5.3016e-9", "5.3325e-9", "5.2347e-9", "5.3203e-9", "5.2845e-9", "5.3133e-9", "5.6723e-9"]))
replace_3 = ReplaceItems(List=data_20, Item=0, Indices=entwine_7, Wrap=False)
ma_5 = MassAddition(Input=replace_3)  # -> Result, PartialResults

data_21 = Data(Tree({0;0}: ["1.3488e-6", "1.311e-6", "1.3036e-6", "1.2794e-6", "1.2759e-6", "1.2627e-6", "1.2543e-6", "7465.65999"], {0;1}: ["8.981e-9", "9.1467e-9", "9.3308e-9", "9.5031e-9", "9.7348e-9", "9.978e-9", "1.0234e-8", "1.5331e-8"], {0;2}: ["5.5088e-9", "5.3053e-9", "5.3364e-9", "5.2388e-9", "5.3246e-9", "5.2924e-9", "5.3214e-9", "5.6723e-9"]))
replace_4 = ReplaceItems(List=data_21, Item=0, Indices=entwine_7, Wrap=False)
ma_6 = MassAddition(Input=replace_4)  # -> Result, PartialResults

data_22 = Data(Tree({0;0}: ["1.4292e-6", "1.3957e-6", "1.3845e-6", "1.3603e-6", "1.3568e-6", "1.4623e-6", "2.6903e-6", "17142.036622"], {0;1}: ["9.408e-9", "9.6201e-9", "9.8428e-9", "1.0027e-8", "1.0272e-8", "1.1554e-8", "2.2805e-8", "2.9416e-8"], {0;2}: ["5.6419e-9", "5.3747e-9", "5.3705e-9", "5.2737e-9", "5.3603e-9", "5.3977e-9", "5.9611e-9", "6.5604e-9"]))
replace_5 = ReplaceItems(List=data_22, Item=0, Indices=entwine_7, Wrap=False)
ma_7 = MassAddition(Input=replace_5)  # -> Result, PartialResults

data_23 = Data(Tree({0;0}: ["1.3822e-6", "1.3634e-6", "1.3522e-6", "1.3442e-6", "1.4541e-6", "1.4408e-6", "1.4325e-6", "22657.064928"], {0;1}: ["9.2e-9", "9.5485e-9", "9.7695e-9", "1.0164e-8", "1.1634e-8", "1.1925e-8", "1.2231e-8", "1.1876e-8"], {0;2}: ["5.5792e-9", "5.3094e-9", "5.3036e-9", "5.2076e-9", "5.29e-9", "5.257e-9", "5.2851e-9", "5.9099e-9"]))
replace_6 = ReplaceItems(List=data_23, Item=0, Indices=entwine_7, Wrap=False)
ma_8 = MassAddition(Input=replace_6)  # -> Result, PartialResults

data_24 = Data(Tree({0;0}: ["1.3682e-6", "1.3366e-6", "1.3331e-6", "1.382e-6", "1.4457e-6", "1.4325e-6", "1.427e-6", "22657.064928"], {0;1}: ["9.111e-9", "9.3173e-9", "9.5886e-9", "1.0562e-8", "1.1584e-8", "1.1873e-8", "1.2194e-8", "1.1876e-8"], {0;2}: ["5.5233e-9", "5.291e-9", "5.2849e-9", "5.1916e-9", "5.2791e-9", "5.2458e-9", "5.2721e-9", "5.9099e-9"]))
replace_7 = ReplaceItems(List=data_24, Item=0, Indices=entwine_7, Wrap=False)
ma_9 = MassAddition(Input=replace_7)  # -> Result, PartialResults

data_25 = Data(Tree({0;0}: ["1.4397e-6", "1.4081e-6", "1.4067e-6", "1.3878e-6", "1.3903e-6", "1.654e-6", "2.6848e-6", "17142.036622"], {0;1}: ["9.5262e-9", "9.7419e-9", "1.0036e-8", "1.0274e-8", "1.0562e-8", "1.3206e-8", "2.2768e-8", "2.9416e-8"], {0;2}: ["5.5913e-9", "5.3605e-9", "5.3559e-9", "5.2586e-9", "5.3491e-9", "5.4142e-9", "5.9482e-9", "6.5604e-9"]))
replace_8 = ReplaceItems(List=data_25, Item=0, Indices=entwine_7, Wrap=False)
ma_10 = MassAddition(Input=replace_8)  # -> Result, PartialResults

data_26 = Data(Tree({0;0}: ["1.3362e-6", "1.3053e-6", "1.2879e-6", "1.269e-6", "1.2676e-6", "1.2544e-6", "1.2488e-6", "7465.65999"], {0;1}: ["8.9517e-9", "9.0988e-9", "9.2268e-9", "9.4464e-9", "9.6845e-9", "9.9264e-9", "1.0197e-8", "1.5331e-8"], {0;2}: ["5.4558e-9", "5.29e-9", "5.3204e-9", "5.2222e-9", "5.3136e-9", "5.2812e-9", "5.3084e-9", "5.6723e-9"]))
replace_9 = ReplaceItems(List=data_26, Item=0, Indices=entwine_7, Wrap=False)
ma_11 = MassAddition(Input=replace_9)  # -> Result, PartialResults

_39_t_a_b = Panel(ma_8.Result)
_39_29_t_a_b = Panel(data_23)
_40_t_a_b = Panel(ma_6.Result)
_39_30_t_a_b = Panel(data_21)
_41_t_a_b = Panel(ma_7.Result)
_39_31_t_a_b = Panel(data_22)
_42_t_a_b = Panel(ma_9.Result)
_41_29_t_a_b = Panel(data_24)
_43_t_a_b = Panel(ma_10.Result)
_41_30_t_a_b = Panel(data_25)
_44_t_a_b = Panel(ma_11.Result)
_41_31_t_a_b = Panel(data_26)
_42_t_a_b_2 = Panel(ma_3.Result)
_40_29_t_a_b = Panel(data_18)
_43_t_a_b_2 = Panel(ma_4.Result)
_40_30_t_a_b = Panel(data_19)
_44_t_a_b_2 = Panel(ma_5.Result)
_40_31_t_a_b = Panel(data_20)

panel_31 = Panel("""6
7""")
entwine_8 = Entwine(Branch00=panel_31, Branch02="6", FlattenInputs=True)

data_27 = Data(Tree({0;0}: ["1.405e-6", "1.3735e-6", "1.3623e-6", "1.3791e-6", "1.4889e-6", "1.437e-6", "1.4287e-6", "9512.010664"], {0;1}: ["9.0745e-9", "9.28e-9", "9.4948e-9", "1.0146e-8", "1.1616e-8", "1.19e-8", "1.2205e-8", "1.1915e-8"], {0;2}: ["5.9694e-9", "5.7472e-9", "5.7517e-9", "5.6688e-9", "5.7625e-9", "5.2491e-9", "5.277e-9", "5.9449e-9"]))
replace_10 = ReplaceItems(List=data_27, Item=0, Indices=entwine_8, Wrap=False)
ma_12 = MassAddition(Input=replace_10)  # -> Result, PartialResults

data_28 = Data(Tree({0;0}: ["1.5755e-6", "1.5439e-6", "1.5327e-6", "1.5138e-6", "1.5104e-6", "1.4585e-6", "2.6865e-6", "28662.715773"], {0;1}: ["1.0255e-8", "1.0488e-8", "1.073e-8", "1.0986e-8", "1.1254e-8", "1.1529e-8", "2.278e-8", "1.9673e-8"], {0;2}: ["6.0969e-9", "5.8776e-9", "5.8851e-9", "5.8003e-9", "5.8998e-9", "5.3898e-9", "5.953e-9", "6.2372e-9"]))
replace_11 = ReplaceItems(List=data_28, Item=0, Indices=entwine_8, Wrap=False)
ma_13 = MassAddition(Input=replace_11)  # -> Result, PartialResults

data_29 = Data(Tree({0;0}: ["1.3802e-6", "1.3463e-6", "1.3429e-6", "1.324e-6", "1.3206e-6", "1.2589e-6", "1.2505e-6", "10851.905975"], {0;1}: ["8.9775e-9", "9.1266e-9", "9.3439e-9", "9.5663e-9", "9.7996e-9", "9.9532e-9", "1.0208e-8", "1.2927e-8"], {0;2}: ["5.9049e-9", "5.7127e-9", "5.7415e-9", "5.6533e-9", "5.7492e-9", "5.2845e-9", "5.3133e-9", "5.7276e-9"]))
replace_12 = ReplaceItems(List=data_29, Item=0, Indices=entwine_8, Wrap=False)
ma_14 = MassAddition(Input=replace_12)  # -> Result, PartialResults

data_30 = Data(Tree({0;0}: ["1.4182e-6", "1.3994e-6", "1.3882e-6", "1.3802e-6", "1.49e-6", "1.4408e-6", "1.4325e-6", "9512.010664"], {0;1}: ["9.2007e-9", "9.5492e-9", "9.7702e-9", "1.0165e-8", "1.1635e-8", "1.1925e-8", "1.2231e-8", "1.1915e-8"], {0;2}: ["5.9779e-9", "5.7172e-9", "5.7209e-9", "5.6348e-9", "5.7277e-9", "5.257e-9", "5.2851e-9", "5.9449e-9"]))
replace_13 = ReplaceItems(List=data_30, Item=0, Indices=entwine_8, Wrap=False)
ma_15 = MassAddition(Input=replace_13)  # -> Result, PartialResults

data_31 = Data(Tree({0;0}: ["1.5839e-6", "1.5504e-6", "1.5392e-6", "1.5149e-6", "1.5115e-6", "1.4623e-6", "2.6903e-6", "28662.715773"], {0;1}: ["1.0321e-8", "1.0553e-8", "1.0798e-8", "1.1005e-8", "1.1273e-8", "1.1554e-8", "2.2805e-8", "1.9673e-8"], {0;2}: ["6.1017e-9", "5.8449e-9", "5.8516e-9", "5.7663e-9", "5.865e-9", "5.3977e-9", "5.9611e-9", "6.2372e-9"]))
replace_14 = ReplaceItems(List=data_31, Item=0, Indices=entwine_8, Wrap=False)
ma_16 = MassAddition(Input=replace_14)  # -> Result, PartialResults

data_32 = Data(Tree({0;0}: ["1.3903e-6", "1.3498e-6", "1.3413e-6", "1.3171e-6", "1.3136e-6", "1.2627e-6", "1.2543e-6", "10851.905975"], {0;1}: ["9.0387e-9", "9.1949e-9", "9.386e-9", "9.5596e-9", "9.7927e-9", "9.978e-9", "1.0234e-8", "1.2927e-8"], {0;2}: ["5.915e-9", "5.6817e-9", "5.71e-9", "5.6214e-9", "5.7165e-9", "5.2924e-9", "5.3214e-9", "5.7276e-9"]))
replace_15 = ReplaceItems(List=data_32, Item=0, Indices=entwine_8, Wrap=False)
ma_17 = MassAddition(Input=replace_15)  # -> Result, PartialResults

data_33 = Data(Tree({0;0}: ["1.4041e-6", "1.3726e-6", "1.3691e-6", "1.4179e-6", "1.4817e-6", "1.4325e-6", "1.427e-6", "9512.010664"], {0;1}: ["9.1118e-9", "9.3181e-9", "9.5893e-9", "1.0563e-8", "1.1585e-8", "1.1873e-8", "1.2194e-8", "1.1915e-8"], {0;2}: ["5.9221e-9", "5.6988e-9", "5.7022e-9", "5.6188e-9", "5.7168e-9", "5.2458e-9", "5.2721e-9", "5.9449e-9"]))
replace_16 = ReplaceItems(List=data_33, Item=0, Indices=entwine_8, Wrap=False)
ma_18 = MassAddition(Input=replace_16)  # -> Result, PartialResults

data_34 = Data(Tree({0;0}: ["1.7017e-6", "1.6701e-6", "1.7029e-6", "1.684e-6", "1.7032e-6", "1.654e-6", "2.6848e-6", "28662.715773"], {0;1}: ["1.1268e-8", "1.1523e-8", "1.2124e-8", "1.2413e-8", "1.2885e-8", "1.3206e-8", "2.2768e-8", "1.9673e-8"], {0;2}: ["6.0688e-9", "5.8489e-9", "5.8614e-9", "5.7761e-9", "5.8811e-9", "5.4142e-9", "5.9482e-9", "6.2372e-9"]))
replace_17 = ReplaceItems(List=data_34, Item=0, Indices=entwine_8, Wrap=False)
ma_19 = MassAddition(Input=replace_17)  # -> Result, PartialResults

data_35 = Data(Tree({0;0}: ["1.378e-6", "1.3437e-6", "1.3256e-6", "1.3067e-6", "1.3053e-6", "1.2544e-6", "1.2488e-6", "10851.905975"], {0;1}: ["9.0146e-9", "9.1585e-9", "9.282e-9", "9.5029e-9", "9.7424e-9", "9.9264e-9", "1.0197e-8", "1.2927e-8"], {0;2}: ["5.8591e-9", "5.6673e-9", "5.6941e-9", "5.6048e-9", "5.7056e-9", "5.2812e-9", "5.3084e-9", "5.7276e-9"]))
replace_18 = ReplaceItems(List=data_35, Item=0, Indices=entwine_8, Wrap=False)
ma_20 = MassAddition(Input=replace_18)  # -> Result, PartialResults

_39_t_a_b_2 = Panel(ma_15.Result)
_39_29_t_a_b_2 = Panel(data_30)
_40_t_a_b_2 = Panel(ma_16.Result)
_39_30_t_a_b_2 = Panel(data_31)
_41_t_a_b_2 = Panel(ma_17.Result)
_39_31_t_a_b_2 = Panel(data_32)
_42_t_a_b_3 = Panel(ma_18.Result)
_41_29_t_a_b_2 = Panel(data_33)
_43_t_a_b_3 = Panel(ma_19.Result)
_41_30_t_a_b_2 = Panel(data_34)
_44_t_a_b_3 = Panel(ma_20.Result)
_41_31_t_a_b_2 = Panel(data_35)
_42_t_a_b_4 = Panel(ma_12.Result)
_40_29_t_a_b_2 = Panel(data_27)
_43_t_a_b_4 = Panel(ma_13.Result)
_40_30_t_a_b_2 = Panel(data_28)
_44_t_a_b_4 = Panel(ma_14.Result)
_40_31_t_a_b_2 = Panel(data_29)

panel_32 = Panel(" 31 is other support")
panel_33 = Panel("""6
7""")
entwine_9 = Entwine(Branch00=panel_33, Branch02="6", FlattenInputs=True)

data_36 = Data(Tree({0;0}: ["1.3361e-6", "1.3047e-6", "1.2973e-6", "1.2784e-6", "1.2749e-6", "1.2589e-6", "1.2505e-6", "7465.65999"], {0;1}: ["8.0473e-7", "8.0101e-7", "7.9855e-7", "7.9855e-7", "7.9854e-7", "7.9625e-7", "7.9623e-7", "1.0119e-6"], {0;2}: ["4.9202e-7", "4.6654e-7", "4.586e-7", "4.3971e-7", "4.3627e-7", "4.2276e-7", "4.1443e-7", "3.7437e-7"]))
replace_19 = ReplaceItems(List=data_36, Item=0, Indices=entwine_9, Wrap=False)
ma_21 = MassAddition(Input=replace_19)  # -> Result, PartialResults

data_37 = Data(Tree({0;0}: ["1.3362e-6", "1.3053e-6", "1.2879e-6", "1.269e-6", "1.2676e-6", "1.2544e-6", "1.2488e-6", "7465.65999"], {0;1}: ["8.0565e-7", "8.0069e-7", "7.935e-7", "7.935e-7", "7.9413e-7", "7.9411e-7", "7.9535e-7", "1.0119e-6"], {0;2}: ["4.9102e-7", "4.6552e-7", "4.5755e-7", "4.3867e-7", "4.3572e-7", "4.225e-7", "4.1406e-7", "3.7437e-7"]))
replace_20 = ReplaceItems(List=data_37, Item=0, Indices=entwine_9, Wrap=False)
ma_22 = MassAddition(Input=replace_20)  # -> Result, PartialResults

data_38 = Data(Tree({0;0}: ["1.3488e-6", "1.311e-6", "1.3036e-6", "1.2794e-6", "1.2759e-6", "1.2627e-6", "1.2543e-6", "7465.65999"], {0;1}: ["8.0829e-7", "8.0491e-7", "8.0245e-7", "7.9826e-7", "7.9825e-7", "7.9824e-7", "7.9822e-7", "1.0119e-6"], {0;2}: ["4.9579e-7", "4.6687e-7", "4.5893e-7", "4.4006e-7", "4.3661e-7", "4.2339e-7", "4.1507e-7", "3.7437e-7"]))
replace_21 = ReplaceItems(List=data_38, Item=0, Indices=entwine_9, Wrap=False)
ma_23 = MassAddition(Input=replace_21)  # -> Result, PartialResults

data_39 = Data(Tree({0;0}: ["1.363e-6", "1.3247e-6", "1.3173e-6", "1.2976e-6", "1.2941e-6", "1.309e-6", "1.3006e-6", "7465.65999"], {0;1}: ["8.2051e-7", "8.1702e-7", "8.1456e-7", "8.1372e-7", "8.1372e-7", "8.0985e-7", "8.0982e-7", "1.0119e-6"], {0;2}: ["4.9101e-7", "4.6145e-7", "4.5351e-7", "4.345e-7", "4.3105e-7", "4.3655e-7", "4.2823e-7", "3.7437e-7"]))
replace_22 = ReplaceItems(List=data_39, Item=0, Indices=entwine_9, Wrap=False)
ma_24 = MassAddition(Input=replace_22)  # -> Result, PartialResults

data_40 = Data(Tree({0;0}: ["1.4025e-6", "1.3556e-6", "1.336e-6", "1.3414e-6", "1.3935e-6", "1.3803e-6", "8.0144e-6", "7465.65999"], {0;1}: ["8.4494e-7", "8.3277e-7", "8.2464e-7", "8.3836e-7", "8.7051e-7", "8.705e-7", "8.0647e-7", "1.0119e-6"], {0;2}: ["4.9372e-7", "4.6483e-7", "4.5692e-7", "4.3896e-7", "4.3733e-7", "4.2411e-7", "4.0651e-6", "3.7437e-7"]))
replace_23 = ReplaceItems(List=data_40, Item=0, Indices=entwine_9, Wrap=False)
ma_25 = MassAddition(Input=replace_23)  # -> Result, PartialResults

data_41 = Data(Tree({0;0}: ["1.3825e-6", "1.3519e-6", "1.3317e-6", "1.3128e-6", "1.3079e-6", "1.3018e-6", "8.4594e-6", "7465.65999"], {0;1}: ["8.3606e-7", "8.3104e-7", "8.2205e-7", "8.2205e-7", "8.202e-7", "8.2296e-7", "8.0725e-7", "1.0119e-6"], {0;2}: ["4.901e-7", "4.646e-7", "4.5662e-7", "4.3773e-7", "4.3484e-7", "4.2208e-7", "4.3894e-6", "3.7437e-7"]))
replace_24 = ReplaceItems(List=data_41, Item=0, Indices=entwine_9, Wrap=False)
ma_26 = MassAddition(Input=replace_24)  # -> Result, PartialResults

_39_t_a_b_3 = Panel(ma_23.Result)
_39_t_a_b_4 = Panel(data_38)
_40_t_a_b_3 = Panel(ma_21.Result)
_40_t_a_b_4 = Panel(data_36)
_41_t_a_b_3 = Panel(ma_22.Result)
_41_t_a_b_4 = Panel(data_37)
_42_t_a_b_5 = Panel(ma_24.Result)
_42_t_a_b_6 = Panel(data_39)
_43_t_a_b_5 = Panel(ma_25.Result)
_43_t_a_b_6 = Panel(data_40)
_44_t_a_b_5 = Panel(ma_26.Result)
_44_t_a_b_6 = Panel(data_41)

panel_34 = Panel("""6
7""")
entwine_10 = Entwine(Branch00=panel_34, Branch02="6", FlattenInputs=True)

data_42 = Data(Tree({0;0}: ["2.0533e-7", "1.8992e-7", "1.8075e-7", "1.7962e-7", "1.7699e-7", "1.7233e-7", "1.9261e-6", "2025.811604"], {0;1}: ["6.3657e-8", "6.3638e-8", "6.3638e-8", "6.4606e-8", "6.4584e-8", "6.2246e-8", "6.8642e-8", "1.5963e-8"], {0;2}: ["1.1483e-7", "9.9442e-8", "9.0272e-8", "8.9247e-8", "8.664e-8", "8.6118e-8", "5.4976e-7", "1.5582e-8"]))
replace_25 = ReplaceItems(List=data_42, Item=0, Indices=entwine_10, Wrap=False)
ma_27 = MassAddition(Input=replace_25)  # -> Result, PartialResults

data_43 = Data(Tree({0;0}: ["2.2037e-7", "2.0215e-7", "1.8825e-7", "1.9409e-7", "1.9146e-7", "1.8983e-7", "1.9436e-6", "1725.617235"], {0;1}: ["6.9793e-8", "6.6371e-8", "6.2883e-8", "6.4514e-8", "6.4491e-8", "6.3126e-8", "6.9521e-8", "3.5816e-7"], {0;2}: ["1.1682e-7", "1.0185e-7", "9.1801e-8", "9.0923e-8", "8.8317e-8", "8.7755e-8", "5.514e-7", "1.623e-8"]))
replace_26 = ReplaceItems(List=data_43, Item=0, Indices=entwine_10, Wrap=False)
ma_28 = MassAddition(Input=replace_26)  # -> Result, PartialResults

data_44 = Data(Tree({0;0}: ["2.3621e-7", "2.1678e-7", "2.0111e-7", "2.2383e-7", "2.212e-7", "2.2002e-7", "1.9738e-6", "1813.384057"], {0;1}: ["8.5605e-8", "8.0151e-8", "7.4592e-8", "1.0547e-7", "1.0545e-7", "1.0486e-7", "1.1125e-7", "6.6548e-7"], {0;2}: ["1.1699e-7", "1.0199e-7", "9.1903e-8", "9.0957e-8", "8.835e-8", "8.786e-8", "5.515e-7", "1.6399e-8"]))
replace_27 = ReplaceItems(List=data_44, Item=0, Indices=entwine_10, Wrap=False)
ma_29 = MassAddition(Input=replace_27)  # -> Result, PartialResults

data_45 = Data(Tree({0;0}: ["2.4036e-7", "2.244e-7", "2.2021e-7", "2.1691e-7", "2.1702e-7", "2.214e-7", "1.9613e-6", "1533.915205"], {0;1}: ["8.3218e-8", "8.1603e-8", "8.546e-8", "8.1612e-8", "8.8095e-8", "1.0553e-7", "9.0726e-8", "4.5615e-7"], {0;2}: ["1.1681e-7", "1.0186e-7", "9.1809e-8", "9.0898e-8", "8.876e-8", "8.8311e-8", "5.5205e-7", "1.775e-8"]))
replace_28 = ReplaceItems(List=data_45, Item=0, Indices=entwine_10, Wrap=False)
ma_30 = MassAddition(Input=replace_28)  # -> Result, PartialResults

data_46 = Data(Tree({0;0}: ["1.9628e-7", "1.8087e-7", "1.717e-7", "1.7066e-7", "1.6806e-7", "1.7002e-7", "1.9151e-6", "1727.882795"], {0;1}: ["5.3343e-8", "5.3325e-8", "5.3324e-8", "5.328e-8", "5.478e-8", "6.0844e-8", "5.6003e-8", "2.1617e-8"], {0;2}: ["1.1381e-7", "9.8421e-8", "8.9251e-8", "8.8212e-8", "8.6037e-8", "8.5587e-8", "5.4928e-7", "1.6013e-8"]))
replace_29 = ReplaceItems(List=data_46, Item=0, Indices=entwine_10, Wrap=False)
ma_31 = MassAddition(Input=replace_29)  # -> Result, PartialResults

data_47 = Data(Tree({0;0}: ["2.6409e-7", "2.4868e-7", "2.3951e-7", "2.4215e-7", "2.3279e-7", "1.3685e-6", "2.6243e-6", "1827.29396"], {0;1}: ["1.03e-7", "1.0298e-7", "1.0298e-7", "1.0793e-7", "1.0153e-7", "7.4606e-7", "4.3975e-7", "1.0442e-7"], {0;2}: ["1.1703e-7", "1.0164e-7", "9.2472e-8", "9.1568e-8", "8.9224e-8", "3.2004e-7", "6.8048e-7", "5.126e-8"]))
replace_30 = ReplaceItems(List=data_47, Item=0, Indices=entwine_10, Wrap=False)
ma_32 = MassAddition(Input=replace_30)  # -> Result, PartialResults

_3_t_a_b = Panel(ma_28.Result)
_3_t_a_b_2 = Panel(data_43)
_4_t_a_b = Panel(ma_29.Result)
_4_t_a_b_2 = Panel(data_44)
_5_t_a_b = Panel(ma_30.Result)
_5_t_a_b_2 = Panel(data_45)
_6_t_a_b = Panel(data_46)
_6_t_a_b_2 = Panel(ma_31.Result)
_7_t_a_b = Panel(data_47)
_7_t_a_b_2 = Panel(ma_32.Result)
_8_t_a_b = Panel(data_42)
_8_t_a_b_2 = Panel(ma_27.Result)

panel_35 = Panel("""6
7""")
entwine_11 = Entwine(Branch00=panel_35, Branch02="6", FlattenInputs=True)

data_48 = Data(Tree({0;0}: ["7.5573e-7", "6.8361e-7", "6.8871e-7", "6.4077e-7", "8.497e-7", "8.2632e-7", "0.00004", "148595.681133"], {0;1}: ["2.8955e-7", "2.8592e-7", "3.3821e-7", "3.1887e-7", "4.8799e-7", "4.5576e-7", "4.3032e-7", "5.4265e-6"], {0;2}: ["3.7068e-7", "3.0401e-7", "2.4269e-7", "2.0751e-7", "2.0402e-7", "2.0266e-7", "0.000013", "4.8353e-7"]))
replace_31 = ReplaceItems(List=data_48, Item=0, Indices=entwine_11, Wrap=False)
ma_33 = MassAddition(Input=replace_31)  # -> Result, PartialResults

data_49 = Data(Tree({0;0}: ["6.5921e-7", "6.3787e-7", "5.9251e-7", "6.3526e-7", "6.3186e-7", "6.2081e-7", "0.000039", "-70731.476727"], {0;1}: ["2.1747e-7", "2.4694e-7", "2.5399e-7", "3.0983e-7", "3.0632e-7", "2.983e-7", "2.13e-7", "3.3339e-6"], {0;2}: ["3.6035e-7", "2.9402e-7", "2.3379e-7", "1.9776e-7", "1.9386e-7", "1.9161e-7", "0.000013", "4.4661e-7"]))
replace_32 = ReplaceItems(List=data_49, Item=0, Indices=entwine_11, Wrap=False)
ma_34 = MassAddition(Input=replace_32)  # -> Result, PartialResults

data_50 = Data(Tree({0;0}: ["7.2626e-7", "6.6605e-7", "5.995e-7", "5.784e-7", "5.5135e-7", "5.435e-7", "0.000039", "64311.123178"], {0;1}: ["3.365e-7", "3.3496e-7", "3.2575e-7", "3.3437e-7", "3.2465e-7", "3.1987e-7", "2.9443e-7", "2.7529e-6"], {0;2}: ["3.5937e-7", "2.9308e-7", "2.3249e-7", "1.9652e-7", "1.9318e-7", "1.9096e-7", "0.000013", "4.3352e-7"]))
replace_33 = ReplaceItems(List=data_50, Item=0, Indices=entwine_11, Wrap=False)
ma_35 = MassAddition(Input=replace_33)  # -> Result, PartialResults

data_51 = Data(Tree({0;0}: ["7.4261e-7", "6.8175e-7", "6.2115e-7", "6.366e-7", "6.5787e-7", "3.1258e-6", "0.000042", "13020.688855"], {0;1}: ["3.3095e-7", "3.3091e-7", "3.2906e-7", "3.617e-7", "3.7735e-7", "2.1124e-6", "2.087e-6", "0.000051"], {0;2}: ["3.6411e-7", "3.0329e-7", "2.4464e-7", "2.0989e-7", "2.0575e-7", "3.5195e-7", "0.000013", "3.9624e-6"]))
replace_34 = ReplaceItems(List=data_51, Item=0, Indices=entwine_11, Wrap=False)
ma_36 = MassAddition(Input=replace_34)  # -> Result, PartialResults

data_52 = Data(Tree({0;0}: ["8.2121e-7", "7.6035e-7", "6.9945e-7", "6.5921e-7", "6.6783e-7", "6.6295e-7", "0.00004", "-141086.080096"], {0;1}: ["4.2639e-7", "4.2635e-7", "4.2517e-7", "4.2701e-7", "4.351e-7", "4.357e-7", "5.2892e-7", "4.8779e-6"], {0;2}: ["3.6161e-7", "3.0079e-7", "2.4281e-7", "2.072e-7", "2.03e-7", "2.0092e-7", "0.000013", "4.7734e-7"]))
replace_35 = ReplaceItems(List=data_52, Item=0, Indices=entwine_11, Wrap=False)
ma_37 = MassAddition(Input=replace_35)  # -> Result, PartialResults

data_53 = Data(Tree({0;0}: ["6.7764e-7", "6.1678e-7", "5.5748e-7", "6.021e-7", "6.5336e-7", "2.0092e-6", "0.00004", "-208048.823201"], {0;1}: ["2.4571e-7", "2.4567e-7", "2.4579e-7", "2.9902e-7", "3.3475e-7", "1.2858e-6", "6.9174e-7", "8.3115e-6"], {0;2}: ["3.5888e-7", "2.9806e-7", "2.3942e-7", "2.0411e-7", "2.0002e-7", "2.0948e-7", "0.000013", "5.3282e-7"]))
replace_36 = ReplaceItems(List=data_53, Item=0, Indices=entwine_11, Wrap=False)
ma_38 = MassAddition(Input=replace_36)  # -> Result, PartialResults

_14_t_a_b = Panel(ma_33.Result)
_14_t_a_b_2 = Panel(data_48)
_15_t_a_b = Panel(ma_34.Result)
_15_t_a_b_2 = Panel(data_49)
_16_t_a_b = Panel(ma_35.Result)
_16_t_a_b_2 = Panel(data_50)
_18_t_a_b = Panel(data_51)
_18_t_a_b_2 = Panel(ma_36.Result)
_19_t_a_b = Panel(data_52)
_19_t_a_b_2 = Panel(ma_37.Result)
_20_t_a_b = Panel(data_53)
_20_t_a_b_2 = Panel(ma_38.Result)
