# Grasshopper definition ACADIA_planning_practice.gh (Grasshopper 1.0.7)

# ----
# STEP 1. Define a list of lines in Rhino to represent your space frame. Set these to the curve component adjacent.
# 
# Choosing the order of construction is up to you. Choose the order so that the robots can place the members successfully
# STEP 2. Open the python component and choose the sequence of placement (i.e. what robot will place what member). You will need as many entries in this list as you have members in your structure.
# STEP 3. Define the rotation about the longitudinal axis (in radians) for each member, this will determine the direction from which the robot will be inserting the member into the structure. you can manually choose values that look reasonable or use any method you choose to generate options parametrically.
# STEP 4. Plan the paths to the member indicated on the slider. The order of members is specified in "STEP 1" and what robot will be trying to place the member is specied in "STEP 2". As you increase the slider, more members will become part of the existing structure.
python = GhPythonScript()  # -> robot_order
# ---------- python: Python ----------
#Choose what robot will place what member

#1 = robot1
#2 = robot2

robot_order = [
2, #member 0
1, #member 1
2, #member 2
1, #member 3
2, #member 4
1, #member 5
#etc...
]

print robot_order
# ---------- end python ----------
panel = Panel("""0
pi
pi/2
-0.20944 + pi
-1.884956 + pi
2.722714
-0.20944+pi
-1.884956 + pi/2
-1.466077+pi
0.20944 + pi/2
-1.884956
1.884956
1.047198
1.047198
1.047198
1.047198""")
number_slider = Slider(3, range=0..44)
crv = Curve([<curve referenced from the Rhino model> x16])

python_2 = GhPythonScript(n=number_slider, robot_order=python)  # -> rob_num; inputs n: Int32, robot_order: list
# ---------- python_2: Python ----------
rob_num = robot_order[n]

print rob_num
# ---------- end python_2 ----------
member_number = Panel(number_slider)
robot_number = Panel(python_2)
python_3 = GhPythonScript(n=number_slider)  # -> idx; inputs n: Int32
# ---------- python_3: Python ----------
idx = range(n+1)

print idx
# ---------- end python_3 ----------
data = Data(panel)

# ---- group: current member curves
data_2 = Data(python_3)
data_3 = Data(crv)
item = ListItem(List=data_3, Index=data_2, Wrap=True)
crv_2 = Curve(item)

# ---- group: member rotations about axis
data_4 = Data(data)
data_5 = Data(python_3)
item_2 = ListItem(List=data_4, Index=data_5, Wrap=True)
panel_2 = Panel(item_2)

# ---- group: size of node and member offset (no need to change)
num = Number(0.04)
num_2 = Number(0.02)

# ---- group: member info
len = Length(Curve=crv_2)
midpt = CurveMiddle(Curve=crv_2)
panel_3 = Panel(num)
panel_4 = Panel(num_2)
pl = PlaneNormal(Origin=midpt, ZAxis=crv_2)
python_4 = GhPythonScript(radius=panel_3, offset=panel_4, len=len)  # -> z_factor; inputs len: list
# ---------- python_4: Python ----------
len_reduce = (radius + offset)*2

z_factor = [(l - len_reduce)/l for l in len]
# ---------- end python_4 ----------

# ---- group: member mesh (rectangular cross-section)
crv_3 = Curve(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)
pframes = PerpFrames(Curve=crv_2, Count=1, Align=True)  # -> Frames, Parameters
orient = Orient(Geometry=crv_3, Source=PlaneXY(0, 0, 0), Target=simplify(pframes.Frames))  # -> Geometry, Transform
swp1 = Sweep1(Rail=graft(crv_2), Sections=orient.Geometry, Miter=1)

# ----
# STRUCTURE AT CURRENT STAGE OF CONSTRUCTION
pln = Plane(pl)
pt = Point(midpt)

# ---- group: as-built structure collision mesh
mesh = Mesh(swp1)
pln_2 = Plane(pln)
num_3 = Number(python_4)
scale_nu = ScaleNU(Geometry=simplify(mesh), Plane=simplify(graft(pln_2)), ScaleX=1, ScaleY=1, ScaleZ=simplify(graft(num_3)))  # -> Geometry, Transform
mesh_2 = Mesh(scale_nu.Geometry)
data_6 = Data(item_2)
pt_2 = Point(pt)
crv_4 = Curve(crv_2)
rot3d = Rotate3D(
    Geometry=simplify(graft(mesh_2)),
    Angle=simplify(graft(data_6)),
    Center=simplify(graft(pt_2)),
    Axis=simplify(graft(crv_4)))  # -> Geometry, Transform
panel_5 = Panel(member_number)
item_3 = ListItem(List=flatten(rot3d.Geometry), Index=panel_5, Wrap=True)
mesh_3 = Mesh(rot3d.Geometry)

# ---- group: length of sides of rect (no need to change)
num_4 = Number(0.03016)
panel_6 = Panel(num_4)
panel_7 = Panel(num_4)

# ----
num_5 = Number(python_4)
num_6 = Number(len)
multiplication = Multiplication(A=num_5, B=num_6)
box = CenterBox(Base=PlaneXY(0, 0, 0), X=expr("x/2", multiplication), Y=expr("x/2", panel_6), Z=expr("x/2", panel_7))
mesh_4 = Mesh(box)
panel_8 = Panel(member_number)
item_4 = ListItem(List=flatten(mesh_4), Index=panel_8, Wrap=True)

# ---- group: distance to place plane (no need to change)
num_7 = Number(0)
panel_9 = Panel(num_7)

# ---- group: structure built so far
mesh_5 = Mesh(flatten(mesh_3))
shift = ShiftList(List=mesh_5, Shift=-1, Wrap=False)
preview = CustomPreview(Geometry=shift, Material=ColourSwatch(SwatchColor=RGB(124, 125, 59)))

# ---- group: current member
mesh_6 = Mesh(flatten(item_3))
preview_2 = CustomPreview(Geometry=mesh_6, Material=ColourSwatch(SwatchColor=RGB(4, 0, 255)))

# ----
# ROBOT CONNECT
toggle = BooleanToggle(True)
ros = ROSConnect(connect=toggle)  # -> ros_client, is_connected; inputs port: Int32, connect: Boolean
#   port ip: The ip address ROS. Defaults to 127.0.0.1.
#   port port: The port of ROS. Defaults to 9090.
#   port connect: If True, connects to ROS. If False, disconnects from ROS. Defaults to False.
#   port ros_client: The ROS client.
#   port is_connected: True if connection established.
# ---------- ros: Python ----------
"""
Connect or disconnect to ROS.

COMPAS FAB v0.19.1
"""
from ghpythonlib.componentbase import executingcomponent as component
from scriptcontext import sticky as st

from compas_fab.backends import RosClient
from compas_fab.ghpython.components import create_id


class ROSConnect(component):
    def RunScript(self, ip, port, connect):
        ros_client = None

        ip = ip or '127.0.0.1'
        port = port or 9090

        key = create_id(self, 'ros_client')
        ros_client = st.get(key, None)

        if ros_client:
            st[key].close()
        if connect:
            st[key] = RosClient(ip, port)
            st[key].run(5)

        ros_client = st.get(key, None)
        is_connected = ros_client.is_connected if ros_client else False
        return (ros_client, is_connected)
# ---------- end ros ----------
data_7 = Data(ros.ros_client)
robot = ROSRobot(ros_client=data_7, load=Toggle(True))  # -> robot; inputs load: Boolean
#   port ros_client: The ROS client.
#   port load: If True, loads the robot from ROS. Defaults to False.
# ---------- robot: Python ----------
"""
Load robot directly from ROS.

COMPAS FAB v0.19.1
"""
from compas_ghpython.artists import RobotModelArtist
from ghpythonlib.componentbase import executingcomponent as component
from scriptcontext import sticky as st

from compas_fab.ghpython.components import create_id


class ROSRobot(component):
    def RunScript(self, ros_client, load):
        key = create_id(self, 'robot')

        if ros_client and ros_client.is_connected and load:
            # Load URDF from ROS
            st[key] = ros_client.load_robot(load_geometry=True, precision='12f')
            st[key].artist = RobotModelArtist(st[key].model)

        robot = st.get(key, None)
        if robot:  # client sometimes need to be restarted, without needing to reload geometry
            robot.client = ros_client
        return robot
# ---------- end robot ----------
data_8 = Data(robot)

# ----
# If axis is included then allow the robot to move along track
list = ValueList({"Robot 1": "robot1", "Robot 2": "robot2", "Robot 1 axis": "robot1_axis", "Robot 2 axis": "robot2_axis", "Robot 1 axis gripper": "robot1_axis_gripper", "Robot 2 axis gripper": "robot2_axis_gripper"}, selected="Robot 1 axis gripper")
list_2 = ValueList({"Robot 1": "robot1", "Robot 2": "robot2", "Robot 1 axis": "robot1_axis", "Robot 2 axis": "robot2_axis", "Robot 1 axis gripper": "robot1_axis_gripper", "Robot 2 axis gripper": "robot2_axis_gripper"}, selected="Robot 2 axis gripper")
rob_num = Number(robot_number)
list_3 = ValueList({"platform": "ecl_platform", "world": "ecl_zero", "wobj_1": "rob1_acadia_EBIT_01", "wobj_2": "rob2_acadia_EBIT_01"}, selected="wobj_2")
list_4 = ValueList({"platform": "ecl_platform", "world": "ecl_zero", "wobj_1": "rob1_acadia_EBIT_01", "wobj_2": "rob2_acadia_EBIT_01"}, selected="wobj_1")
data_9 = Data(list)
data_10 = Data(list_2)
panel_10 = Panel(rob_num)
panel_11 = Panel(rob_num)
filter = StreamFilter(Gate=panel_11, Stream1=list_4, Stream2=list_3)
filter_2 = StreamFilter(Gate=panel_10, Stream1=data_9, Stream2=data_10)
data_11 = Data(filter)
data_12 = Data(filter_2)

# ----
# SCENE COLLISION MESHES
scene = PlanningScene(robot=data_8)  # -> scene
#   port scene: A planning scene.
# ---------- scene: Python ----------
"""
Create a planning scene.

COMPAS FAB v0.19.1
"""
from ghpythonlib.componentbase import executingcomponent as component
from scriptcontext import sticky as st

from compas_fab.ghpython.components import create_id
from compas_fab.robots import PlanningScene


class PlanningSceneComponent(component):
    def RunScript(self, robot):
        key = create_id(self, 'planning_scene')
        if robot:
            st[key] = PlanningScene(robot)
        return st.get(key, None)
# ---------- end scene ----------

# ----
# FK - Preset Configs
# Planning Preset
python_5 = GhPythonScript()  # -> out, config
# ---------- python_5: Python ----------
#ROBOT 1 CONFIG
#Start path planning from

#axis 1-6 + track (mm)
config = [
-37.57,
-3.24,
8.36,
0.19,
84.45,
230,
100]

#config = [
#-37.57,
#-3.24,
#8.36,
#0.19,
#84.45,
#230,
#100]
# ---------- end python_5 ----------
python_6 = GhPythonScript()  # -> out, config
# ---------- python_6: Python ----------
#ROBOT 1 CONFIG
#Start path planning from

#axis 1-6 + track
config = [
40.55,
16.21,
-13.89,
-0.0,
87.68,
130.55,
3900]

#axis 1-6 + track
#config = [40.55,16.21,-13.89,-0.0,87.68,130.55,3900]
# ---------- end python_6 ----------
config = GhPythonScript(robot=data_8, r1=python_5.config, r2=python_6.config)  # -> config, config_scaled; inputs r1: list, r2: list
# ---------- config: Python ----------
import math

config = robot.zero_configuration()

for i in range(6):
    config['r1_joint_{}'.format(i + 1)] = r1[i]
    config['r2_joint_{}'.format(i + 1)] = r2[i]

#mm
config['r1_cart_joint'] = r1[6]
config['r2_cart_joint'] = r2[6]

print config

#for use in path planning
#radians and meters
config_scaled = robot.zero_configuration()

for i in range(6):
    config_scaled['r1_joint_{}'.format(i + 1)] = math.radians(r1[i])
    config_scaled['r2_joint_{}'.format(i + 1)] = math.radians(r2[i])

#mm --> m
config_scaled['r1_cart_joint'] = r1[6]/1000
config_scaled['r2_cart_joint'] = r2[6]/1000

print config_scaled
# ---------- end config ----------

# ----
# Return Preset
python_7 = GhPythonScript()  # -> out, config
# ---------- python_7: Python ----------
#RETURN CONFIG (BEFORE PICKUP)

#axis 1-6 + track (mm)
config = [
-90.0,
0.0,
0.0,
0.0,
90,
180,
100]
# ---------- end python_7 ----------
python_8 = GhPythonScript()  # -> out, config
# ---------- python_8: Python ----------
#RETURN CONFIG (BEFORE PICKUP)

#axis 1-6 + track
config = [
90.0,
0.0,
0.0,
0.0,
90,
180,
3900]
# ---------- end python_8 ----------
config_2 = GhPythonScript(robot=data_8, r1=python_7.config, r2=python_8.config)  # -> config, config_scaled; inputs r1: list, r2: list; same code as config

mesh_7 = Mesh(flatten(mesh_3))
shift_2 = ShiftList(List=flatten(mesh_7), Shift=-1, Wrap=False)
mjoin = MeshJoin(Meshes=shift_2)
cm = CollisionMesh(scene=scene, mesh=simplify(mjoin), identifier="structure_mesh", add=Button(), remove=Button())  # -> ok; inputs mesh: Mesh, add: Boolean, remove: Boolean
#   port scene: The planning scene.
#   port mesh: A collision mesh.
#   port identifier: The identifier of the collision mesh.
#   port add: If True, adds the collision mesh to the planning scene.
#   port remove: If True, removes the collision mesh from the planning scene.
#   port ok: True if the operation was successfully performed.
# ---------- cm: Python ----------
"""
Add or remove a collision mesh from the planning scene.

COMPAS FAB v0.19.1
"""
from compas_rhino.geometry import RhinoMesh
from ghpythonlib.componentbase import executingcomponent as component

from compas_fab.robots import CollisionMesh


class CollisionMeshComponent(component):
    def RunScript(self, scene, M, name, add, remove):
        ok = False
        if scene and M and name:
            mesh = RhinoMesh.from_geometry(M).to_compas()
            collision_mesh = CollisionMesh(mesh, name)
            if add:
                scene.add_collision_mesh(collision_mesh)
                ok = True
            if remove:
                scene.remove_collision_mesh(name)
                ok = True
        return ok
# ---------- end cm ----------
panel_12 = Panel(cm)

mesh_8 = Mesh(item_4)
# STEP 6. Add the collision meshes to your path planning. This will ensure that the algorithm plans to avoid obstacles such as the floor and existing structure.
acm = AttachedCollisionMesh(
    scene=scene,
    mesh=mesh_8,
    identifier="member",
    link_name="r1_tcp",
    touch_links="r1_gripper",
    add=Button(),
    remove=Button())  # -> attached_collision_mesh; inputs mesh: Mesh, touch_links: list, add: Boolean, remove: Boolean
#   port scene: The planning scene.
#   port mesh: A collision mesh.
#   port identifier: The identifier of the collision mesh.
#   port link_name: The robot's link name to attach the mesh to.
#   port touch_links: Names of links that the robot is allowed to touch.
#   port add: If True, adds the collision mesh to the planning scene.
#   port remove: If True, removes the collision mesh from the planning scene.
#   port attached_collision_mesh: A collision mesh that is attached to a robot's link.
# ---------- acm: Python ----------
"""
Add an attached collision mesh to the robot.

COMPAS FAB v0.19.1
"""
from ghpythonlib.componentbase import executingcomponent as component

from compas_rhino.geometry import RhinoMesh
from compas_fab.robots import AttachedCollisionMesh
from compas_fab.robots import CollisionMesh


class AttachedCollisionMeshComponent(component):
    def RunScript(self, scene, mesh, identifier, link_name, touch_links, add, remove):
        attached_collision_mesh = None
        if scene and mesh and identifier and link_name:
            compas_mesh = RhinoMesh.from_geometry(mesh).to_compas()
            collision_mesh = CollisionMesh(compas_mesh, identifier)
            attached_collision_mesh = AttachedCollisionMesh(collision_mesh, link_name, touch_links)
            if add:
                scene.add_attached_collision_mesh(attached_collision_mesh)
            if remove:
                scene.remove_attached_collision_mesh(identifier)
                scene.remove_collision_mesh(identifier)
        return attached_collision_mesh
# ---------- end acm ----------

mesh_9 = Mesh(item_4)
acm_2 = AttachedCollisionMesh(
    scene=scene,
    mesh=mesh_9,
    identifier="member",
    link_name="r2_tcp",
    touch_links="r2_gripper",
    add=Button(),
    remove=Button())  # -> attached_collision_mesh; inputs mesh: Mesh, touch_links: list, add: Boolean, remove: Boolean; same code as acm

mesh_10 = Mesh(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)
cm_2 = CollisionMesh(scene=scene, mesh=mesh_10, identifier="base_mesh", add=Button(), remove=Button())  # -> ok; inputs mesh: Mesh, add: Boolean, remove: Boolean; same code as cm
panel_13 = Panel(cm_2)

# ----
# STEP 5. can set different starting configuration presets for the robots from where to start the path planning to. For example, assuming the members are picked up at one end of the platform. Enable the visualizer component to see the starting config. You can add different configs and select them in the drop-down menu.
list_5 = ValueList({"Preset Start Planning Config": 2, "Preset Return Config": 3}, selected="Preset Start Planning Config")
filter_3 = StreamFilter(Gate=list_5, Stream2=config.config_scaled, Stream3=config_2.config_scaled)
# STEP 8. Once you have planned the path from the starting preset to the offset plane location, you have to plan the final insertion path. The starting configuration here is taken as the final step in the path found in STEP 7. It might happen that a feasible path is found in STEP 7, but it is not possible to find a path for the final placement move (due to awkard final positioning of the robot). In this case try finding a different path in STEP 7 or adjusting the approach plane offset and re-plan STEP 7 to a new location. If this still fails, go back to STEP 1/2/3 and change the definitions for your structure. You can save paths you have planned as a .json file at a specified location on your computer. You can load and show these saved paths, or you can show the current path planned using the dropdown menu
robot_visualize = RobotVisualize(robot=data_8, configuration=filter_3)  # -> visual, collision, attached_meshes, frames, base_frame, ee_frame; inputs attached_collision_meshes: list, show_visual: Boolean, show_collision: Boolean, show_frames: Boolean, show_base_frame: Boolean, show_end_effector_frame: Boolean, show_acm: Boolean; disabled
#   port group: The planning group used for end-effector and base visualization.
#   port configuration: The robot's full configuration.
#   port attached_collision_meshes: A list of attached collision meshes.
#   port show_visual: Whether or not to show the robot's visual meshes.
#   port show_collision: Whether or not to show the robot's collision meshes.
#   port show_frames: Whether or not to show the robot's joint frames.
#   port show_base_frame: Whether or not to show the robot's base frame.
#   port show_end_effector_frame: Whether or not to show the robot's end-effector frame.
#   port show_acm: Whether or not to show the attached collision meshes (if any).
#   port visual: The robot's visual Rhino meshes (if any).
#   port collision: The robot's collision Rhino meshes (if any).
#   port attached_meshes: The attached collision Rhino meshes (if any).
#   port frames: The robot's joint frames as Rhino planes (if any).
#   port base_frame: The robot's base frame as a Rhino plane (if any).
#   port ee_frame: The robot's end-effector frame as a Rhino plane (if any).
# ---------- robot_visualize: Python ----------
"""
Visualizes the robot.

COMPAS FAB v0.19.1
"""
from compas.geometry import Frame
from compas.geometry import Transformation
from compas_ghpython.artists import FrameArtist
from compas_ghpython.artists import MeshArtist
from ghpythonlib.componentbase import executingcomponent as component


class RobotVisualize(component):
    def RunScript(self, robot, group, configuration, attached_collision_meshes, show_visual, show_collision,
                  show_frames, show_base_frame, show_end_effector_frame, show_acm):

        visual = None
        collision = None
        attached_meshes = None
        frames = None
        base_frame = None
        ee_frame = None

        if robot:
            show_visual = True if show_visual is None else show_visual
            configuration = configuration or robot.zero_configuration()

            robot.update(configuration, visual=show_visual, collision=show_collision)
            compas_frames = robot.transformed_frames(configuration, group)

            if show_visual:
                visual = robot.artist.draw_visual()

            if show_collision:
                collision = robot.artist.draw_collision()

            if show_base_frame:
                base_compas_frame = compas_frames[0]
                artist = FrameArtist(base_compas_frame)
                base_frame = artist.draw()

            if show_end_effector_frame:
                ee_compas_frame = robot.forward_kinematics(configuration, group, options=dict(solver='model'))
                artist = FrameArtist(ee_compas_frame)
                ee_frame = artist.draw()

            if show_frames:
                frames = []
                for compas_frame in compas_frames[1:]:
                    artist = FrameArtist(compas_frame)
                    frame = artist.draw()
                    frames.append(frame)

            if show_acm:
                attached_meshes = []
                for acm in attached_collision_meshes:
                    frame = robot.forward_kinematics(configuration, options=dict(solver='model', link_name=acm.link_name))
                    T = Transformation.from_frame_to_frame(Frame.worldXY(), frame)
                    mesh = acm.collision_mesh.mesh.transformed(T)
                    attached_meshes.append(MeshArtist(mesh).draw())

        return (visual, collision, attached_meshes, frames, base_frame, ee_frame)
# ---------- end robot_visualize ----------

# ----
# STEP 7. click the compute button to plan the first path from the preset configuration to the "approach plane".
# 
# The direction of the approach plane is set in STEP 3, and the distance from the center of the member is specified in the slider below. Try different starting configurations or different approach plane angles until you find a combination that works. You might have to click the compute button several times before a path is found. If no path is found, go back to STEP 1/2/3 to change how you have defined your structure to ensure it is buildable. For example, certain approach planes might not be reachable by certain robots, or parts of your existing structure (collision meshes) might block a robot from placing a member.
place_far = Slider(0.23, range=0..1.5)

# ---- group: distance to far plane (set in step 7)
num_8 = Number(place_far)
panel_14 = Panel(num_8)

# ----
# GEOMETRIC INFO FOR FABRICATION
pln_3 = Plane(pln)
data_13 = Data(item_2)
pt_3 = Point(pt)
crv_5 = Curve(crv_2)
rot3d_2 = Rotate3D(
    Geometry=simplify(graft(pln_3)),
    Angle=simplify(graft(data_13)),
    Center=simplify(graft(pt_3)),
    Axis=simplify(graft(crv_5)))  # -> Geometry, Transform
panel_15 = Panel(member_number)
item_5 = ListItem(List=flatten(rot3d_2.Geometry), Index=panel_15, Wrap=True)
deplane = DeconstructPlane(Plane=item_5)  # -> Origin, XAxis, YAxis, ZAxis
multiplication_2 = Multiplication(A=deplane.XAxis, B=panel_9)
multiplication_3 = Multiplication(A=deplane.XAxis, B=panel_14)
move = Move(Geometry=deplane.Origin, Motion=expr("-x", multiplication_2))  # -> Geometry, Transform
move_2 = Move(Geometry=deplane.Origin, Motion=expr("-x", multiplication_3))  # -> Geometry, Transform
multiplication_4 = Multiplication(A=move.Geometry, B=1000)
multiplication_5 = Multiplication(A=move_2.Geometry, B=1000)
pl_2 = ConstructPlane(Origin=multiplication_4, XAxis=deplane.YAxis, YAxis=deplane.ZAxis)
pl_3 = ConstructPlane(Origin=move.Geometry, XAxis=deplane.YAxis, YAxis=deplane.ZAxis)
pl_4 = ConstructPlane(Origin=multiplication_5, XAxis=deplane.YAxis, YAxis=deplane.ZAxis)
pl_5 = ConstructPlane(Origin=move_2.Geometry, XAxis=deplane.YAxis, YAxis=deplane.ZAxis)

# ---- group: current member place planes
pln_4 = Plane(pl_5)
# VIZUALIZE
pln_5 = Plane(pl_3)
merge = Merge(Data1=pln_5, Data2=pln_4)
preview_3 = CustomPreview(Geometry=merge, Material=ColourSwatch(SwatchColor=RGB(4, 0, 255)))

# ----
panel_16 = Panel("APPROACH PLANE")
panel_17 = Panel("PLACE PLANE")
pln_6 = Plane(pl_5)
pln_7 = Plane(pl_3)

# ---- group: plan path
# PATH PLANNING (START)
constraints_from_plane = ConstraintsFromPlane(robot=data_8, plane=pln_6, group=data_12)  # -> constraints
#   port plane: The plane or frame from which we create position and orientation constraints.
#   port group: The planning group for which we specify the constraint. Defaults to the robot's main planning group.
#   port tolerance_position: The allowed tolerance to the frame's position (defined in the robot's units). Defaults to 0.001
#   port tolerance_xaxis: The allowed tolerance of the frame's X-axis in degrees.
#   port tolerance_yaxis: The allowed tolerance of the frame's Y-axis in degrees.
#   port tolerance_zaxis: The allowed tolerance of the frame's Z-axis in degrees.
#   port constraints: A list containing a position and an orientation constraint.
# ---------- constraints_from_plane: Python ----------
"""
Create a position and an orientation constraint from a plane calculated for the group's end-effector link.

COMPAS FAB v0.19.1
"""
import math

from ghpythonlib.componentbase import executingcomponent as component

from compas_fab.ghpython.components import coerce_frame


class ConstraintsFromPlane(component):
    def RunScript(self, robot, plane, group, tolerance_position, tolerance_xaxis, tolerance_yaxis, tolerance_zaxis):
        goal_constraints = None
        if robot and plane:
            tolerance_position = tolerance_position or 0.001
            tolerance_xaxis = tolerance_xaxis or 1.
            tolerance_yaxis = tolerance_yaxis or 1.
            tolerance_zaxis = tolerance_zaxis or 1.

            frame = coerce_frame(plane)
            tolerances_axes = [math.radians(tolerance_xaxis), math.radians(tolerance_yaxis), math.radians(tolerance_zaxis)]
            goal_constraints = robot.constraints_from_frame(frame, tolerance_position, tolerances_axes, group)

        return goal_constraints
# ---------- end constraints_from_plane ----------
plan_motion = PlanMotion(robot=data_8, goal_constraints=constraints_from_plane, start_configuration=filter_3, group=data_12, compute=Button())  # -> trajectory; inputs goal_constraints: list, attached_collision_meshes: list of Mesh, path_constraints: list, compute: Boolean
#   port goal_constraints: The goal to be achieved, defined in a set of constraints. Constraints can be very specific, for example defining value domains for each joint, such that the goal configuration is included, or defining a volume in space, to which a specific robot link (e.g. the end-effector) is required to move to.
#   port start_configuration: The robot's full configuration, i.e. values for all configurable joints of the entire robot, at the starting position. Defaults to the all-zero configuration.
#   port group: The planning group used for calculation. Defaults to the robot's main planning group.
#   port attached_collision_meshes: A list of attached collision meshes to be included for planning.
#   port path_constraints: Optional constraints that can be imposed along the solution path. Note that path calculation won't work if the start_configuration violates these constraints. Defaults to None.
#   port planner_id: The name of the algorithm used for path planning. Defaults to 'RRTConnectkConfigDefault'
#   port compute: If True, calculates a trajectory.
#   port trajectory: The calculated trajectory.
# ---------- plan_motion: Python ----------
"""
Calculate a motion path.

COMPAS FAB v0.19.1
"""
from ghpythonlib.componentbase import executingcomponent as component
from scriptcontext import sticky as st

from compas_fab.ghpython.components import create_id


class PlanMotion(component):
    def RunScript(self, robot, goal_constraints, start_configuration, group, attached_collision_meshes, path_constraints, planner_id, compute):

        key = create_id(self, 'trajectory')

        path_constraints = list(path_constraints) if path_constraints else None
        attached_collision_meshes = list(attached_collision_meshes) if attached_collision_meshes else None
        planner_id = str(planner_id) if planner_id else 'RRTConnectkConfigDefault'

        if robot and robot.client and robot.client.is_connected and start_configuration and goal_constraints and compute:
            st[key] = robot.plan_motion(goal_constraints,
                                        start_configuration=start_configuration,
                                        group=group,
                                        options=dict(
                                            attached_collision_meshes=attached_collision_meshes,
                                            path_constraints=path_constraints,
                                            planner_id=planner_id,
                                        ))

        trajectory = st.get(key, None)
        return trajectory
# ---------- end plan_motion ----------
trajectory_visualize = TrajectoryVisualize(robot=data_8, group=data_12, trajectory=plan_motion)  # -> start_configuration, configurations, fraction, time, planes, P, V, A
#   port group: The planning group for which this trajectory was planned.
#   port trajectory: The calculated trajectory.
#   port start_configuration: The start configuration of the trajectory.
#   port configurations: The full configurations along the trajectory.
#   port fraction: Indicates the fraction of requested trajectory that was calculated, e.g. 1 means the full trajectory was found.
#   port time: The time which is needed to execute that trajectory at full speed.
#   port planes: The planes of the robot's end-effector.
#   port P: The positions along the trajectory
#   port V: The velocities along the trajectory
#   port A: The accelerations along the trajectory
# ---------- trajectory_visualize: Python ----------
"""
Visualizes a trajectory.

COMPAS FAB v0.19.1
"""
from compas_ghpython import draw_frame
from compas_ghpython import list_to_ghtree
from ghpythonlib.componentbase import executingcomponent as component


class TrajectoryVisualize(component):
    def RunScript(self, robot, group, trajectory):
        start_configuration = None
        configurations = []
        fraction = 0.
        time = 0.

        planes = []
        positions = []
        velocities = []
        accelerations = []

        if robot and trajectory:
            group = group or robot.main_group_name

            for c in trajectory.points:
                configurations.append(robot.merge_group_with_full_configuration(c, trajectory.start_configuration, group))
                frame = robot.forward_kinematics(c, group, options=dict(solver='model'))
                planes.append(draw_frame(frame))
                positions.append(c.positions)
                velocities.append(c.velocities)
                accelerations.append(c.accelerations)

            start_configuration = trajectory.start_configuration
            fraction = trajectory.fraction
            time = trajectory.time_from_start

        P = list_to_ghtree(list(zip(*positions)))
        V = list_to_ghtree(list(zip(*velocities)))
        A = list_to_ghtree(list(zip(*accelerations)))

        # return outputs if you have them; here I try it for you:
        return (start_configuration, configurations, fraction, time, planes, P, V, A)
# ---------- end trajectory_visualize ----------

# ---- group: save new planned path
panel_18 = Panel("C:/Users/Edvard/Documents/GitHub/workshop_princeton_2021/ACADIA/")
save_data = Button()
panel_19 = Panel(member_number)
python_9 = GhPythonScript(configs=trajectory_visualize.configurations, path=panel_18, member_num=panel_19, save_data=save_data)  # inputs configs: list
# ---------- python_9: Python ----------
import os
from compas_fab.utilities import write_data_to_json

configs_combined = {}
if save_data:
    for i,c in enumerate(configs):
        configs_combined['config_{}'.format(i)] = c.to_data()
        #c.to_json(os.path.join(path, 'member_{}/config_{}.json'.format(member_num,i)))

    print configs_combined
    write_data_to_json(configs_combined, os.path.join(path, 'member_{}_start.json'.format(member_num)))
# ---------- end python_9 ----------

# ----
list_6 = ValueList({"Use new planned path": 0, "Load saved path": 1}, selected="Use new planned path")
python_10 = GhPythonScript(path=panel_18, member_num=panel_19, read_data=list_6)  # -> configs
# ---------- python_10: Python ----------
import os
from compas_fab.utilities import read_data_from_json
from compas_fab.robots import Configuration

if read_data:
    data = read_data_from_json(os.path.join(path, 'member_{}_start.json'.format(member_num)))

    print data['config_1']
    print len(data)

configs = []
for i in range(len(data)):
    configs.append(Configuration.from_data(data['config_{}'.format(i)]))
    
print configs[1]
   
print configs[0]['r1_joint_6']
# ---------- end python_10 ----------
filter_4 = StreamFilter(Gate=list_6, Stream0=trajectory_visualize.configurations, Stream1=python_10)
data_14 = Data(filter_4)

# ---- group: plan path
# start from the last config path of "start" path plan
data_15 = Data(data_14)
item_6 = ListItem(List=data_15, Index="-1", Wrap=True)

# PATH PLANNING (END)
constraints_from_plane_2 = ConstraintsFromPlane(robot=data_8, plane=pln_7, group=data_12)  # -> constraints; same code as constraints_from_plane
plan_motion_2 = PlanMotion(robot=data_8, goal_constraints=constraints_from_plane_2, start_configuration=item_6, group=data_12, compute=Button())  # -> trajectory; inputs goal_constraints: list, attached_collision_meshes: list of Mesh, path_constraints: list, compute: Boolean; same code as plan_motion
trajectory_visualize_2 = TrajectoryVisualize(robot=data_8, group=data_12, trajectory=plan_motion_2)  # -> start_configuration, configurations, fraction, time, planes, P, V, A; same code as trajectory_visualize

# ---- group: save new planned path
save_data_2 = Button()
panel_20 = Panel("C:/Users/Edvard/Documents/GitHub/workshop_princeton_2021/ACADIA/")
panel_21 = Panel(member_number)
python_11 = GhPythonScript(configs=trajectory_visualize_2.configurations, path=panel_20, member_num=panel_21, save_data=save_data_2)  # inputs configs: list
# ---------- python_11: Python ----------
import os
from compas_fab.utilities import write_data_to_json

configs_combined = {}
if save_data:
    for i,c in enumerate(configs):
        configs_combined['config_{}'.format(i)] = c.to_data()
        #c.to_json(os.path.join(path, 'member_{}/config_{}.json'.format(member_num,i)))

    #print configs_combined
    write_data_to_json(configs_combined, os.path.join(path, 'member_{}_end.json'.format(member_num)))
# ---------- end python_11 ----------

# ----
list_7 = ValueList({"Use new planned path": 0, "Load saved path": 1}, selected="Use new planned path")
python_12 = GhPythonScript(path=panel_20, member_num=panel_21, read_data=list_7)  # -> configs
# ---------- python_12: Python ----------
import os
from compas_fab.utilities import read_data_from_json
from compas_fab.robots import Configuration

if read_data:
    data = read_data_from_json(os.path.join(path, 'member_{}_end.json'.format(member_num)))

    print data['config_1']
    print len(data)

configs = []
for i in range(len(data)):
    configs.append(Configuration.from_data(data['config_{}'.format(i)]))
    
print configs[1]
# ---------- end python_12 ----------
filter_5 = StreamFilter(Gate=list_7, Stream0=trajectory_visualize_2.configurations, Stream1=python_12)
data_16 = Data(filter_5)

# ---- group: visualize robot path
item_7 = ListItem(List=data_14, Index=Slider(13, range=0..50), Wrap=False)
# STEP 9. Turn the visualizer component on and scroll through the slider to see the different configurations the robot will take along its path. If multiple visualizer components are active on the canvas it might not work as expected, so try disabling the others if the robots are not showing up on the Rhino screen.
robot_visualize_2 = RobotVisualize(robot=data_8, configuration=item_7)  # -> visual, collision, attached_meshes, frames, base_frame, ee_frame; inputs attached_collision_meshes: list, show_visual: Boolean, show_collision: Boolean, show_frames: Boolean, show_base_frame: Boolean, show_end_effector_frame: Boolean, show_acm: Boolean; same code as robot_visualize

# ---- group: vizualize robot path
item_8 = ListItem(List=data_16, Index=Slider(0, range=0..50), Wrap=False)
robot_visualize_3 = RobotVisualize(robot=data_8, configuration=item_8)  # -> visual, collision, attached_meshes, frames, base_frame, ee_frame; inputs attached_collision_meshes: list, show_visual: Boolean, show_collision: Boolean, show_frames: Boolean, show_base_frame: Boolean, show_end_effector_frame: Boolean, show_acm: Boolean; same code as robot_visualize
