# Grasshopper definition compas_path_plan_rotations.gh (Grasshopper 1.0.7)

panel = Panel("C:/Users/Edvard/Documents/GitHub/workshop_princeton_2021/ACADIA/input_data/")

crv = Curve([<curve referenced from the Rhino model> x45])
number_slider = Slider(23, range=0..44)
data = Data(crv)
python = GhPythonScript(n=number_slider)  # -> rob_num; inputs n: Int32
# ---------- python: Python ----------
#Robot Order

order = [
2, #0
1, #1
2, #2
1, #3
2, #4
1, #5
2, #6
1, #7
2, #8
2, #9
1, #10
2, #11
2, #12
1, #13
2, #14
2, #15
1, #16
1, #17
2, #18
1, #19
2, #20
1, #21
2, #22
2, #23
2, #24
1, #25
2, #26
1, #27
2, #29
2, #28
1, #30
2, #31
1, #32
1, #33
1, #34
2, #33
2, #38
1, #36
1, #37
#done
2, #36
2, #37
2, #39
2, #41
2, #42
1, #43
]

rob_num = order[n]
# ---------- end python ----------
panel_2 = Panel(python)

panel_3 = Panel("nodes")
pt = Point([<point referenced from the Rhino model> x16])
sph = Sphere(Base=pt, Radius="0.040")

# ---- group: profile
# 1 3/16" (30.16mm) section.
# this dist is to corner
panel_4 = Panel("4")
panel_5 = Panel("0.03016")
division = Division(A=panel_5, B="sqrt(2)")
polygon = Polygon(Plane=PlaneXY(0, 0, 0), Radius=division, Segments=panel_4, FilletRadius=0)  # -> Polygon, Length
rotate = Rotate(Geometry=polygon.Polygon, Angle=degrees("45"), Plane=PlaneXY(0, 0, 0))  # -> Geometry, Transform

# ----
# place approach planes offsets
number_slider_2 = Slider(0.3, range=0..2)
num = Number(Slider(0, range=0..1))
num_2 = Number(number_slider_2)

num_3 = Number(number_slider)
dom = ConstructDomain(DomainStart="0", DomainEnd=num_3)
range = Range(Domain=dom, Steps=num_3)
item = ListItem(List=data, Index=range, Wrap=True)
panel_6 = Panel("0.040")
panel_7 = Panel("0.020")
len = Length(Curve=item)
midpt = CurveMiddle(Curve=item)
pframes = PerpFrames(Curve=item, Count="1", Align=True)  # -> Frames, Parameters
python_2 = GhPythonScript(radius=panel_6, offset=panel_7, len=len)  # -> z_factor; inputs len: list
# ---------- python_2: Python ----------
len_reduce = (radius + offset)*2

z_factor = [(l - len_reduce)/l for l in len]
# ---------- end python_2 ----------
pl = PlaneNormal(Origin=midpt, ZAxis=item)
graft = GraftTree(Tree=item, IncludeEmptyLists=True, IncludeNullItems=True)
orient = Orient(Geometry=rotate.Geometry, Source=PlaneXY(0, 0, 0), Target=simplify(pframes.Frames))  # -> Geometry, Transform
swp1 = Sweep1(Rail=graft, Sections=orient.Geometry, Miter=1)
scale_nu = ScaleNU(Geometry=simplify(swp1), Plane=simplify(graft(pl)), ScaleX=1, ScaleY=1, ScaleZ=simplify(graft(python_2)))  # -> Geometry, Transform

python_3 = GhPythonScript(path=panel, filename="member_rotations.json", read_data=Toggle(True))  # -> rotations
# ---------- python_3: Python ----------
import os
from compas_fab.utilities import read_data_from_json
from compas_fab.robots import Configuration

if read_data:
    data = read_data_from_json(os.path.join(path, filename))
    
    
print len(data)
print data
print data['member_29']

rotations = []
for i in range(len(data)):
    rotations.append(data['member_{}'.format(i)])

print rotations
# ---------- end python_3 ----------
panel_8 = Panel("""0
pi
pi/2
-0.20944
-1.884956
2.722714
-0.20944+pi
-1.884956
-1.466077+pi
0.20944 + pi/2
-1.884956
1.884956
1.047198
Pi
-0.20944
-1.884956 - pi/2
-2.722714-0.7
0.20944
2.722714
2.722714
-1.047198
Pi-pi/2
-1.047198 + pi/2
2.303835 + pi/2
-1.466077
-2.722714
-Pi
-0.20944+pi/2
-1.884956
-1.466077
Pi
-1.884956 - pi/2
2.303835-pi/2
-0.20944
0.628319
-1.884956 + pi
-1.466077
1.466077 + pi/2
1.884956
0.628319
2.303835
1.466077
1.884956
-0.20944
-1.466077""")
item_2 = ListItem(List=panel_8, Index=range, Wrap=True)  # disabled

# ----
# close circle
# far circle
panel_9 = Panel(num)  # disabled
panel_10 = Panel(num_2)  # disabled
panel_11 = Panel("15")  # disabled
item_3 = ListItem(List=data, Index=number_slider, Wrap=True)  # disabled
midpt_2 = CurveMiddle(Curve=item_3)  # disabled
number_slider_3 = Slider(4, range=0..15)  # disabled
circle = CircleCNR(Center=midpt_2, Normal=item_3, Radius=panel_9)  # disabled
circle_2 = CircleCNR(Center=midpt_2, Normal=item_3, Radius=panel_10)  # disabled
divide = DivideCurve(Curve=circle, Count=panel_11, Kinks=False)  # -> Points, Tangents, Parameters; disabled
divide_2 = DivideCurve(Curve=circle_2, Count=panel_11, Kinks=False)  # -> Points, Tangents, Parameters; disabled
pl_2 = ConstructPlane(Origin=divide.Points, XAxis=item_3, YAxis=divide.Tangents)  # disabled
pl_3 = ConstructPlane(Origin=divide_2.Points, XAxis=item_3, YAxis=divide_2.Tangents)  # disabled
num_4 = Number(number_slider_3)  # disabled
num_5 = Number(number_slider_3)  # disabled
item_4 = ListItem(List=pl_2, Index=num_4, Wrap=True)  # disabled
item_5 = ListItem(List=pl_3, Index=num_5, Wrap=True)  # disabled

item_6 = ListItem(List=python_3, Index=range, Wrap=True)

multiplication = Multiplication(A=len, B=python_2)
panel_12 = Panel(panel_5)
panel_13 = Panel(panel_5)
box = CenterBox(Base=PlaneXY(0, 0, 0), X=expr("x/2", multiplication), Y=expr("x/2", panel_12), Z=expr("x/2", panel_13))

item_7 = ListItem(List=pl, Index=number_slider, Wrap=True)  # disabled
item_8 = ListItem(List=flatten(scale_nu.Geometry), Index=number_slider, Wrap=True)  # disabled
deplane = DeconstructPlane(Plane=item_7)  # -> Origin, XAxis, YAxis, ZAxis; disabled
deplane_2 = DeconstructPlane(Plane=item_4)  # -> Origin, XAxis, YAxis, ZAxis; disabled
xprod = CrossProduct(VectorA=deplane.XAxis, VectorB=deplane_2.ZAxis, Unitize=True)  # -> Vector, Length; disabled
angle = Angle(VectorA=deplane_2.ZAxis, VectorB=deplane.XAxis)  # -> Angle, Reflex; disabled
dprod = DotProduct(VectorA=deplane.XAxis, VectorB=deplane_2.ZAxis, Unitize=True)  # disabled
dprod_2 = DotProduct(VectorA=xprod.Vector, VectorB=deplane.ZAxis, Unitize=False)  # disabled
python_4 = GhPythonScript(dot=dprod, cross_dot=dprod_2, a=angle.Angle)  # -> out, a; disabled
# ---------- python_4: Python ----------
if dot > 0 and cross_dot > 0:
    a = a
elif dot < 0 and cross_dot > 0:
    a = a
elif dot < 0 and cross_dot < 0:
    a = -a
elif dot > 0 and cross_dot < 0:
    a = -a
# ---------- end python_4 ----------
rot3d = Rotate3D(Geometry=item_8, Angle=python_4.a, Center=deplane.Origin, Axis=deplane.ZAxis)  # -> Geometry, Transform; disabled
rotation_angle = Panel(python_4.a)  # disabled
preview = CustomPreview(
    Geometry=rot3d.Geometry,
    Material={diffuse=RGB(221, 160, 221), emission=RGB(66, 48, 66), shine=0.5, specular=RGB(255, 255, 255), transparency=0})  # disabled

panel_14 = Panel(item_6)

# ---- group: lacing wobj
pln = Plane()  # disabled
pln_2 = Plane()  # disabled
python_5 = GhPythonScript()  # -> out, t_a; disabled
# ---------- python_5: Python ----------
from compas.geometry import Frame
from compas.geometry import Point
from compas_ghpython import draw_frame
from compas.geometry import Transformation

from compas_rhino.geometry import RhinoPlane


wobj_A = Frame.from_quaternion([0.999987, 0.002274, -0.001300, 0.004463])
wobj_A.point = [2239.98, 1816.570, 150.477]

f_a = RhinoPlane.from_geometry(wobj_A).to_compas() 
print(f_a)

t_a = Transformation.from_frame(f_a)
print t_a
# ---------- end python_5 ----------
python_6 = GhPythonScript(p_send1=pln, p_send2=pln_2, t_a=python_5.t_a)  # -> out, f_send_trans1, f_send_trans2; inputs p_send1: Plane; disabled
# ---------- python_6: Python ----------
from compas.geometry import Frame
from compas.geometry import Point
from compas_ghpython import draw_frame
from compas.geometry import Transformation

from compas_rhino.geometry import RhinoPlane

f_send1 = RhinoPlane.from_geometry(p_send1).to_compas() 
f_send2 = RhinoPlane.from_geometry(p_send2).to_compas() 

p_trans1 = f_send1.transformed(t_a.inverse())
p_trans2 = f_send2.transformed(t_a.inverse())

f_send_trans1 = draw_frame(p_trans1)
f_send_trans2 = draw_frame(p_trans2)
# ---------- end python_6 ----------
pln_3 = Plane(python_6.f_send_trans1)  # disabled
pln_4 = Plane(python_6.f_send_trans2)  # disabled

# ----
mesh = Mesh(box)

panel_15 = Panel(number_slider)
rot3d_2 = Rotate3D(Geometry=simplify(graft(pl)), Angle=simplify(graft(item_6)), Center=simplify(graft(midpt)), Axis=simplify(graft(item)))  # -> Geometry, Transform
rot3d_3 = Rotate3D(
    Geometry=simplify(graft(scale_nu.Geometry)),
    Angle=simplify(graft(item_6)),
    Center=simplify(graft(midpt)),
    Axis=simplify(graft(item)))  # -> Geometry, Transform
item_9 = ListItem(List=flatten(rot3d_2.Geometry), Index=panel_15, Wrap=True)
item_10 = ListItem(List=flatten(rot3d_3.Geometry), Index=panel_15, Wrap=True)
item_11 = ListItem(List=flatten(mesh), Index=panel_15, Wrap=True)

panel_16 = Panel("C:/Users/Edvard/Documents/GitHub/workshop_princeton_2021/ACADIA/input_data/")

# ----
# PLACEMENT PLANES
panel_17 = Panel(num)
panel_18 = Panel(num_2)
deplane_3 = DeconstructPlane(Plane=item_9)  # -> Origin, XAxis, YAxis, ZAxis
multiplication_2 = Multiplication(A=deplane_3.XAxis, B=panel_17)
multiplication_3 = Multiplication(A=deplane_3.XAxis, B=panel_18)
move = Move(Geometry=deplane_3.Origin, Motion=expr("-x", multiplication_2))  # -> Geometry, Transform
move_2 = Move(Geometry=deplane_3.Origin, Motion=expr("-x", multiplication_3))  # -> Geometry, Transform
multiplication_4 = Multiplication(A=move.Geometry, B=1000)
multiplication_5 = Multiplication(A=move_2.Geometry, B=1000)
pl_4 = ConstructPlane(Origin=multiplication_4, XAxis=deplane_3.YAxis, YAxis=deplane_3.ZAxis)
pl_5 = ConstructPlane(Origin=move.Geometry, XAxis=deplane_3.YAxis, YAxis=deplane_3.ZAxis)
pl_6 = ConstructPlane(Origin=multiplication_5, XAxis=deplane_3.YAxis, YAxis=deplane_3.ZAxis)
pl_7 = ConstructPlane(Origin=move_2.Geometry, XAxis=deplane_3.YAxis, YAxis=deplane_3.ZAxis)

python_7 = GhPythonScript(path=panel_16, filename="member_rotations.json", save_data=Button())  # inputs rotations: list
# ---------- python_7: Python ----------
import os
from compas_fab.utilities import write_data_to_json

output_data = {}
if save_data:
    for i,c in enumerate(rotations):
        output_data['member_{}'.format(i)] = c

    print output_data
    write_data_to_json(output_data, os.path.join(path, filename))
# ---------- end python_7 ----------
