# Grasshopper definition 210702_robotower.gh (Grasshopper 1.0.7)

brep = Brep([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])
brick_num = Slider(1, range=0..25)

# ---- group: brick_dimensions
panel = Panel("246")
panel_2 = Panel("116")
panel_3 = Panel("53")

# ---- group: approach_offset
approach_offset = Panel("300")

# ---- group: Pickup Location
pt = Point(Point(372.3863032, -667.9908963, -8.403137628))

# ---- group: tower_geometry
brep_2 = Brep([<brep referenced from the Rhino model> x26])

# ---- group: pickup_offset
panel_4 = Panel("300")

# ----
panel_5 = Panel(pt)
# . . . . . . . . . . . . . . . . . .
# .                                 .
# .   <<><><>   <<><><>   <<        .
# .   <<        <<        <<        .
# .   <<><><>   <<        <<        .
# .   <<        <<        <<        .
# .   <<        <<        <<        .
# .   <<><><>   <<><><>   <<><><>   .
# .                                 .
# .       Princeton SOA 2020        .
# . . . . . . . . . . . . . . . . . .
# 
# Created on 10.12.2016
# Modified 12.19.2020
# 
# @author: ebruun, stefanap, iant
# Connecting to ABB IRC5
# i. IP settings ipv4 automatically assign (ping test)
# ii. start the program on pendant (pp to main -> play)
# 1. <<Init>> in GH
# 2. <<R on>> in GH
# 3. Send commands
panel_6 = Panel("""rob1 = rob_B
rob2 = rob_A""")
deconstruct_brep = DeconstructBrep(Brep=brep_2)  # -> Faces, Edges, Vertices

# ---- group: brick_visualization
ghpython_script = GhPythonScript(brick_list=brep_2, brick_num=brick_num)  # -> out, show_brick; inputs brick_list: list, brick_num: Int32
# ---------- ghpython_script: Python ----------
__author__ = "Ian"
__version__ = "2021.07.02"

import rhinoscriptsyntax as rs

brick_num = brick_num

show_brick = []

for i in range(brick_num+1):
    show_brick.append(brick_list[i])
# ---------- end ghpython_script ----------

# ----
division = Division(A=panel_2, B=1000)
xy_plane = XYPlane(Origin=pt)
list_item = ListItem(List=deconstruct_brep.Faces, Index=Slider(2, range=0..4), Wrap=True)  # -> flatten(Item)
unit_z = UnitZ(Factor=panel_4)
flip_plane = FlipPlane(Plane=xy_plane, ReverseX=False, ReverseY=False, SwapAxes=True)
division_2 = Division(A=panel_2, B="-2")
area = Area(Geometry=list_item)  # -> Area, Centroid
unit_z_2 = UnitZ(Factor=division_2)
rotate = Rotate(Geometry=flip_plane, Angle="pi/2", Plane=flip_plane)  # -> Geometry, Transform
xy_plane_2 = XYPlane(Origin=area.Centroid)
move = Move(Geometry=rotate.Geometry, Motion=unit_z)  # -> Geometry, Transform

# ---- group: odd course
cull_pattern = CullPattern(List=xy_plane_2, CullPattern=[True, True, False, False])
rotate_2 = Rotate(Geometry=cull_pattern, Angle=1.570796327, Plane=cull_pattern)  # -> Geometry, Transform

# ---- group: even course
cull_pattern_2 = CullPattern(List=xy_plane_2, CullPattern=[False, False, True, True])

# ---- group: place+approach planes
unit_z_3 = UnitZ(Factor=approach_offset)
weave = Weave(Pattern=[0, 0, 1, 1], Stream0=rotate_2.Geometry, Stream1=cull_pattern_2, NullGaps=False)
move_2 = Move(Geometry=weave, Motion=unit_z_2)  # -> Geometry, Transform
plane = Plane(move_2.Geometry)
move_3 = Move(Geometry=plane, Motion=unit_z_3)  # -> Geometry, Transform
plane_2 = Plane(move_3.Geometry)
list_item_2 = ListItem(List=plane, Index=brick_num, Wrap=True)
list_item_3 = ListItem(List=plane_2, Index=brick_num, Wrap=True)

# ----
panel_7 = Panel(rotate_2.Geometry)

# ---- group: pickup_approach
plane_3 = Plane(move.Geometry)

# ---- group: pickup_plane
plane_4 = Plane(rotate.Geometry)

# ---- group: brick_approach
plane_5 = Plane(list_item_3)

# ---- group: brick_place
plane_6 = Plane(list_item_2)

# ----
pflip = FlipPlane(Plane=plane_5, ReverseX=False, ReverseY=False, SwapAxes=True)
pflip_2 = FlipPlane(Plane=plane_6, ReverseX=False, ReverseY=False, SwapAxes=True)
ros = ROSConnect(connect=Toggle(True))  # -> ros_client, is_connected; inputs port: Int32, connect: Boolean
#   port ip: The ip address ROS. Defaults to 127.0.0.1.
#   port port: The port of ROS. Defaults to 9090.
#   port connect: If True, connects to ROS. If False, disconnects from ROS. Defaults to False.
#   port ros_client: The ROS client.
#   port is_connected: True if connection established.
# ---------- ros: Python ----------
"""
Connect or disconnect to ROS.

COMPAS FAB v0.19.1
"""
from ghpythonlib.componentbase import executingcomponent as component
from scriptcontext import sticky as st

from compas_fab.backends import RosClient
from compas_fab.ghpython.components import create_id


class ROSConnect(component):
    def RunScript(self, ip, port, connect):
        ros_client = None

        ip = ip or '127.0.0.1'
        port = port or 9090

        key = create_id(self, 'ros_client')
        ros_client = st.get(key, None)

        if ros_client:
            st[key].close()
        if connect:
            st[key] = RosClient(ip, port)
            st[key].run(5)

        ros_client = st.get(key, None)
        is_connected = ros_client.is_connected if ros_client else False
        return (ros_client, is_connected)
# ---------- end ros ----------
rotate_3 = Rotate(Geometry=pflip, Angle=1.570796327, Plane=pflip)  # -> Geometry, Transform
rotate_4 = Rotate(Geometry=pflip_2, Angle=1.570796327, Plane=pflip_2)  # -> Geometry, Transform
python = GhPythonScript(
    ros=ros.ros_client,
    rob_num="1",
    pick1=plane_3,
    pick2=plane_4,
    place1=rotate_3.Geometry,
    place2=rotate_4.Geometry,
    send=Button())  # -> out, a; inputs rob_num: Int32, pick1: Plane
# ---------- python: Python ----------
import compas_rrc as rrc
from compas.geometry import Frame
from compas.geometry import Plane

from compas_rhino.geometry import RhinoPlane


# Create ABB Client
if rob_num == 1:
    abb = rrc.AbbClient(ros, '/rob1')
    print('Connected.')
    abb.send(rrc.SetTool('ECL_gripper_EB'))
    DO = 'do_1'
elif rob_num == 2:
    abb = rrc.AbbClient(ros, '/rob2')
    print('Connected.')
    abb.send(rrc.SetTool('ECL_gripper_EB'))
    DO = 'do_2'

# Set tool


# Define pick positions
#frame_on_pick = Frame(Point(50, 50, 50), Vector(0, -1, 0), Vector(-1, 0, 0))
#frame_on_place = Frame(Point(50, 50, 50), Vector(0, -1, 0), Vector(-1, 0, 0))

# Define speeds
speed = 100

frame_on_pick_far = RhinoPlane.from_geometry(pick1).to_compas() 
frame_on_pick = RhinoPlane.from_geometry(pick2).to_compas()

frame_on_place_far = RhinoPlane.from_geometry(place1).to_compas() 
frame_on_place = RhinoPlane.from_geometry(place2).to_compas()

if send:

    abb.send(rrc.SetWorkObject('rotrobwob_r1_CG_04'))
    abb.send_and_wait(rrc.MoveToFrame(frame_on_pick_far, speed, rrc.Zone.FINE))
    
    #open gripper
    done = abb.send_and_wait(rrc.SetDigital(DO,0))
    
    future = abb.send(rrc.Stop(feedback_level=rrc.FeedbackLevel.DONE))
    print('Press Play on the FlexPendant to continue.')
    
    abb.send(rrc.SetWorkObject('rotrobwob_r1_CG_04'))
    abb.send_and_wait(rrc.MoveToFrame(frame_on_pick, speed, rrc.Zone.FINE))
    
    future = abb.send(rrc.Stop(feedback_level=rrc.FeedbackLevel.DONE))
    print('Press Play on the FlexPendant to close gripper.')
    
    #close gripper
    done = abb.send_and_wait(rrc.SetDigital(DO,1))
    
    future = abb.send(rrc.Stop(feedback_level=rrc.FeedbackLevel.DONE))
    print('Press Play on the FlexPendant to move up')
    
    future = abb.send(rrc.Stop(feedback_level=rrc.FeedbackLevel.DONE))
    abb.send_and_wait(rrc.MoveToFrame(frame_on_pick_far, speed, rrc.Zone.FINE))
    
    future = abb.send(rrc.Stop(feedback_level=rrc.FeedbackLevel.DONE))
    abb.send_and_wait(rrc.MoveToFrame(frame_on_place_far, speed, rrc.Zone.FINE))
    
    future = abb.send(rrc.Stop(feedback_level=rrc.FeedbackLevel.DONE))
    abb.send_and_wait(rrc.MoveToFrame(frame_on_place, speed, rrc.Zone.FINE))
    
    future = abb.send(rrc.Stop(feedback_level=rrc.FeedbackLevel.DONE))
    done = abb.send_and_wait(rrc.SetDigital(DO,0))
    
    future = abb.send(rrc.Stop(feedback_level=rrc.FeedbackLevel.DONE))
    abb.send_and_wait(rrc.MoveToFrame(frame_on_place_far, speed, rrc.Zone.FINE))
    
    # End of Code
    print('Finished')
# ---------- end python ----------
