# Grasshopper definition 210702_robotower_planning.gh (Grasshopper 1.0.7)

brep = Brep([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])
brick_num = Slider(1, range=0..25)

# ---- group: brick_dimensions
panel = Panel("246")
panel_2 = Panel("116")
panel_3 = Panel("53")

# ---- group: approach_offset
approach_offset = Panel("300")

# ---- group: Pickup Location
pt = Point(Point(372.3863032, -667.9908963, -8.403137628))

# ---- group: tower_geometry
brep_2 = Brep([<brep referenced from the Rhino model> x26])

# ---- group: pickup_offset
panel_4 = Panel("300")

# ----
panel_5 = Panel(pt)
# . . . . . . . . . . . . . . . . . .
# .                                 .
# .   <<><><>   <<><><>   <<        .
# .   <<        <<        <<        .
# .   <<><><>   <<        <<        .
# .   <<        <<        <<        .
# .   <<        <<        <<        .
# .   <<><><>   <<><><>   <<><><>   .
# .                                 .
# .       Princeton SOA 2020        .
# . . . . . . . . . . . . . . . . . .
# 
# Created on 10.12.2016
# Modified 12.19.2020
# 
# @author: ebruun, stefanap, iant
# Connecting to ABB IRC5
# i. IP settings ipv4 automatically assign (ping test)
# ii. start the program on pendant (pp to main -> play)
# 1. <<Init>> in GH
# 2. <<R on>> in GH
# 3. Send commands
panel_6 = Panel("""rob1 = rob_B
rob2 = rob_A""")
deconstruct_brep = DeconstructBrep(Brep=brep_2)  # -> Faces, Edges, Vertices

# ---- group: brick_visualization
ghpython_script = GhPythonScript(brick_list=brep_2, brick_num=brick_num)  # -> out, show_brick; inputs brick_list: list, brick_num: Int32
# ---------- ghpython_script: Python ----------
__author__ = "Ian"
__version__ = "2021.07.02"

import rhinoscriptsyntax as rs

brick_num = brick_num

show_brick = []

for i in range(brick_num+1):
    show_brick.append(brick_list[i])
# ---------- end ghpython_script ----------

# ----
division = Division(A=panel_2, B=1000)
xy_plane = XYPlane(Origin=pt)
list_item = ListItem(List=deconstruct_brep.Faces, Index=Slider(2, range=0..4), Wrap=True)  # -> flatten(Item)
unit_z = UnitZ(Factor=panel_4)
flip_plane = FlipPlane(Plane=xy_plane, ReverseX=False, ReverseY=False, SwapAxes=True)
division_2 = Division(A=panel_2, B="-2")
area = Area(Geometry=list_item)  # -> Area, Centroid
unit_z_2 = UnitZ(Factor=division_2)
rotate = Rotate(Geometry=flip_plane, Angle="pi/2", Plane=flip_plane)  # -> Geometry, Transform
xy_plane_2 = XYPlane(Origin=area.Centroid)
move = Move(Geometry=rotate.Geometry, Motion=unit_z)  # -> Geometry, Transform

# ---- group: odd course
cull_pattern = CullPattern(List=xy_plane_2, CullPattern=[True, True, False, False])
rotate_2 = Rotate(Geometry=cull_pattern, Angle=1.570796327, Plane=cull_pattern)  # -> Geometry, Transform

# ---- group: even course
cull_pattern_2 = CullPattern(List=xy_plane_2, CullPattern=[False, False, True, True])

# ---- group: place+approach planes
unit_z_3 = UnitZ(Factor=approach_offset)
weave = Weave(Pattern=[0, 0, 1, 1], Stream0=rotate_2.Geometry, Stream1=cull_pattern_2, NullGaps=False)
move_2 = Move(Geometry=weave, Motion=unit_z_2)  # -> Geometry, Transform
plane = Plane(move_2.Geometry)
move_3 = Move(Geometry=plane, Motion=unit_z_3)  # -> Geometry, Transform
plane_2 = Plane(move_3.Geometry)
list_item_2 = ListItem(List=plane, Index=brick_num, Wrap=True)
list_item_3 = ListItem(List=plane_2, Index=brick_num, Wrap=True)

# ----
panel_7 = Panel(rotate_2.Geometry)

# ---- group: pickup_approach
plane_3 = Plane(move.Geometry)

# ---- group: brick_approach
plane_4 = Plane(list_item_3)

# ---- group: brick_place
plane_5 = Plane(list_item_2)

# ---- group: pickup_plane
plane_6 = Plane(rotate.Geometry)

# ----
pflip = FlipPlane(Plane=plane_4, ReverseX=False, ReverseY=False, SwapAxes=True)
pflip_2 = FlipPlane(Plane=plane_5, ReverseX=False, ReverseY=False, SwapAxes=True)
rotate_3 = Rotate(Geometry=pflip, Angle=1.570796327, Plane=pflip)  # -> Geometry, Transform
rotate_4 = Rotate(Geometry=pflip_2, Angle=1.570796327, Plane=pflip_2)  # -> Geometry, Transform
toggle = BooleanToggle(False)

attach = BooleanToggle(True)
z_offset = Slider(0.07, range=-0.1..0.2)
cluster = Cluster()
attach_tool = GhPythonScript(attached=attach, z_offset=z_offset, tool_mesh=cluster)  # -> tool_at_origin; inputs tool_mesh: Mesh
# ---------- attach_tool: Python ----------
import os
from compas.geometry import Frame
from compas.datastructures import Mesh
from compas_fab.robots import PlanningScene
from compas_fab.robots import Tool
from compas_ghpython.artists import MeshArtist
from compas_rhino.geometry import RhinoMesh

HERE = os.path.dirname(ghenv.Component.OnPingDocument().FilePath)

# create tool from mesh and frame
mesh = RhinoMesh.from_geometry(tool_mesh).to_compas()
frame = Frame([1, 0, 0], [0, 1, 0], [0, 0, z_offset])
tool = Tool(mesh, frame, name='vacuum_gripper')
tool_at_origin = MeshArtist(mesh).draw()

if robot and robot.client and robot.client.is_connected:
    scene = PlanningScene(robot)
    if attached:
        robot.attach_tool(tool)
        scene.add_attached_tool()
    else:
        if robot.attached_tool:
            scene.remove_attached_tool()
            scene.remove_collision_mesh('attached_tool_link_collision_0')
            robot.detach_tool()
# ---------- end attach_tool ----------

ros = ROSConnect(connect=toggle)  # -> ros_client, is_connected; inputs port: Int32, connect: Boolean
#   port ip: The ip address ROS. Defaults to 127.0.0.1.
#   port port: The port of ROS. Defaults to 9090.
#   port connect: If True, connects to ROS. If False, disconnects from ROS. Defaults to False.
#   port ros_client: The ROS client.
#   port is_connected: True if connection established.
# ---------- ros: Python ----------
"""
Connect or disconnect to ROS.

COMPAS FAB v0.19.1
"""
from ghpythonlib.componentbase import executingcomponent as component
from scriptcontext import sticky as st

from compas_fab.backends import RosClient
from compas_fab.ghpython.components import create_id


class ROSConnect(component):
    def RunScript(self, ip, port, connect):
        ros_client = None

        ip = ip or '127.0.0.1'
        port = port or 9090

        key = create_id(self, 'ros_client')
        ros_client = st.get(key, None)

        if ros_client:
            st[key].close()
        if connect:
            st[key] = RosClient(ip, port)
            st[key].run(5)

        ros_client = st.get(key, None)
        is_connected = ros_client.is_connected if ros_client else False
        return (ros_client, is_connected)
# ---------- end ros ----------
ros_robot = ROSRobot(ros_client=ros.ros_client, load=toggle)  # -> robot; inputs load: Boolean
#   port ros_client: The ROS client.
#   port load: If True, loads the robot from ROS. Defaults to False.
# ---------- ros_robot: Python ----------
"""
Load robot directly from ROS.

COMPAS FAB v0.19.1
"""
from compas_ghpython.artists import RobotModelArtist
from ghpythonlib.componentbase import executingcomponent as component
from scriptcontext import sticky as st

from compas_fab.ghpython.components import create_id


class ROSRobot(component):
    def RunScript(self, ros_client, load):
        key = create_id(self, 'robot')

        if ros_client and ros_client.is_connected and load:
            # Load URDF from ROS
            st[key] = ros_client.load_robot(load_geometry=True, precision='12f')
            st[key].artist = RobotModelArtist(st[key].model)

        robot = st.get(key, None)
        if robot:  # client sometimes need to be restarted, without needing to reload geometry
            robot.client = ros_client
        return robot
# ---------- end ros_robot ----------
ghpython_script_2 = GhPythonScript()  # -> out, a
# ---------- ghpython_script_2: Python ----------
from compas.geometry import Frame, Transformation

f = Frame.from_quaternion([0.707787, 0.001403, 0.000708, 0.706424],[2.15976, 1.36429, 0.0845992])
t = Transformation.from_frame(f)
# ---------- end ghpython_script_2 ----------
ghpython_script_3 = GhPythonScript(robot=ros_robot)  # -> robot
# ---------- ghpython_script_3: Python ----------
robot.scale(1000)
# ---------- end ghpython_script_3 ----------
list = ValueList({"Robot Axis A": "robotAaxis", "Robot Axis B": "robotBaxis", "Robot A": "robotA", "Robot B": "robotB"}, selected="Robot Axis B")
constraints_from_plane = ConstraintsFromPlane(robot=ghpython_script_3, group=list)  # -> constraints
#   port plane: The plane or frame from which we create position and orientation constraints.
#   port group: The planning group for which we specify the constraint. Defaults to the robot's main planning group.
#   port tolerance_position: The allowed tolerance to the frame's position (defined in the robot's units). Defaults to 0.001
#   port tolerance_xaxis: The allowed tolerance of the frame's X-axis in degrees.
#   port tolerance_yaxis: The allowed tolerance of the frame's Y-axis in degrees.
#   port tolerance_zaxis: The allowed tolerance of the frame's Z-axis in degrees.
#   port constraints: A list containing a position and an orientation constraint.
# ---------- constraints_from_plane: Python ----------
"""
Create a position and an orientation constraint from a plane calculated for the group's end-effector link.

COMPAS FAB v0.19.1
"""
import math

from ghpythonlib.componentbase import executingcomponent as component

from compas_fab.ghpython.components import coerce_frame


class ConstraintsFromPlane(component):
    def RunScript(self, robot, plane, group, tolerance_position, tolerance_xaxis, tolerance_yaxis, tolerance_zaxis):
        goal_constraints = None
        if robot and plane:
            tolerance_position = tolerance_position or 0.001
            tolerance_xaxis = tolerance_xaxis or 1.
            tolerance_yaxis = tolerance_yaxis or 1.
            tolerance_zaxis = tolerance_zaxis or 1.

            frame = coerce_frame(plane)
            print(repr(frame))
            tolerances_axes = [math.radians(tolerance_xaxis), math.radians(tolerance_yaxis), math.radians(tolerance_zaxis)]
            goal_constraints = robot.constraints_from_frame(frame, tolerance_position, tolerances_axes, group)

        return goal_constraints
# ---------- end constraints_from_plane ----------
plan_motion = PlanMotion(robot=ghpython_script_3, goal_constraints=constraints_from_plane, group=list, compute=Button())  # -> trajectory; inputs goal_constraints: list, attached_collision_meshes: list, path_constraints: list, compute: Boolean
#   port goal_constraints: The goal to be achieved, defined in a set of constraints. Constraints can be very specific, for example defining value domains for each joint, such that the goal configuration is included, or defining a volume in space, to which a specific robot link (e.g. the end-effector) is required to move to.
#   port start_configuration: The robot's full configuration, i.e. values for all configurable joints of the entire robot, at the starting position. Defaults to the all-zero configuration.
#   port group: The planning group used for calculation. Defaults to the robot's main planning group.
#   port attached_collision_meshes: A list of attached collision meshes to be included for planning.
#   port path_constraints: Optional constraints that can be imposed along the solution path. Note that path calculation won't work if the start_configuration violates these constraints. Defaults to None.
#   port planner_id: The name of the algorithm used for path planning. Defaults to 'RRTConnectkConfigDefault'
#   port compute: If True, calculates a trajectory.
#   port trajectory: The calculated trajectory.
# ---------- plan_motion: Python ----------
"""
Calculate a motion path.

COMPAS FAB v0.19.1
"""
from ghpythonlib.componentbase import executingcomponent as component
from scriptcontext import sticky as st

from compas_fab.ghpython.components import create_id


class PlanMotion(component):
    def RunScript(self, robot, goal_constraints, start_configuration, group, attached_collision_meshes, path_constraints, planner_id, compute):

        key = create_id(self, 'trajectory')

        path_constraints = list(path_constraints) if path_constraints else None
        attached_collision_meshes = list(attached_collision_meshes) if attached_collision_meshes else None
        planner_id = str(planner_id) if planner_id else 'RRTConnectkConfigDefault'

        if robot and robot.client and robot.client.is_connected and start_configuration and goal_constraints and compute:
            st[key] = robot.plan_motion(goal_constraints,
                                        start_configuration=start_configuration,
                                        group=group,
                                        options=dict(
                                            attached_collision_meshes=attached_collision_meshes,
                                            path_constraints=path_constraints,
                                            planner_id=planner_id,
                                        ))

        trajectory = st.get(key, None)
        return trajectory
# ---------- end plan_motion ----------
trajectory_visualize = TrajectoryVisualize(robot=ghpython_script_3, group=list, trajectory=plan_motion)  # -> start_configuration, configurations, fraction, time, planes, P, V, A
#   port group: The planning group for which this trajectory was planned.
#   port trajectory: The calculated trajectory.
#   port start_configuration: The start configuration of the trajectory.
#   port configurations: The full configurations along the trajectory.
#   port fraction: Indicates the fraction of requested trajectory that was calculated, e.g. 1 means the full trajectory was found.
#   port time: The time which is needed to execute that trajectory at full speed.
#   port planes: The planes of the robot's end-effector.
#   port P: The positions along the trajectory
#   port V: The velocities along the trajectory
#   port A: The accelerations along the trajectory
# ---------- trajectory_visualize: Python ----------
"""
Visualizes a trajectory.

COMPAS FAB v0.19.1
"""
from compas_ghpython import draw_frame
from compas_ghpython import list_to_ghtree
from ghpythonlib.componentbase import executingcomponent as component


class TrajectoryVisualize(component):
    def RunScript(self, robot, group, trajectory):
        start_configuration = None
        configurations = []
        fraction = 0.
        time = 0.

        planes = []
        positions = []
        velocities = []
        accelerations = []

        if robot and trajectory:
            group = group or robot.main_group_name

            for c in trajectory.points:
                configurations.append(robot.merge_group_with_full_configuration(c, trajectory.start_configuration, group))
                frame = robot.forward_kinematics(c, group, options=dict(solver='model'))
                planes.append(draw_frame(frame))
                positions.append(c.positions)
                velocities.append(c.velocities)
                accelerations.append(c.accelerations)

            start_configuration = trajectory.start_configuration
            fraction = trajectory.fraction
            time = trajectory.time_from_start

        P = list_to_ghtree(list(zip(*positions)))
        V = list_to_ghtree(list(zip(*velocities)))
        A = list_to_ghtree(list(zip(*accelerations)))

        # return outputs if you have them; here I try it for you:
        return (start_configuration, configurations, fraction, time, planes, P, V, A)
# ---------- end trajectory_visualize ----------
item = ListItem(List=trajectory_visualize.configurations, Index=Slider(0, range=0..200), Wrap=True)
robot_visualize = RobotVisualize(robot=ghpython_script_3, group=list, configuration=item)  # -> visual, collision, attached_meshes, frames, base_frame, ee_frame; inputs attached_collision_meshes: list, show_visual: Boolean, show_collision: Boolean, show_frames: Boolean, show_base_frame: Boolean, show_end_effector_frame: Boolean, show_acm: Boolean
#   port group: The planning group used for end-effector and base visualization.
#   port configuration: The robot's full configuration.
#   port attached_collision_meshes: A list of attached collision meshes.
#   port show_visual: Whether or not to show the robot's visual meshes.
#   port show_collision: Whether or not to show the robot's collision meshes.
#   port show_frames: Whether or not to show the robot's joint frames.
#   port show_base_frame: Whether or not to show the robot's base frame.
#   port show_end_effector_frame: Whether or not to show the robot's end-effector frame.
#   port show_acm: Whether or not to show the attached collision meshes (if any).
#   port visual: The robot's visual Rhino meshes (if any).
#   port collision: The robot's collision Rhino meshes (if any).
#   port attached_meshes: The attached collision Rhino meshes (if any).
#   port frames: The robot's joint frames as Rhino planes (if any).
#   port base_frame: The robot's base frame as a Rhino plane (if any).
#   port ee_frame: The robot's end-effector frame as a Rhino plane (if any).
# ---------- robot_visualize: Python ----------
"""
Visualizes the robot.

COMPAS FAB v0.19.1
"""
from compas.geometry import Frame
from compas.geometry import Transformation
from compas_ghpython.artists import FrameArtist
from compas_ghpython.artists import MeshArtist
from ghpythonlib.componentbase import executingcomponent as component


class RobotVisualize(component):
    def RunScript(self, robot, group, configuration, attached_collision_meshes, show_visual, show_collision,
                  show_frames, show_base_frame, show_end_effector_frame, show_acm):

        visual = None
        collision = None
        attached_meshes = None
        frames = None
        base_frame = None
        ee_frame = None

        if robot:
            show_visual = True if show_visual is None else show_visual
            configuration = configuration or robot.zero_configuration()

            robot.update(configuration, visual=show_visual, collision=show_collision)
            compas_frames = robot.transformed_frames(configuration, group)

            if show_visual:
                visual = robot.artist.draw_visual()

            if show_collision:
                collision = robot.artist.draw_collision()

            if show_base_frame:
                base_compas_frame = compas_frames[0]
                artist = FrameArtist(base_compas_frame)
                base_frame = artist.draw()

            if show_end_effector_frame:
                ee_compas_frame = robot.forward_kinematics(configuration, group, options=dict(solver='model'))
                artist = FrameArtist(ee_compas_frame)
                ee_frame = artist.draw()

            if show_frames:
                frames = []
                for compas_frame in compas_frames[1:]:
                    artist = FrameArtist(compas_frame)
                    frame = artist.draw()
                    frames.append(frame)

            if show_acm:
                attached_meshes = []
                for acm in attached_collision_meshes:
                    frame = robot.forward_kinematics(configuration, options=dict(solver='model', link_name=acm.link_name))
                    T = Transformation.from_frame_to_frame(Frame.worldXY(), frame)
                    mesh = acm.collision_mesh.mesh.transformed(T)
                    attached_meshes.append(MeshArtist(mesh).draw())

        return (visual, collision, attached_meshes, frames, base_frame, ee_frame)
# ---------- end robot_visualize ----------

# ==== cluster Cluster
mesh_detailed = Mesh([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])
bounding_box = BoundingBox(Content=mesh_detailed, Plane=PlaneXY(0, 0, 0))  # -> Box, Box_2
mesh_brep = MeshBrep(
    Brep=bounding_box.Box,
    Settings={GridMaxCount=16, GridMinCount=4, JaggedSeams=False, MaxEdgeLength=0, MinEdgeLength=0.0001, MinTolerance=0, Refine=True, RefineAngle=0, RelativeTolerance=0.65, SimplePlanes=True, Tolerance=0})
mesh_join = MeshJoin(Meshes=mesh_brep)
mesh = ClusterOutput(mesh_join)
