# Grasshopper definition ACADIA_FEM.gh (Grasshopper 1.0.7)
# plug-ins: karambaGH

# INPUT GEOMETRY
crv = Curve([<curve referenced from the Rhino model> x45])

# ---- group: members
number_slider = Slider(44, range=0..44)
python = GhPythonScript(n=number_slider)  # -> rob_num; inputs n: Int32
# ---------- python: Python ----------
#Robot Order

order = [
2, #0
1, #1
2, #2
1, #3
2, #4
1, #5
2, #6
1, #7
2, #8
2, #9
1, #10
2, #11
2, #12
1, #13
2, #14
2, #15
1, #16
1, #17
2, #18
1, #19
2, #20
1, #21
2, #22
2, #23
2, #24
1, #25
2, #26
1, #27
2, #29
2, #28
1, #30
2, #31
1, #32
1, #33
1, #34
2, #33
2, #38
1, #36
1, #37
#done
2, #36
2, #37
2, #39
2, #41
2, #42
1, #43
]

rob_num = order[n]
# ---------- end python ----------
python_2 = GhPythonScript(n=number_slider)  # -> idx; inputs n: Int32
# ---------- python_2: Python ----------
idx = range(n+1)

print idx
# ---------- end python_2 ----------
panel = Panel(number_slider)
panel_2 = Panel(python)
data = Data(crv)
data_2 = Data(python_2)

# ---- group: nodes
pt = Point([<point referenced from the Rhino model> x17])
python_3 = GhPythonScript(n=number_slider)  # -> idx; inputs n: Int32
# ---------- python_3: Python ----------
sphere_order = {
0: 2,
1: 3,
2: 4,
3: 4,
4: 4,
5: 4,
6: 5,
7: 5,
8: 5,
9: 6,
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}

idx = range(sphere_order[n])

print idx
# ---------- end python_3 ----------
data_3 = Data(pt)
data_4 = Data(python_3)

# ----
num = Number()

# ----
# INPUT PARAMETERS
# can update placement plane location manually during path planning or use default "place_far" value
panel_3 = Panel("C:\Users\Edvard\Documents\GitHub\workshop_princeton_2021\workshop_ACADIA\input_data")
panel_4 = Panel("C:\Users\Edvard\Documents\GitHub\workshop_princeton_2021\workshop_ACADIA\input_data")
python_4 = GhPythonScript(path=panel_4, filename="member_rotations.json", read_data=Toggle(True))  # -> rotations
# ---------- python_4: Python ----------
import os
from compas_fab.utilities import read_data_from_json
from compas_fab.robots import Configuration

if read_data:
    data = read_data_from_json(os.path.join(path, filename))
    
    
print len(data)
print data
print data['member_29']

rotations = []
for i in range(len(data)):
    rotations.append(data['member_{}'.format(i)])

print rotations
# ---------- end python_4 ----------
python_5 = GhPythonScript(path=panel_3, filename="input_params.json", read_data=Toggle(True))  # -> node_diameter, member_offset, cross_section, place_close, place_far
# ---------- python_5: Python ----------
import os
from compas_fab.utilities import read_data_from_json

if read_data:
    data = read_data_from_json(os.path.join(path, filename))

print data

node_diameter = data['node_diameter']
member_offset = data['member_dist_from_node']
cross_section = data['cross_section_dim']
place_far = data['offset_place_far']
place_close = data['offset_place_close']
# ---------- end python_5 ----------
num_2 = Number(python_5.node_diameter)
num_3 = Number(python_5.member_offset)
num_4 = Number(python_5.cross_section)
num_5 = Number(python_5.place_close)
data_5 = Data(python_4)
num_6 = Number(num)

# ---- group: cross-section
# 1 3/16" (30.16mm) section.
# this dist is to corner
panel_5 = Panel(num_4)
division = Division(A=panel_5, B="sqrt(2)")
polygon = Polygon(Plane=PlaneXY(0, 0, 0), Radius=division, Segments="4", FilletRadius=0)  # -> Polygon, Length
rotate = Rotate(Geometry=polygon.Polygon, Angle=degrees("45"), Plane=PlaneXY(0, 0, 0))  # -> Geometry, Transform
# DEFINE KARAMBA ELEMENTS
crv_2 = Curve(rotate.Geometry)

# ----
num_7 = Number(python_5.place_far)

division_2 = Division(A="1050", B="3")
matprops = MaterialPropertiesKaramba3D(
    FamilyOfMaterial="wood",
    Name="poplar",
    YoungsModulus_kN_cm2="1050",
    InPlaneShearModulus_kN_cm2=division_2,
    TransverseShearModulus_kN_cm2=division_2,
    SpecificWeight_kN_m3="6",
    CoefficientOfThermalExpansion_1_C=1e-05,
    YieldStrength_kN_cm2=23.5,
    mode="Isotrop")
num_8 = Number(panel_5)
multiplication = Multiplication(A=num_8, B=100)
material = MaterialKaramba3D(matprops)
number = Number(multiplication)
number_2 = Number(multiplication)
cross_section = CrossSectionKaramba3D(
    FamilyNameOfCrossSection="DefaultCroSec",
    Material=material,
    Height_cm=number,
    UpperFlangeWidth_cm=number_2,
    LowerFlangeWidth_cm=number_2,
    mode="Trapezoid")
crosec = CrossSectionKaramba3D(cross_section)

# ---- group: current member curves
data_6 = Data(data_2)
data_7 = Data(data)
item = ListItem(List=data_7, Index=data_6, Wrap=True)
crv_3 = Curve(item)

# ---- group: member info
len = Length(Curve=crv_3)
midpt = CurveMiddle(Curve=crv_3)
panel_6 = Panel(num_3)
panel_7 = Panel(num_2)
pl = PlaneNormal(Origin=midpt, ZAxis=crv_3)
python_6 = GhPythonScript(radius=panel_7, offset=panel_6, len=len)  # -> z_factor; inputs len: list
# ---------- python_6: Python ----------
len_reduce = (radius + offset)*2

z_factor = [(l - len_reduce)/l for l in len]
# ---------- end python_6 ----------

# ---- group: member meshes
pframes = PerpFrames(Curve=crv_3, Count=1, Align=True)  # -> Frames, Parameters
crv_4 = Curve(crv_2)
orient = Orient(Geometry=crv_4, Source=PlaneXY(0, 0, 0), Target=simplify(pframes.Frames))  # -> Geometry, Transform
swp1 = Sweep1(Rail=graft(crv_3), Sections=orient.Geometry, Miter=1)

# ---- group: member rotations about axis
data_8 = Data(data_5)
data_9 = Data(data_2)
item_2 = ListItem(List=data_8, Index=data_9, Wrap=True)
panel_8 = Panel(item_2)

# ---- group: nodes
data_10 = Data(data_3)
data_11 = Data(data_4)
panel_9 = Panel(num_2)
item_3 = ListItem(List=data_10, Index=data_11, Wrap=True)
sph = Sphere(Base=item_3, Radius=panel_9)

# ----
# split into supportmembers (fixed at base) and normal members (pinned both ends)
panel_10 = Panel("""3
39
3""")
python_7 = GhPythonScript()  # -> ele_sup_start, ele_norm, ele_sup_end
# ---------- python_7: Python ----------
ele_sup_start = []
for i in range(3):
    ele_sup_start.append("{}_sup_1".format(i))
    ele_sup_start.append("{}_sup_2".format(i))
    
ele_sup_end = []
for i in range(42,45):
    ele_sup_end.append("{}_sup_1".format(i))
    ele_sup_end.append("{}_sup_2".format(i))
    

#ele_norm = []
#for i in range(3,42):
#    ele_norm.append("{}_norm".format(i))
    
ele_norm = []
for i in range(3,42):
    ele_norm.append("{}_norm_1".format(i))
    ele_norm.append("{}_norm_2".format(i))
    
print ele_norm
# ---------- end python_7 ----------
vec = Vector([Vector(-0.9853303771, 0, 0.1706576925), Vector(0.905402374, 0, -0.4245545208), Vector(0.1599355752, 0.9684205669, 0.1912647836), Vector(-0.8783972285, -0.4305993595, 0.2073704427), Vector(0.1098924174, 0.9205970569, -0.3747328587), Vector(0.760114408, -0.5200522929, -0.3895788744)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])
crv_5 = Curve(crv)
partition = PartitionList(List=crv_5, Size=panel_10)  # -> simplify(Chunks)
partition_2 = PartitionList(List=vec, Size=panel_10)  # -> simplify(Chunks)
bang = ExplodeTree(Data=partition)  # -> Branch0, Branch1, Branch2
bang_2 = ExplodeTree(Data=partition_2)  # -> Branch0, Branch1, Branch2
crv_6 = Curve(bang.Branch0)
crv_7 = Curve(bang.Branch1)
crv_8 = Curve(bang.Branch2)
vec_2 = Vector(bang_2.Branch0)
vec_3 = Vector(bang_2.Branch1)
vec_4 = Vector(bang_2.Branch2)
txt = Text(python_7.ele_sup_start)
txt_2 = Text(python_7.ele_norm)
txt_3 = Text(python_7.ele_sup_end)

# ----
# STRUCTURE AT CURRENT STAGE OF CONSTRUCTION
pln = Plane(pl)
pt_2 = Point(midpt)

pt_3 = Point(pt)
item_4 = ListItem(List=pt_3, Index=0, Wrap=True)  # -> Item1, Item
pt_4 = Point(item_4.Item)
pt_5 = Point(item_4.Item1)
supp = SupportKaramba3D(PosInd=pt_4, menu=[buttons(on, on, on, on, on, on)])
supp_2 = SupportKaramba3D(PosInd=pt_5, menu=[buttons(on, on, on, on, on, on)])
support = SupportKaramba3D(supp)
support_2 = SupportKaramba3D(supp_2)

divide = DivideCurve(Curve=crv_8, Count=2, Kinks=False)  # -> Points, Tangents, Parameters
shatter = Shatter(Curve=graft(crv_8), Parameters=divide.Parameters)
vec_5 = Vector(vec_4)
dup = DuplicateData(Data=graft(vec_5), Number=2, Order=True)
crv_9 = Curve(shatter)
txt_4 = Text(txt_3)
graft = GraftTree(Tree=dup, IncludeEmptyLists=True, IncludeNullItems=True)
graft_2 = GraftTree(Tree=crv_9, IncludeEmptyLists=True, IncludeNullItems=True)
graft_3 = GraftTree(Tree=txt_4, IncludeEmptyLists=True, IncludeNullItems=True)
crosec_2 = CrossSectionKaramba3D(crosec)
linetobeam = LineToBeamKaramba3D(
    Line=graft_2,
    Identifier=graft_3,
    CrossSection=crosec_2,
    New=True,
    Remove=True,
    LimitDistance_m=0.005,
    ZOrientation=graft,
    Bending=Toggle(True))  # -> simplify(Element), Points, Info
element = ElementKaramba3D(linetobeam.Element)

divide_2 = DivideCurve(Curve=crv_7, Count=2, Kinks=False)  # -> Points, Tangents, Parameters
shatter_2 = Shatter(Curve=graft(crv_7), Parameters=divide_2.Parameters)
vec_6 = Vector(vec_3)
dup_2 = DuplicateData(Data=graft(vec_6), Number=2, Order=True)
crv_10 = Curve(shatter_2)
txt_5 = Text(txt_2)
graft_4 = GraftTree(Tree=dup_2, IncludeEmptyLists=True, IncludeNullItems=True)
graft_5 = GraftTree(Tree=crv_10, IncludeEmptyLists=True, IncludeNullItems=True)
graft_6 = GraftTree(Tree=txt_5, IncludeEmptyLists=True, IncludeNullItems=True)
crosec_3 = CrossSectionKaramba3D(crosec)
linetobeam_2 = LineToBeamKaramba3D(
    Line=graft_5,
    Identifier=graft_6,
    CrossSection=crosec_3,
    New=True,
    Remove=True,
    LimitDistance_m=0.005,
    ZOrientation=graft_4,
    Bending=Toggle(True))  # -> simplify(Element), Points, Info
element_2 = ElementKaramba3D(linetobeam_2.Element)

divide_3 = DivideCurve(Curve=crv_6, Count=2, Kinks=False)  # -> Points, Tangents, Parameters
shatter_3 = Shatter(Curve=graft(crv_6), Parameters=divide_3.Parameters)
vec_7 = Vector(vec_2)
dup_3 = DuplicateData(Data=graft(vec_7), Number=2, Order=True)
crv_11 = Curve(shatter_3)
txt_6 = Text(txt)
graft_7 = GraftTree(Tree=dup_3, IncludeEmptyLists=True, IncludeNullItems=True)
graft_8 = GraftTree(Tree=crv_11, IncludeEmptyLists=True, IncludeNullItems=True)
graft_9 = GraftTree(Tree=txt_6, IncludeEmptyLists=True, IncludeNullItems=True)
crosec_4 = CrossSectionKaramba3D(crosec)
linetobeam_3 = LineToBeamKaramba3D(
    Line=graft_8,
    Identifier=graft_9,
    CrossSection=crosec_4,
    New=True,
    Remove=True,
    LimitDistance_m=0.005,
    ZOrientation=graft_7,
    Bending=Toggle(True))  # -> simplify(Element), Points, Info
element_3 = ElementKaramba3D(linetobeam_3.Element)

Z = UnitZ(Factor="-0.01")
pt_6 = Point(pt)
loads = LoadsKaramba3D(Vector=Vector(0, 0, -1), LCase=0, mode="Gravity")
loads_2 = LoadsKaramba3D(ForceVector=Z, Local=False, PosInd=pt_6, LCase=0, mode="Point")
load = LoadKaramba3D(loads)
load_2 = LoadKaramba3D(loads_2)

# ----
# ELEMENTS
# use poplar wood as the material
entwine = Entwine(Branch00=element_3, Branch01=element_2, Branch02=element, FlattenInputs=True)
element_4 = ElementKaramba3D(simplify(flatten(entwine)))

# ----
# LOADS
# self-weight for all members, with an additional 1kg point load at each support to represent the weight of the nodes. Need to weigh this later.
merge = Merge(Data1=load, Data2=load_2)
load_3 = LoadKaramba3D(merge)

lng = ListLength(List=load_3)
lng_2 = ListLength(List=load_3)
lng_3 = ListLength(List=element_4)
lng_4 = ListLength(List=element_4)
subtraction = Subtraction(A=lng, B="8")
split = SplitList(List=load_3, Index=subtraction)  # -> ListA, ListB
subtraction_2 = Subtraction(A=lng_2, B="4")
split_2 = SplitList(List=load_3, Index=subtraction_2)  # -> ListA, ListB
subtraction_3 = Subtraction(A=lng_3, B="24")
split_3 = SplitList(List=element_4, Index=subtraction_3)  # -> ListA, ListB
subtraction_4 = Subtraction(A=lng_4, B="48")
split_4 = SplitList(List=element_4, Index=subtraction_4)  # -> ListA, ListB
load_4 = LoadKaramba3D(split.ListA)
element_5 = ElementKaramba3D(split_3.ListA)
load_5 = LoadKaramba3D(split_2.ListA)
element_6 = ElementKaramba3D(split_4.ListA)

panel_11 = Panel("""24
27
29
30
31
32""")
panel_12 = Panel("""39
40
41
42
43
44""")
int = Integer(panel_11)
int_2 = Integer(panel_12)
python_8 = GhPythonScript(step=Slider(-1, range=-1..251), r1=int, r2=int_2)  # -> out, rob1_support, rob2_support, n_delete; inputs r1: list, r2: list
# ---------- python_8: Python ----------
import math

n = int(math.floor(step/7))
n_delete = int(step%7)
print n, n_delete

n_r1 = int(n%6)
n_r2 = int(math.floor(n/6))

rob1_support = r1[n_r1]
rob2_support = r2[n_r2]

print 36*7
# ---------- end python_8 ----------
panel_13 = Panel(python_8.rob2_support)
panel_14 = Panel(python_8.rob1_support)
panel_15 = Panel(python_8.n_delete)

panel_16 = Panel("""14
15
16
18
19
20""")
panel_17 = Panel("""24
27
29
30
31
32""")
int_3 = Integer(panel_16)
int_4 = Integer(panel_17)
python_9 = GhPythonScript(step=Slider(181, range=-1..251), r1=int_3, r2=int_4)  # -> out, rob1_support, rob2_support, n_delete; inputs r1: list, r2: list; same code as python_8
panel_18 = Panel(python_9.rob2_support)
panel_19 = Panel(python_9.n_delete)
panel_20 = Panel(python_9.rob1_support)

panel_21 = Panel("""3
4
5
6
7
8""")
panel_22 = Panel("""14
15
16
18
19
20""")
int_5 = Integer(panel_21)
int_6 = Integer(panel_22)
python_10 = GhPythonScript(step=Slider(251, range=-1..251), r1=int_5, r2=int_6)  # -> out, rob1_support, rob2_support, n_delete; inputs r1: list, r2: list; same code as python_8
panel_23 = Panel(python_10.n_delete)
panel_24 = Panel(python_10.rob1_support)
panel_25 = Panel(python_10.rob2_support)

panel_26 = Panel("""999
38
34
37
33
36
35
39,40,41,42,43,44""")
panel_27 = Panel(panel_14)
panel_28 = Panel(panel_13)
number_slider_2 = Slider(0, range=0..7)
python_11 = GhPythonScript(n="6", rob1=panel_27, rob2=panel_28)  # -> support_list; inputs n: Int32
# ---------- python_11: Python ----------
support_list = []

for i in range(n+1):
    support_list.append("{},{}".format(rob1,rob2))

support_list.append(rob1)

print support_list
# ---------- end python_11 ----------
python_12 = GhPythonScript(n=panel_15, remove_eles=panel_26, support_eles=python_11)  # -> remove_ids, support_idx; inputs n: Int32, remove_eles: list, support_eles: list
# ---------- python_12: Python ----------
def split_and_append(list_in):
    list_out = []
    for row in list_in:
        list = row.split(',')
        for item in list:
            list_out.append(item)

    return list_out
    
remove_list = split_and_append(remove_eles[1:n+1])
support_list = split_and_append([support_eles[n]])

# turn elements to remove into equivalent text tags
remove_ids = []
for num in remove_list:
    remove_ids.append("{}_norm_1".format(num))
    remove_ids.append("{}_norm_2".format(num))

support_idx = [int(x) for x in support_list]

print remove_ids
print support_idx
# ---------- end python_12 ----------
panel_29 = Panel(python_11)
panel_30 = Panel(python_12.support_idx)
panel_31 = Panel(python_12.remove_ids)
txt_7 = Text(python_12.remove_ids)
python_13 = GhPythonScript(remove_ids=txt_7)  # -> remove_index; inputs remove_ids: list
# ---------- python_13: Python ----------
remove_index = []
for remove_id in remove_ids:
    member_number = int(remove_id.split('_')[0])
    member_piece = int(remove_id.split('_')[2])
    
    remove_index.append(member_number*2 + (member_piece-1))
    
print remove_index
# ---------- end python_13 ----------
panel_32 = Panel(python_13)

panel_33 = Panel("""9999
28
26
25
23
21
22
27,28,29,30,31,32""")
panel_34 = Panel(panel_20)
panel_35 = Panel(panel_18)
number_slider_3 = Slider(0, range=0..7)
python_14 = GhPythonScript(n="6", rob1=panel_34, rob2=panel_35)  # -> support_list; inputs n: Int32
# ---------- python_14: Python ----------
support_list = []

for i in range(n+1):
    support_list.append("{},{}".format(rob1,rob2))

support_list.append(rob2)

print support_list
# ---------- end python_14 ----------
panel_36 = Panel(python_14)
python_15 = GhPythonScript(n=panel_19, remove_eles=panel_33, support_eles=python_14)  # -> remove_ids, support_idx; inputs n: Int32, remove_eles: list, support_eles: list; same code as python_12
panel_37 = Panel(python_15.remove_ids)
txt_8 = Text(python_15.remove_ids)
python_16 = GhPythonScript(remove_ids=txt_8)  # -> remove_index; inputs remove_ids: list; same code as python_13
panel_38 = Panel(python_16)

panel_39 = Panel(panel_23)

panel_40 = Panel("""9999
17
13
10
12
9
11
14,15,16,18,19,20""")
panel_41 = Panel(panel_24)
panel_42 = Panel(panel_25)
number_slider_4 = Slider(0, range=0..7)
python_17 = GhPythonScript(n="6", rob1=panel_41, rob2=panel_42)  # -> support_list; inputs n: Int32; same code as python_14
panel_43 = Panel(python_17)
python_18 = GhPythonScript(n=panel_39, remove_eles=panel_40, support_eles=python_17)  # -> remove_ids, support_idx; inputs n: Int32, remove_eles: list, support_eles: list; same code as python_12
panel_44 = Panel(python_18.remove_ids)
txt_9 = Text(python_18.remove_ids)
python_19 = GhPythonScript(remove_ids=txt_9)  # -> remove_index; inputs remove_ids: list; same code as python_13
panel_45 = Panel(python_19)

merge_2 = Merge(
    Data1=ColourSwatch(SwatchColor=RGB(251, 255, 0)),
    Data2=ColourSwatch(SwatchColor=RGB(255, 255, 255)),
    Data3=ColourSwatch(SwatchColor=RGB(255, 255, 255)),
    Data4=ColourSwatch(SwatchColor=RGB(255, 255, 255)),
    Data5=ColourSwatch(SwatchColor=RGB(227, 0, 0)),
    Data6=ColourSwatch(SwatchColor=RGB(21, 255, 0)))
col = Colour(merge_2)  # disabled

panel_46 = Panel("C:/Users/Edvard/Documents/GitHub/workshop_princeton_2021/ACADIA/output_data")
panel_47 = Panel("C:/Users/Edvard/Documents/GitHub/workshop_princeton_2021/ACADIA/output_data")
panel_48 = Panel("C:/Users/Edvard/Documents/GitHub/workshop_princeton_2021/ACADIA/output_data")
panel_49 = Panel("""6x6 = 36 combos
x7 = steps/combo""")
save_data = Button()
data_12 = Data([8.098722687e-07, 2.679409206e-05, 2.674621025e-05, 2.669380492e-05, 2.703217008e-05, 2.70336123e-05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])
save_data_2 = Button()
save_data_3 = Button()
int_7 = Integer(panel_11)
int_8 = Integer(panel_12)
data_13 = Data([1.265290802e-06, 1.229284232e-06, 1.218080325e-06, 1.192299536e-06, 1.186155903e-06, 1.167508219e-06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])
data_14 = Data([1.612250698e-08, 7.886765063e-09, 8.046194582e-09, 8.232287732e-09, 8.360331813e-09, 8.541061473e-09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])
data_15 = Data([5.651606777e-08, 5.629122698e-09, 5.360557988e-09, 5.355971795e-09, 5.260238523e-09, 5.344019159e-09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])
int_9 = Integer(panel_16)
int_10 = Integer(panel_17)
data_16 = Data([4.684899371e-09, 3.296703653e-09, 3.483342104e-09, 3.309764508e-09, 7.985476265e-09, 7.95116089e-09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])
data_17 = Data([5.715708532e-09, 1.318565041e-07, 1.352530687e-07, 1.39217829e-07, 1.439493247e-07, 1.490804051e-07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])
int_11 = Integer(panel_21)
int_12 = Integer(panel_22)
data_18 = Data([5.783614728e-07, 9.837712745e-05, 9.837000118e-05, 9.838772722e-05, 9.838509787e-05, 9.838248114e-05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])
data_19 = Data([7.002911207e-09, 1.726219302e-09, 1.842757849e-09, 2.2351344e-09, 2.365945486e-09, 2.504759716e-09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])
data_20 = Data([3.112177095e-09, 6.911574432e-07, 7.272717217e-07, 7.676421577e-07, 8.127209124e-07, 8.634464935e-07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])
python_20 = GhPythonScript(path=panel_46, name="output_data_phase1.json", r1=int_7, r2=int_8, T=data_13, A=data_14, B=data_15, save_data=save_data)  # inputs r1: list, r2: list, T: list, A: list, B: list
# ---------- python_20: Python ----------
import os
from compas_fab.utilities import write_data_to_json

import json


configs_combined = {}
if save_data:
    for cnt2,i in enumerate(r2):
        for cnt1,j in enumerate(r1):
            start = cnt2*42 + cnt1*7
            print start
            configs_combined['{}_{}'.format(i,j)] = { 'BENDING':B[start:start+7],'AXIAL':A[start:start+7],'TOTAL':T[start:start+7]}
        #c.to_json(os.path.join(path, 'member_{}/config_{}.json'.format(member_num,i)))

    print configs_combined
    #write_data_to_json(configs_combined, os.path.join(path, 'output_phase1.json'), pretty = True)

    with open(os.path.join(path, name), 'w') as f:
        json.dump(configs_combined, f, sort_keys=True, indent=4)
        
    f.close()
# ---------- end python_20 ----------
python_21 = GhPythonScript(
    path=panel_47,
    name="output_data_phase2.json",
    r1=int_9,
    r2=int_10,
    T=data_12,
    A=data_16,
    B=data_17,
    save_data=save_data_2)  # inputs r1: list, r2: list, T: list, A: list, B: list
# ---------- python_21: Python ----------
import os
from compas_fab.utilities import write_data_to_json

import json


configs_combined = {}
if save_data:
    for cnt2,i in enumerate(r2):
        for cnt1,j in enumerate(r1):
            start = cnt2*42 + cnt1*7
            print i,j,start
            configs_combined['{}_{}'.format(i,j)] = { 'BENDING':B[start:start+7],'AXIAL':A[start:start+7],'TOTAL':T[start:start+7]}
        #c.to_json(os.path.join(path, 'member_{}/config_{}.json'.format(member_num,i)))
    
    print configs_combined
    #write_data_to_json(configs_combined, os.path.join(path, 'output_phase1.json'), pretty = True)
    
    with open(os.path.join(path, name), 'w') as f:
        json.dump(configs_combined, f, sort_keys=True, indent=4)
        
    f.close()
# ---------- end python_21 ----------
python_22 = GhPythonScript(
    path=panel_48,
    name="output_data_phase3.json",
    r1=int_11,
    r2=int_12,
    T=data_18,
    A=data_19,
    B=data_20,
    save_data=save_data_3)  # inputs r1: list, r2: list, T: list, A: list, B: list; same code as python_20

panel_50 = Panel("C:\Users\Edvard\Documents\GitHub\workshop_princeton_2021\workshop_ACADIA\output_data")
panel_51 = Panel("""lowest strain energy
P1: (39, 30)
P2: (31, 15)
P3: (16, 6)""")
list = ValueList({"AXIAL", "BENDING", "TOTAL"}, selected="AXIAL")
list_2 = ValueList({"PHASE1": "output_data_phase1.json", "PHASE2": "output_data_phase2.json", "PHASE3": "output_data_phase3.json"}, selected="PHASE1")
python_23 = GhPythonScript(path=panel_50, name=list_2, order_based=list, read_data=Toggle(True))  # -> out, saved_sort
# ---------- python_23: Python ----------
import os
import math
from compas_fab.utilities import read_data_from_json

if read_data:
    data = read_data_from_json(os.path.join(path, name))
    
    saved = {}
    
    for step in data.items():
        name = step[0]    
        
        #ignore final step, since TOTAL and BENDING have large differences here
        #that skew data
        saved[name] = sum(step[1][order_based][0:6])
        print step[1][order_based][0:6]
        
    print saved
    
    saved_sort = sorted(saved.items(), key=lambda x: x[1])
    
    print saved_sort
# ---------- end python_23 ----------
panel_52 = Panel(python_23.saved_sort)

# ----
# remove double joints at end, but keep orientation consistent
vec_8 = Vector(vec)

# ----
# SUPPORTS
# treat initial support as fixed, while the other end is pinned. This is closer to how the actual structure behaves based on the types of supports used. Could potentially add some moment support at end...
# 
# The robot grips the middle of the member as a fixed support
crv_12 = Curve(crv_5)

# ----
# based on weak and strong axis bending of tab, calculate rotation angle...etc
txt_10 = Text(txt_2)
dispatch = Dispatch(List=txt_10, DispatchPattern=[True, False])  # -> ListA, ListB
panel_53 = Panel(dispatch.ListA)
panel_54 = Panel(dispatch.ListB)
txt_11 = Text(graft(dispatch.ListB))
beam_joints = BeamJointsKaramba3D(
    ElementIdentifiers=txt_11,
    CtKNMAtStartingNode=Vector(0, 0, 0),
    CrKNmRadAtStartingNode=Vector(0, 0, 0),
    CtKNMAtEndNode=Vector(0, 0, 0),
    CrKNmRadAtEndNode="{999999,0.03,0.33}",
    menu=[buttons(off, off, off, off, off, off), buttons(off, off, off, off, on, on)])
joint = JointKaramba3D(beam_joints)

# ----
# JOINTS
# pin all the ends of the members, but leave the middle node (where the robot grips) as a full connection to represent the fact that the member is continuous here. Leave torsional resistance at the joints to represent the fact that the tabs will not allow members to twist about their own axis.
# 
# Do not but a joint at the ends of the support members, since they are connected to the base. Currently a torsional rigid body mode exists when but supports are assigned a joint at one end, doesn't affect results but for now keep top of start support elements without a joint
txt_12 = Text(txt)
txt_13 = Text(txt_3)
dispatch_2 = Dispatch(List=txt_12, DispatchPattern=[True, False])  # -> ListA, ListB; disabled
dispatch_3 = Dispatch(List=txt_13, DispatchPattern=[True, False])  # -> ListA, ListB
merge_3 = Merge(Data1=dispatch_2.ListA, Data2=dispatch.ListA, Data3=dispatch_3.ListA)

txt_14 = Text(graft(merge_3))
beam_joints_2 = BeamJointsKaramba3D(
    ElementIdentifiers=txt_14,
    CtKNMAtStartingNode=Vector(0, 0, 0),
    CrKNmRadAtStartingNode="{999999,0.03,0.33}",
    CtKNMAtEndNode=Vector(0, 0, 0),
    CrKNmRadAtEndNode=Vector(0, 0, 0),
    menu=[buttons(off, off, off, off, on, on), buttons(off, off, off, off, off, off)])
joint_2 = JointKaramba3D(beam_joints_2)

merge_4 = Merge(Data1=graft(joint_2), Data2=graft(joint))  # -> flatten(Result)

joint_3 = JointKaramba3D(merge_4)

lng_5 = ListLength(List=joint_3)
lng_6 = ListLength(List=joint_3)
subtraction_5 = Subtraction(A=lng_5, B="45")
split_5 = SplitList(List=joint_3, Index=subtraction_5)  # -> ListA, ListB
subtraction_6 = Subtraction(A=lng_6, B="21")
split_6 = SplitList(List=joint_3, Index=subtraction_6)  # -> ListA, ListB
joint_4 = JointKaramba3D(split_5.ListA)
joint_5 = JointKaramba3D(split_6.ListA)

line = Line(crv_10)
line_2 = Line(crv_11)
line_3 = Line(crv_9)
entwine_2 = Entwine(Branch00=line_2, Branch01=line, Branch02=line_3, FlattenInputs=True)  # -> flatten(Result)
crv_13 = Curve(entwine_2)
num_9 = Number(python_13)
python_24 = GhPythonScript(x=crv_13, off_idx=num_9)  # -> out, on_list; inputs x: list, off_idx: list of Int32
# ---------- python_24: Python ----------
num = len(x)

on_list = []
for i in range(num):
    on_list.append(True)
    
for idx in off_idx:
    on_list[idx] = False
    
print on_list
# ---------- end python_24 ----------

line_4 = Line(crv_11)
line_5 = Line(crv_10)
line_6 = Line(crv_9)
entwine_3 = Entwine(Branch00=line_4, Branch01=line_5, Branch02=line_6, FlattenInputs=True)  # -> flatten(Result)
crv_14 = Curve(entwine_3)
num_10 = Number(python_16)
python_25 = GhPythonScript(x=crv_14, off_idx=num_10)  # -> out, on_list; inputs x: list, off_idx: list of Int32; same code as python_24

line_7 = Line(crv_11)
line_8 = Line(crv_10)
line_9 = Line(crv_9)
entwine_4 = Entwine(Branch00=line_7, Branch01=line_8, Branch02=line_9, FlattenInputs=True)  # -> flatten(Result)
crv_15 = Curve(entwine_4)
num_11 = Number(python_19)
python_26 = GhPythonScript(x=crv_15, off_idx=num_11)  # -> out, on_list; inputs x: list, off_idx: list of Int32; same code as python_24

element_7 = ElementKaramba3D(flatten(element_4))
load_6 = LoadKaramba3D(flatten(load_3))
joint_6 = JointKaramba3D(flatten(joint_3))

element_8 = ElementKaramba3D(flatten(element_5))
load_7 = LoadKaramba3D(flatten(load_5))
joint_7 = JointKaramba3D(flatten(joint_5))

element_9 = ElementKaramba3D(flatten(element_6))
load_8 = LoadKaramba3D(flatten(load_4))
joint_8 = JointKaramba3D(flatten(joint_4))

list_3 = ValueList({"1st phase": 0, "2nd phase": 1, "3rd phase": 2}, selected="1st phase")
num_12 = Number(python_12.support_idx)
num_13 = Number(python_15.support_idx)
num_14 = Number(python_18.support_idx)
filter = StreamFilter(Gate=list_3, Stream0=num_12, Stream1=num_13, Stream2=num_14)

num_15 = Number(filter)

item_5 = ListItem(List=crv_12, Index=num_15, Wrap=False)  # -> simplify(graft(Item))
item_6 = ListItem(List=vec_8, Index=num_15, Wrap=False)  # -> simplify(graft(Item))
end = EndPoints(Curve=item_5)  # -> Start, End
midpt_2 = CurveMiddle(Curve=item_5)
vec_9 = Vector(item_5)
pl_2 = ConstructPlane(Origin=midpt_2, XAxis=vec_9, YAxis=item_6)
rot3d = Rotate3D(Geometry=graft(pl_2), Angle=-1.570796327, Center=graft(midpt_2), Axis=graft(vec_9))  # -> Geometry, Transform
pln_2 = Plane(graft(rot3d.Geometry))

pt_7 = Point(flatten([end.Start, end.End]))
pt_8 = Point(graft(midpt_2))
supp_3 = SupportKaramba3D(PosInd=pt_8, PlaneOfReference=pln_2, menu=[buttons(on, on, on, on, on, on)])
support_3 = SupportKaramba3D(supp_3)

cset = CreateSet(List=flatten(pt_7))  # -> Set, Map
python_27 = GhPythonScript(n=num_15, S=cset.Set, map_index=cset.Map)  # -> S, new_tree; inputs n: list of Int32, S: list, map_index: list
# ---------- python_27: Python ----------
import ghpythonlib.treehelpers as th

#remove node if it is attached to the end support (members 0-2, 42-44)
for i,node in enumerate(n):
    if node in [0,1,2,42,43,44]:
        map_index[2*i + 1] = 0
        print S
        del S[2*i + 1]
        print S
        
print map_index

num_points = int(len(map_index)/2)

new_list = []
save_list = []
for i in range(num_points):
    x,y = map_index[i*2:i*2+2]
    print x,y
    print new_list
    
    if not x in save_list and not y in save_list:
        save_list.append(x)
        save_list.append(y)
        new_list.append([0,0])
    elif not x in save_list:
        save_list.append(x)
        new_list.append([0])
    elif not y in save_list:
        save_list.append(y)
        new_list.append([0])
    else:
        new_list.append([])
        
    
    print "save_list", save_list
    print "tree", new_list
    
#    if x<=y:
#        new_list.append([x,y])
#    else:
#        new_list.append([x])
        
new_tree = th.list_to_tree(new_list)
print new_tree
# ---------- end python_27 ----------
unflatten = UnflattenTree(Tree=python_27.S, Guide=python_27.new_tree)
pt_9 = Point(unflatten)

supp_4 = SupportKaramba3D(PosInd=pt_9, PlaneOfReference=pln_2, menu=[buttons(on, on, on, on, on, on)])
support_4 = SupportKaramba3D(supp_4)

entwine_5 = Entwine(Branch00=support_4, Branch01=support_3, Branch02=support, Branch03=support_2, FlattenInputs=True)  # -> flatten(Result)

support_5 = SupportKaramba3D(flatten(entwine_5))

lng_7 = ListLength(List=support_5)
subtraction_7 = Subtraction(A=lng_7, B="1")
split_7 = SplitList(List=support_5, Index=subtraction_7)  # -> ListA, ListB
support_6 = SupportKaramba3D(split_7.ListA)

support_7 = SupportKaramba3D(flatten(support_5))
assemble = AssembleModelKaramba3D(Elem=flatten(element_7), Support=flatten(support_7), Load=flatten(load_6), Joint=flatten(joint_6), LimitDistance_m=0.005)  # -> Model, Info, Mass_kg, CenterOfGravity

support_8 = SupportKaramba3D(flatten(support_6))
assemble_2 = AssembleModelKaramba3D(Elem=flatten(element_8), Support=flatten(support_8), Load=flatten(load_7), Joint=flatten(joint_7), LimitDistance_m=0.005)  # -> Model, Info, Mass_kg, CenterOfGravity

support_9 = SupportKaramba3D(flatten(support_6))
assemble_3 = AssembleModelKaramba3D(Elem=flatten(element_9), Support=flatten(support_9), Load=flatten(load_8), Joint=flatten(joint_8), LimitDistance_m=0.005)  # -> Model, Info, Mass_kg, CenterOfGravity

analyze = AnalyzeKaramba3D(Model=assemble.Model)  # -> CalculatedModel, MaximumDisplacement_cm, ResultingForceOfGravity_kN, ElasticEnergy_kNm
model = ModelKaramba3D(analyze.CalculatedModel)
num_16 = Number(analyze.MaximumDisplacement_cm)
num_17 = Number(analyze.ElasticEnergy_kNm)

model_2 = ModelKaramba3D(model)
activate = ElementActivationKaramba3D(Model=model_2, IsActive=python_24.on_list)

analyze_2 = AnalyzeKaramba3D(Model=activate)  # -> CalculatedModel, MaximumDisplacement_cm, ResultingForceOfGravity_kN, ElasticEnergy_kNm
model_3 = ModelKaramba3D(analyze_2.CalculatedModel)
num_18 = Number(analyze_2.ElasticEnergy_kNm)
num_19 = Number(analyze_2.MaximumDisplacement_cm)

analyze_3 = AnalyzeKaramba3D(Model=assemble_2.Model)  # -> CalculatedModel, MaximumDisplacement_cm, ResultingForceOfGravity_kN, ElasticEnergy_kNm
num_20 = Number(analyze_3.ElasticEnergy_kNm)
num_21 = Number(analyze_3.MaximumDisplacement_cm)
model_4 = ModelKaramba3D(analyze_3.CalculatedModel)

model_5 = ModelKaramba3D(model_4)
activate_2 = ElementActivationKaramba3D(Model=model_5, IsActive=python_25.on_list)

analyze_4 = AnalyzeKaramba3D(Model=activate_2)  # -> CalculatedModel, MaximumDisplacement_cm, ResultingForceOfGravity_kN, ElasticEnergy_kNm
num_22 = Number(analyze_4.ElasticEnergy_kNm)
model_6 = ModelKaramba3D(analyze_4.CalculatedModel)
num_23 = Number(analyze_4.MaximumDisplacement_cm)

analyze_5 = AnalyzeKaramba3D(Model=assemble_3.Model)  # -> CalculatedModel, MaximumDisplacement_cm, ResultingForceOfGravity_kN, ElasticEnergy_kNm
num_24 = Number(analyze_5.MaximumDisplacement_cm)
num_25 = Number(analyze_5.ElasticEnergy_kNm)
model_7 = ModelKaramba3D(analyze_5.CalculatedModel)

model_8 = ModelKaramba3D(model_7)
activate_3 = ElementActivationKaramba3D(Model=model_8, IsActive=python_26.on_list)

analyze_6 = AnalyzeKaramba3D(Model=activate_3)  # -> CalculatedModel, MaximumDisplacement_cm, ResultingForceOfGravity_kN, ElasticEnergy_kNm
model_9 = ModelKaramba3D(analyze_6.CalculatedModel)
num_26 = Number(analyze_6.MaximumDisplacement_cm)
num_27 = Number(analyze_6.ElasticEnergy_kNm)

deflection_cm = Panel(num_16)
internal_energy = Panel(num_17)
deflection_cm_2 = Panel(num_19)
internal_energy_2 = Panel(num_18)

deflection_cm_3 = Panel(num_21)
internal_energy_3 = Panel(num_20)
deflection_cm_4 = Panel(num_23)
internal_energy_4 = Panel(num_22)

deflection_cm_5 = Panel(num_24)
internal_energy_5 = Panel(num_25)
internal_energy_6 = Panel(num_27)
deflection_cm_6 = Panel(num_26)

model_10 = ModelKaramba3D(model_6)
num_28 = Number(num_18)
num_29 = Number(num_22)
num_30 = Number(num_27)
model_11 = ModelKaramba3D(model_3)
model_12 = ModelKaramba3D(model_9)
filter_2 = StreamFilter(Gate=list_3, Stream0=num_28, Stream1=num_29, Stream2=num_30)
filter_3 = StreamFilter(Gate=list_3, Stream0=model_11, Stream1=model_10, Stream2=model_12)

model_13 = ModelKaramba3D(filter_3)
model_14 = ModelKaramba3D(model_13)
model_15 = ModelKaramba3D(model_13)
model_16 = ModelKaramba3D(model_13)
model_17 = ModelKaramba3D(model_13)
model_18 = ModelKaramba3D(model_13)
d_energy = DeformationEnergyKaramba3D(AnalyzedModel=model_18, ResultCase=0)  # -> AnalyzedModel, flatten(AxialDeformationEnergies_kNm), flatten(BendingEnergies_kNm)
beamdisp = BeamDisplacementsKaramba3D(AnalyzedModel=model_15, LoadCase=-1, MaximumDistanceBetweenResults_m=-1, NumberOfResultsPerElement=2)  # -> AnalyzedModel, Translations_m, Rotations_rad
utilization = UtilizationOfElementsKaramba3D(
    AnalyzedModel=model_16,
    ResultCase=-1,
    NumberOfSamplePoints=3,
    ElasticDesign=True,
    GammaM0=1,
    GammaM1=1,
    WithDetails=False,
    mode="Beams")  # -> AnalyzedModel, Utilization, SigMax_kN_cm2, SigMin_kN_cm2, TauMax_kN_cm2, UtilN, UtilVy, UtilVz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
nodedisp = NodalDisplacementsKaramba3D(AnalyzedModel=model_17, ResultCase=0)  # -> AnalyzedModel, NodalTranslations_m, NodalRotations_rad
modelview = ModelViewKaramba3D(Model=model_14, ResultFactors="1000", ResultCase=-1, Colors=col)  # -> Model, DeformedMesh, DeformedAxes, DeformedModel
panel_55 = Panel(d_energy.BendingEnergies_kNm)
panel_56 = Panel(d_energy.AxialDeformationEnergies_kNm)
beamview = BeamViewKaramba3D(Model=modelview.Model)  # -> Model, MeshesOfRenderedBeams, DeformedBeamAxes, LegendColors, LegendTags
panel_57 = Panel(nodedisp.NodalTranslations_m)
legend = Legend(Colour=beamview.LegendColors, Tags=beamview.LegendTags, LegendType=101)
panel_58 = Panel(beamdisp.Translations_m)

ma = MassAddition(Input=d_energy.AxialDeformationEnergies_kNm)  # -> Result, PartialResults
ma_2 = MassAddition(Input=d_energy.BendingEnergies_kNm)  # -> Result, PartialResults
lng_8 = ListLength(List=d_energy.AxialDeformationEnergies_kNm)
num_31 = Number(filter_2)
division_3 = Division(A=ma.Result, B=lng_8)
division_4 = Division(A=ma_2.Result, B=lng_8)
rec = DataRecorder(division_4, DataLimit=-10, RecordData=False)
rec_2 = DataRecorder(num_31, DataLimit=-10, RecordData=False)
rec_3 = DataRecorder(division_3, DataLimit=-10, RecordData=False)
data_21 = Data(rec_2)
data_22 = Data(rec_3)
data_23 = Data(rec)

data_24 = Data(data_22)
data_25 = Data(data_21)
data_26 = Data(data_23)
axial = Panel(data_24)
bending = Panel(data_26)
total = Panel(data_25)
