# Grasshopper definition rigidity_test.gh (Grasshopper 1.0.7)
# plug-ins: karambaGH

list = ValueList({"phase 1": 0, "phase 2a": 1, "phase 2b": 2, "phase 3a": 3, "phase 3b": 4}, selected="phase 2a")
crv = Curve([<curve referenced from the Rhino model> x10])
crv_2 = Curve([<curve referenced from the Rhino model> x11])
crv_3 = Curve([<curve referenced from the Rhino model> x11])
crv_4 = Curve([<curve referenced from the Rhino model> x12])
crv_5 = Curve([<curve referenced from the Rhino model> x12])
pt = Point([<point referenced from the Rhino model> x4])
pt_2 = Point([<point referenced from the Rhino model> x3])
pt_3 = Point([<point referenced from the Rhino model> x3])
pt_4 = Point([<point referenced from the Rhino model> x3])
pt_5 = Point([<point referenced from the Rhino model> x4])
filter = StreamFilter(Gate=list, Stream0=crv, Stream1=crv_2, Stream2=crv_3, Stream3=crv_4, Stream4=crv_5)
filter_2 = StreamFilter(Gate=list, Stream0=pt_4, Stream1=pt, Stream2=pt_2, Stream3=pt_5, Stream4=pt_3)
crv_6 = Curve(filter)
pt_6 = Point(filter_2)
pt_7 = Point(<point referenced from the Rhino model>)
item = ListItem(List=pt_6, Index=0, Wrap=False)  # -> Item, Item1, Item2, Item3

crv_7 = Curve([<curve referenced from the Rhino model> x6])
pt_8 = Point(<point referenced from the Rhino model>)
pt_9 = Point(<point referenced from the Rhino model>)

division = Division(A="1050", B="3")
matprops = MaterialPropertiesKaramba3D(
    FamilyOfMaterial="wood",
    Name="poplar",
    YoungsModulus_kN_cm2="1050",
    InPlaneShearModulus_kN_cm2=division,
    TransverseShearModulus_kN_cm2=division,
    SpecificWeight_kN_m3="6",
    CoefficientOfThermalExpansion_1_C=1e-05,
    YieldStrength_kN_cm2=23.5,
    mode="Isotrop")
num = Number("0.0333375")
multiplication = Multiplication(A=num, B=100)
material = MaterialKaramba3D(matprops)
number = Number(multiplication)
number_2 = Number(multiplication)
cross_section = CrossSectionKaramba3D(
    FamilyNameOfCrossSection="DefaultCroSec",
    Material=material,
    Height_cm=number,
    UpperFlangeWidth_cm=number_2,
    LowerFlangeWidth_cm=number_2,
    mode="Trapezoid")
crosec = CrossSectionKaramba3D(cross_section)

crv_8 = Curve(crv_6)
midpt = CurveMiddle(Curve=crv_8)
pl = PlaneNormal(Origin=midpt, ZAxis=crv_8)
pflip = FlipPlane(Plane=pl, ReverseX=False, ReverseY=False, SwapAxes=True)
deplane = DeconstructPlane(Plane=pflip)  # -> Origin, XAxis, YAxis, ZAxis
pl_2 = ConstructPlane(Origin=deplane.Origin, XAxis=deplane.ZAxis, YAxis=expr("-x", deplane.YAxis))

number_slider = Slider(4, range=0..5)

end = EndPoints(Curve=crv_8)  # -> Start, End
equals = Equality(FirstNumber=item.Item1, SecondNumber=end.Start)  # -> Equality, Inequality
equals_2 = Equality(FirstNumber=item.Item1, SecondNumber=end.End)  # -> Equality, Inequality
equals_3 = Equality(FirstNumber=item.Item2, SecondNumber=end.Start)  # -> Equality, Inequality
equals_4 = Equality(FirstNumber=item.Item2, SecondNumber=end.End)  # -> Equality, Inequality
equals_5 = Equality(FirstNumber=item.Item2, SecondNumber=end.Start)  # -> Equality, Inequality
equals_6 = Equality(FirstNumber=item.Item2, SecondNumber=end.End)  # -> Equality, Inequality
equals_7 = Equality(FirstNumber=item.Item3, SecondNumber=end.Start)  # -> Equality, Inequality
equals_8 = Equality(FirstNumber=item.Item3, SecondNumber=end.End)  # -> Equality, Inequality
python = GhPythonScript(s1=equals_5.Equality, s2=equals_6.Equality, e1=equals_7.Equality, e2=equals_8.Equality)  # -> index; inputs s1: list, s2: list, e1: list, e2: list
# ---------- python: Python ----------
save1 = []
for x,y in zip(s1,s2):
    
    if x or y:
        save1.append(1)
    else:
        save1.append(0)
        
print save1

save2 = []
for x,y in zip(e1,e2):
    
    if x or y:
        save2.append(1)
    else:
        save2.append(0)
        
print save2

index = 0
for i, (x,y) in enumerate(zip(save1,save2)):
    
    if x and y:
        index = i
        
print index
# ---------- end python ----------
python_2 = GhPythonScript(s1=equals.Equality, s2=equals_2.Equality, e1=equals_3.Equality, e2=equals_4.Equality)  # -> index; inputs s1: list, s2: list, e1: list, e2: list; same code as python
item_2 = ListItem(List=pl_2, Index=python, Wrap=True)
item_3 = ListItem(List=pl_2, Index=python_2, Wrap=True)
pln = Plane(item_3)
pln_2 = Plane(item_2)

item_4 = ListItem(List=crv_7, Index=number_slider, Wrap=True)
end_2 = EndPoints(Curve=item_4)  # -> Start, End

division_2 = Division(A="1050", B="3")
matprops_2 = MaterialPropertiesKaramba3D(
    FamilyOfMaterial="wood",
    Name="poplar",
    YoungsModulus_kN_cm2="1050",
    InPlaneShearModulus_kN_cm2=division_2,
    TransverseShearModulus_kN_cm2=division_2,
    SpecificWeight_kN_m3="6",
    CoefficientOfThermalExpansion_1_C=1e-05,
    YieldStrength_kN_cm2=23.5,
    mode="Isotrop")
num_2 = Number("0.0333375")
multiplication_2 = Multiplication(A=num_2, B=100)
material_2 = MaterialKaramba3D(matprops_2)
number_3 = Number(multiplication_2)
number_4 = Number(multiplication_2)
cross_section_2 = CrossSectionKaramba3D(
    FamilyNameOfCrossSection="DefaultCroSec",
    Material=material_2,
    Height_cm=number_3,
    UpperFlangeWidth_cm=number_4,
    LowerFlangeWidth_cm=number_4,
    mode="Trapezoid")
crosec_2 = CrossSectionKaramba3D(cross_section_2)

pt_10 = Point(end_2.Start)
pt_11 = Point(end_2.End)
pt_12 = Point(pt_10)
pt_13 = Point(pt_11)
midpt_2 = CurveMiddle(Curve=crv_7)
pl_3 = PlaneNormal(Origin=midpt_2, ZAxis=crv_7)
Z = UnitZ(Factor="-1")

Z_2 = UnitZ(Factor="-1")
pt_14 = Point(pt_7)
loads = LoadsKaramba3D(ForceVector=Z_2, Local=False, PosInd=pt_14, LCase=0, mode="Point")
load = LoadKaramba3D(loads)

pt_15 = Point(item.Item)
pt_16 = Point(item.Item1)
pt_17 = Point(item.Item2)
pt_18 = Point(item.Item3)
supp = SupportKaramba3D(PosInd=pt_15, menu=[buttons(on, on, on, off, off, off)])
supp_2 = SupportKaramba3D(PosInd=pt_16, PlaneOfReference=pln, menu=[buttons(on, on, on, off, off, off)])
supp_3 = SupportKaramba3D(PosInd=pt_17, PlaneOfReference=pln, menu=[buttons(on, on, on, off, off, off)])
supp_4 = SupportKaramba3D(PosInd=pt_18, PlaneOfReference=pln_2, menu=[buttons(on, on, on, off, off, off)])
support = SupportKaramba3D(supp)
support_2 = SupportKaramba3D(supp_2)
support_3 = SupportKaramba3D(supp_3)
support_4 = SupportKaramba3D(supp_4)
merge = Merge(Data1=support, Data2=support_2, Data3=support_3, Data4=support_4)
support_5 = SupportKaramba3D(merge)

pflip_2 = FlipPlane(Plane=pl_3, ReverseX=False, ReverseY=False, SwapAxes=True)
supp_5 = SupportKaramba3D(PosInd=pt_8, menu=[buttons(on, on, on, off, off, off)])
loads_2 = LoadsKaramba3D(ForceVector=Z, Local=False, PosInd=pt_9, LCase=0, mode="Point")
deplane_2 = DeconstructPlane(Plane=pflip_2)  # -> Origin, XAxis, YAxis, ZAxis
load_2 = LoadKaramba3D(loads_2)
pl_4 = ConstructPlane(Origin=deplane_2.Origin, XAxis=expr("-x", deplane_2.ZAxis), YAxis=expr("-x", deplane_2.YAxis))
item_5 = ListItem(List=pl_4, Index=number_slider, Wrap=True)
pln_3 = Plane(item_5)
supp_6 = SupportKaramba3D(PosInd=pt_12, PlaneOfReference=pln_3, menu=[buttons(off, off, on, off, off, off)])
supp_7 = SupportKaramba3D(PosInd=pt_13, PlaneOfReference=pln_3, menu=[buttons(on, off, on, off, off, off)])
support_6 = SupportKaramba3D(supp_5)
support_7 = SupportKaramba3D(supp_6)

crv_9 = Curve(crv_6)
crosec_3 = CrossSectionKaramba3D(crosec)
linetobeam = LineToBeamKaramba3D(
    Line=crv_9,
    CrossSection=crosec_3,
    New=True,
    Remove=True,
    LimitDistance_m=0.005,
    ZOrientation=deplane.XAxis,
    Bending=Toggle(False))  # -> simplify(Element), Points, Info
element = ElementKaramba3D(linetobeam.Element)

support_8 = SupportKaramba3D(supp_7)
merge_2 = Merge(Data1=support_6, Data2=support_7, Data3=support_8)
deplane_3 = DeconstructPlane(Plane=pl_4)  # -> Origin, XAxis, YAxis, ZAxis
support_9 = SupportKaramba3D(merge_2)
linetobeam_2 = LineToBeamKaramba3D(
    Line=crv_7,
    CrossSection=crosec_2,
    New=True,
    Remove=True,
    LimitDistance_m=0.005,
    ZOrientation=deplane_3.ZAxis,
    Bending=Toggle(False))  # -> simplify(Element), Points, Info
support_10 = SupportKaramba3D(flatten(support_9))
element_2 = ElementKaramba3D(flatten(linetobeam_2.Element))
load_3 = LoadKaramba3D(flatten(load_2))
disassemble = DisassembleElementKaramba3D(Element=linetobeam_2.Element)  # -> Element, ElementIdentifier, AxisOfElement, CrossSection, Joints, Material, LocalCoordinateSystem, ElementIsActive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
element_3 = ElementKaramba3D(flatten(element))
support_11 = SupportKaramba3D(flatten(support_5))
load_4 = LoadKaramba3D(flatten(load))
assemble = AssembleModelKaramba3D(Elem=flatten(element_2), Support=flatten(support_10), Load=flatten(load_3), LimitDistance_m=0.005)  # -> Model, Info, Mass_kg, CenterOfGravity
assemble_2 = AssembleModelKaramba3D(Elem=flatten(element_3), Support=flatten(support_11), Load=flatten(load_4), LimitDistance_m=0.005)  # -> Model, Info, Mass_kg, CenterOfGravity
orientate = OrientateElemKaramba3D(mode="Beam")
list_2 = ValueList({"regular": 0, "eigen": 1}, selected="eigen")
analyze = AnalyzeKaramba3D(Model=assemble_2.Model)  # -> CalculatedModel, MaximumDisplacement_cm, ResultingForceOfGravity_kN, ElasticEnergy_kNm
emodes = EigenModesKaramba3D(Model=assemble_2.Model, FromIndex=1, NumberOfModes=1, MaximumNumberOfIterations=300, Epsilon=1e-07)  # -> ModelWithEigenModesAsLoadCaseResults, Eigenvalues
list_3 = ValueList({"regular": 0, "eigen": 1}, selected="regular")
analyze_2 = AnalyzeKaramba3D(Model=assemble.Model)  # -> CalculatedModel, MaximumDisplacement_cm, ResultingForceOfGravity_kN, ElasticEnergy_kNm
emodes_2 = EigenModesKaramba3D(Model=assemble.Model, FromIndex=1, NumberOfModes=1, MaximumNumberOfIterations=300, Epsilon=1e-07)  # -> ModelWithEigenModesAsLoadCaseResults, Eigenvalues
filter_3 = StreamFilter(Gate=list_2, Stream0=analyze_2.CalculatedModel, Stream1=emodes_2.ModelWithEigenModesAsLoadCaseResults)
filter_4 = StreamFilter(Gate=list_2, Stream0="100", Stream1="0.1")
model = ModelKaramba3D(filter_3)
num_3 = Number(filter_4)
filter_5 = StreamFilter(Gate=list_3, Stream0=analyze.CalculatedModel, Stream1=emodes.ModelWithEigenModesAsLoadCaseResults)
filter_6 = StreamFilter(Gate=list_3, Stream0="100", Stream1="0.1")
modelview = ModelViewKaramba3D(Model=model, ResultFactors=num_3, ResultCase=-1)  # -> Model, DeformedMesh, DeformedAxes, DeformedModel
model_2 = ModelKaramba3D(filter_5)
num_4 = Number(filter_6)
modelview_2 = ModelViewKaramba3D(Model=model_2, ResultFactors=num_4, ResultCase=-1)  # -> Model, DeformedMesh, DeformedAxes, DeformedModel; disabled
beamview = BeamViewKaramba3D(Model=modelview_2.Model)  # -> Model, MeshesOfRenderedBeams, DeformedBeamAxes, LegendColors, LegendTags; disabled
